# Grasshopper definition 170320_Sim1_joinmesh_8_print_csv.gh (Grasshopper 0.9.76)
# plug-ins: MeshEdit Components, Python Interpreter, LunchBox, Weaverbird

panel = Panel("C:\Users\Scott\Dropbox\NBI\Vorticity\OUTPUT\Sim_0\Thin_STLs")
rhinopython_filepath = Panel("C:\Users\Scott\Dropbox\NBI\Vorticity\OUTPUT\Thin_STLs")

# ---- group: BBox info
panel_2 = Panel("6.28318530718")
# Plane Pi Numbers
panel_3 = Panel("-3.1415926535")
panel_4 = Panel("+3.1415926535")

# ----
tolerance = Panel("-0.0001")
excelwrite = ExcelWrite(WriteExcelData=False, WorksheetName="Sheet1", ClearSheet=False)

python = PythonScript()  # -> SliderNickNames, SliderGuids
# ---------- python: Python ----------
import Grasshopper as gh

# Get the Grasshopper component, document and objects
ghComp = ghenv.Component
ghDoc = ghComp.OnPingDocument()
ghObjects = ghDoc.Objects

# Iterate the GH objects and get their name/guid if they are a slider
SliderNickNames = []
SliderGuids = []

for obj in ghObjects:
    if type(obj) is gh.Kernel.Special.GH_NumberSlider:
        
        # Get the slider nick name
        name = obj.NickName
        SliderNickNames.append(name)
        
        # Get instance guid
        guid = obj.InstanceGuid
        SliderGuids.append(str(guid))
        
        # Set the value of the sliders named "Foo" and "Ham"
        if name == "Foo" or name == "Ham":
            obj.Slider.Value = 0.42
            obj.ExpireSolution(True)
# ---------- end python ----------
panel_5 = Panel(python.SliderGuids)
panel_6 = Panel(python.SliderNickNames)

# ---- group: DONT DELETE - Iterated in Python
mesh_to_export = Slider(48, range=0..105)

# ----
which_file_number = Slider(419, range=0..420)

# ----
# Read thin STL files in Dir
python_2 = PythonScript(walk_dir=panel, y=which_file_number)  # -> out, a, how_many, current; inputs y: Int32
# ---------- python_2: Python ----------
import os
from os.path import isfile, join

#print('walk_dir = ' + walk_dir)
#print('walk_dir (absolute) = ' + os.path.abspath(walk_dir))

def all_Files_in(direct):
    allFiles = []
    for r, s, f in os.walk(direct):
        for filenavn in f:
            file_path = os.path.join(r, filenavn)
            allFiles.append(file_path)
            #print('\t- file %s (full path: %s)' % (filename, file_path))
    return allFiles

stlfiles = all_Files_in(walk_dir)

for s in stlfiles:
    print s.split('\\')[-1]
    
a = stlfiles[y]
how_many = len(stlfiles)
current = stlfiles[y].split('\\')[-1][:-9]
print current[:-9]
# ---------- end python_2 ----------
panel_7 = Panel(python_2.current)
panel_8 = Panel(python_2.out)
panel_9 = Panel(python_2.how_many)

# ---- group: http://www.grasshopper3d.com/forum/topics/import-an-stl-file-direct-in-grasshopper
path = FilePath(python_2.a)
# Parse STLs to Mesh
vb = VBScript(F=path)  # -> out, Mesh
# ---------- vb: VB ----------
    Dim stl = My.Computer.FileSystem.ReadAllBytes(F)
    print("File length: " & stl.length() & " bytes")
    Dim numtris As Long = BitConverter.ToInt32(stl, 80)
    print("Number of triangles: " & numtris)
    Dim c,pos As Integer
    Dim tempmesh As New mesh
    Dim tempvect As Vector3f
    If (numtris * 50 + 84 = stl.length()) Then
      print("STL file length matches the number of triangle faces")
      For c = 0 To numtris - 1
        pos = c * 50 + 84
        tempvect = readVect3f(stl, pos)
        With tempmesh
          .Vertices.setvertex(c * 3, readPoint3f(stl, pos))
          .Vertices.setvertex(c * 3 + 1, readPoint3f(stl, pos))
          .Vertices.setvertex(c * 3 + 2, readPoint3f(stl, pos))
          .Faces.setface(c, c * 3, c * 3 + 1, c * 3 + 2)
          .Normals.SetNormal(c * 3, tempvect)
          .Normals.SetNormal(c * 3 + 1, tempvect)
          .Normals.SetNormal(c * 3 + 2, tempvect)
        End With
      Next
      tempmesh.Weld(math.PI)
    Else
      print("STL file length does not match the number of triangle faces")
    End If
    Mesh = tempmesh
# ---------- vb: VB additional code ----------
  '
  Private Function readSingle(ByRef stl As Byte(), ByRef pos As Integer) As Single
    readSingle = BitConverter.ToSingle(stl, pos)
    pos = pos + 4
  End Function

  Private Function readVect3f(ByRef stl As Byte(), ByRef pos As Integer) As Vector3f
    readVect3f = New Vector3f(readSingle(stl, pos), readSingle(stl, pos), readSingle(stl, pos))
  End Function

  Private Function readPoint3f(ByRef stl As Byte(), ByRef pos As Integer) As Point3f
    readPoint3f = New Point3f(readSingle(stl, pos), readSingle(stl, pos), readSingle(stl, pos))
  End Function
# ---------- end vb ----------
disjoint = DisjointMesh(Mesh=vb.Mesh)
preview = CustomPreview(
    Geometry=vb.Mesh,
    Shader={ambient=RGB(0, 0, 0), diffuse=RGB(255, 105, 180), emission=RGB(76, 32, 54), shine=0.5, specular=RGB(255, 255, 255), transparency=0})  # disabled

# ----
# Repair Invalid Meshes
python_3 = PythonScript(meshes=disjoint)  # -> out, simplify(valid), inval; inputs meshes: list of Mesh
# ---------- python_3: Python ----------
import rhinoscriptsyntax as rs
import Rhino.Geometry as rg

valid = []
inval = []

for m in meshes:
    if m.IsValid:
        print m, ('yes')
        valid.append(m)
    else:
        print m, ("NO!")
        inval.append(m)
# ---------- end python_3 ----------
explode = MeshExplode(Mesh=python_3.inval, Interpolate=False)  # -> simplify(Faces)
pshift = ShiftPaths(Data=python_3.valid, Offset=-1)
mjoin = MeshJoin(Meshes=explode)  # -> flatten(Mesh)
mesh = Mesh([pshift, mjoin])

python_4 = PythonScript(pi=panel_4, meshes=mesh, toler=tolerance)  # -> out, planes, direction, cut, stitch, virgin; inputs meshes: list of Mesh; disabled
# ---------- python_4: Python ----------
import Rhino.Geometry as rg
import rhinoscriptsyntax as rs

x_pos = rg.Plane(rg.Point3d(pi + toler,0,0),rg.Vector3d(pi,0,0))
x_neg = rg.Plane(rg.Point3d(-pi - toler,0,0),rg.Vector3d(-pi,0,0))
y_pos = rg.Plane(rg.Point3d(0,pi + toler,0),rg.Vector3d(0,pi,0))
y_neg = rg.Plane(rg.Point3d(0,-pi - toler,0),rg.Vector3d(0,-pi,0))
z_pos = rg.Plane(rg.Point3d(0,0,pi + toler),rg.Vector3d(0,0,pi))
z_neg = rg.Plane(rg.Point3d(0,0,-pi - toler),rg.Vector3d(0,0,-pi))

orig_planes = [x_neg, x_pos, y_pos, y_neg, x_pos, z_neg]
planes = []
direction = []
cut = []
stitch = []
virgin = []

for m in meshes:
    # X
    if rg.Intersect.Intersection.MeshPlane(m, x_pos):
        cut.append(m)
        planes.append(x_pos)
        direction.append('X')
    elif rg.Intersect.Intersection.MeshPlane(m, x_neg):
        stitch.append(m)
        planes.append(x_neg)
        direction.append('X')
    # Y
    elif rg.Intersect.Intersection.MeshPlane(m, y_pos):
        cut.append(m)
        planes.append(y_pos)
        direction.append('Y')
    elif rg.Intersect.Intersection.MeshPlane(m, y_neg):
        stitch.append(m)
        planes.append(y_neg)
        direction.append('Y')
    # Z
    elif rg.Intersect.Intersection.MeshPlane(m, z_pos):
        cut.append(m)
        planes.append(z_pos)
        direction.append('Z')
    elif rg.Intersect.Intersection.MeshPlane(m, z_neg):
        stitch.append(m)
        planes.append(z_neg)
        direction.append('Z')
    
    # Untouched
    else:
        virgin.append(m)

if len(meshes)== len(cut) + len(stitch) + len(virgin) and len(cut) == len(stitch):
    print 'PASSES - ' #+ direction
else:
    print 'FAILS - ' #+ direction 

print '-'
print 'Total -', len(meshes)
print 'Cut -', len(cut), 'Stitch -', len(stitch)
print 'Untouched -', len(virgin)
print '-'
print 'To Export -', len(virgin) + len(cut)
# ---------- end python_4 ----------
# Sort Meshes
panel_10 = Panel(python_4.out)

mesh_virgin = Mesh(simplify(flatten(python_4.virgin)))
mesh_stitch = Mesh(graft(python_4.stitch))
mesh_cut = Mesh(graft(python_4.cut))

python_5 = PythonScript(direction=python_4.direction, two_pi=panel_2)  # -> graft(v_out), sort_vec
# ---------- python_5: Python ----------
import rhinoscriptsyntax as rs
import Rhino.Geometry as rg

"""
Takes Filament direction of the file and
returns Vector3d for that direction.
Only x,y, or z
"""

print direction

sort_vec = None

if direction == 'X':
    v_out = rg.Vector3d(two_pi,0,0)
    sort_vec = 'Y'
elif direction == 'Y':
    v_out = rg.Vector3d(0,two_pi,0)
    sort_vec = 'Z'
elif direction == 'Z':
    v_out = rg.Vector3d(0,0,two_pi)
    sort_vec = 'X'
# ---------- end python_5 ----------
rev = Reverse(Vector=python_5.v_out)
# Move
# Align Data
move = Move(Geometry=mesh_cut, Motion=rev)  # -> graft(Geometry), Transform

# ---- group: Sort in Plane
wbnaked = WeaverbirdsNakedBoundary(MeshClosedPolylines=mesh_stitch)  # -> flatten(NakedCurves)
wbnaked_2 = WeaverbirdsNakedBoundary(MeshClosedPolylines=mesh_cut)  # -> flatten(NakedCurves)
area = Area(Geometry=wbnaked_2)  # -> Area, graft(Centroid)
area_2 = Area(Geometry=wbnaked)  # -> Area, graft(Centroid)
pdecon = Deconstruct(Point=area_2.Centroid)  # -> flatten(XComponent), flatten(YComponent), flatten(ZComponent)
pdecon_2 = Deconstruct(Point=area.Centroid)  # -> flatten(XComponent), flatten(YComponent), flatten(ZComponent)
python_6 = PythonScript(X=pdecon.XComponent, Y=pdecon.YComponent, Z=pdecon.ZComponent, sort_vec=python_5.sort_vec)  # -> keys; inputs X: list, Y: list, Z: list
# ---------- python_6: Python ----------
print X, Y, Z


if sort_vec == 'X':
    keys = [t for t in X]
elif sort_vec == 'Y':
    keys = [t for t in Y]
elif sort_vec == 'Z':
    keys = [t for t in Z]
# ---------- end python_6 ----------
python_7 = PythonScript(X=pdecon_2.XComponent, Y=pdecon_2.YComponent, Z=pdecon_2.ZComponent, sort_vec=python_5.sort_vec)  # -> keys; inputs X: list, Y: list, Z: list; same code as python_6
sort = SortList(Keys=python_6, ValuesA=flatten(mesh_stitch))  # -> Keys, simplify(graft(ValuesA))
sort_2 = SortList(Keys=python_7, ValuesA=flatten(move.Geometry))  # -> Keys, simplify(graft(ValuesA))
mesh_2 = Mesh(simplify(sort.ValuesA))
mesh_3 = Mesh(simplify(sort_2.ValuesA))

# ----
# WELD Seams
wbjoin = WeaverbirdsJoinMeshesAndWeld(Mesh=[mesh_3, mesh_2], Weld=True)

# ---- group: Average Edge Length
medges = MeshEdges(Mesh=wbjoin)  # -> NakedEdges, InteriorEdges, NonManifoldEdges; disabled
len = Length(Curve=medges.NakedEdges)  # -> flatten(Length); disabled
avr = Average(Input=len)  # disabled
avg_edge_length = Panel(avr)  # disabled

# ----
weldvertices = MeshWeldVertices(Mesh=wbjoin, Tolerance="0.01")  # -> RuntimeMessage, flatten(Mesh)

# ---- group: Cull tiny, unused meshes
python_8 = PythonScript(meshes=mesh_virgin)  # -> out, a, culled; inputs meshes: list of Mesh
# ---------- python_8: Python ----------
import Rhino.Geometry as rg

a = []
culled = []

min_faces = 100

print "Min faces =", min_faces

for m in meshes:
    print m.Faces.Count
    if m.Faces.Count > min_faces:
        a.append(m)
    else:
        culled.append(m)
# ---------- end python_8 ----------

# ---- group: Fresh Sewn Chips
mesh_4 = Mesh(weldvertices.Mesh)

# ---- group: All Chips
mesh_5 = Mesh([python_8.a, mesh_4])

# ----
# Export to Individual 3dms
python_9 = PythonScript(meshes=mesh_5)  # -> out, a, num_meshes; inputs meshes: list of Mesh
# ---------- python_9: Python ----------
import Rhino.Geometry as rg

a = []

for m in meshes:
    print m.Faces.Count
    if m.Faces.Count > 100:
        a.append(m)
    else:
        pass

num_meshes = len(a)
# ---------- end python_9 ----------
panel_11 = Panel("""_RunPythonScript in Rhino
"Automate_Export_Individual_Meshes_01"
""")
panel_12 = Panel(python_9.num_meshes)
mesh_6 = Mesh(python_9.a)
meshes = PythonScript(num_meshes=python_9.num_meshes)  # -> out; inputs num_meshes: Int32; disabled
# ---------- meshes: Python ----------
import scriptcontext as sc


sc.sticky["Meshes_To_Export"] = num_meshes

print num_meshes, ' variable copied to sticky variable to Rhino Python editor'
# ---------- end meshes ----------
item = ListItem(List=mesh_6, Index=mesh_to_export, Wrap=False)

# ---- group: DONT DELETE - Baked in Python
geo_to_export = Geometry(item)
