# Grasshopper definition 170328_Sim0_Vorticity_joinmesh_9.gh (Grasshopper 0.9.76)
# plug-ins: MeshEdit Components, Python Interpreter, Weaverbird

panel = Panel("C:\Users\Scott\Dropbox\NBI\Vorticity\OUTPUT\Sim_0\Thin_STLs")
rhinopython_filepath = Panel("C:\Users\Scott\Dropbox\NBI\Vorticity\OUTPUT\Sim_0\FBXs")

# ---- group: BBox info
panel_2 = Panel("6.28318530718")
# Plane Pi Numbers
panel_3 = Panel("-3.1415926535")
panel_4 = Panel("+3.1415926535")

# ----
tolerance = Panel("-0.0001")

python = PythonScript()  # -> SliderNickNames, SliderGuids
# ---------- python: Python ----------
import Grasshopper as gh

# Get the Grasshopper component, document and objects
ghComp = ghenv.Component
ghDoc = ghComp.OnPingDocument()
ghObjects = ghDoc.Objects

# Iterate the GH objects and get their name/guid if they are a slider
SliderNickNames = []
SliderGuids = []

for obj in ghObjects:
    if type(obj) is gh.Kernel.Special.GH_NumberSlider:
        
        # Get the slider nick name
        name = obj.NickName
        SliderNickNames.append(name)
        
        # Get instance guid
        guid = obj.InstanceGuid
        SliderGuids.append(str(guid))
        
        # Set the value of the sliders named "Foo" and "Ham"
        if name == "Foo" or name == "Ham":
            obj.Slider.Value = 0.42
            obj.ExpireSolution(True)
# ---------- end python ----------
panel_5 = Panel(python.SliderGuids)
panel_6 = Panel(python.SliderNickNames)

# ---- group: DONT DELETE - Iterated in Python
mesh_to_export = Slider(0, range=0..200)

# ----
which_file_number = Slider(42, range=0..425)

# ----
# Read thin STL files in Dir
python_2 = PythonScript(walk_dir=panel, y=which_file_number)  # -> out, a, how_many, current; inputs y: Int32
# ---------- python_2: Python ----------
import os
from os.path import isfile, join

#print('walk_dir = ' + walk_dir)
#print('walk_dir (absolute) = ' + os.path.abspath(walk_dir))

def all_Files_in(direct):
    allFiles = []
    for r, s, f in os.walk(direct):
        for filenavn in f:
            file_path = os.path.join(r, filenavn)
            allFiles.append(file_path)
            #print('\t- file %s (full path: %s)' % (filename, file_path))
    return allFiles

stlfiles = all_Files_in(walk_dir)

for s in stlfiles:
    print s.split('\\')[-1]
    
a = stlfiles[y]
how_many = len(stlfiles)
current = stlfiles[y].split('\\')[-1][:-9]
print current[:-9]
# ---------- end python_2 ----------
panel_7 = Panel(python_2.current)
panel_8 = Panel(python_2.out)
panel_9 = Panel(python_2.how_many)

# ---- group: http://www.grasshopper3d.com/forum/topics/import-an-stl-file-direct-in-grasshopper
path = FilePath(python_2.a)
# Parse STLs to Mesh
vb = VBScript(F=path)  # -> out, Mesh
# ---------- vb: VB ----------
    Dim stl = My.Computer.FileSystem.ReadAllBytes(F)
    print("File length: " & stl.length() & " bytes")
    Dim numtris As Long = BitConverter.ToInt32(stl, 80)
    print("Number of triangles: " & numtris)
    Dim c,pos As Integer
    Dim tempmesh As New mesh
    Dim tempvect As Vector3f
    If (numtris * 50 + 84 = stl.length()) Then
      print("STL file length matches the number of triangle faces")
      For c = 0 To numtris - 1
        pos = c * 50 + 84
        tempvect = readVect3f(stl, pos)
        With tempmesh
          .Vertices.setvertex(c * 3, readPoint3f(stl, pos))
          .Vertices.setvertex(c * 3 + 1, readPoint3f(stl, pos))
          .Vertices.setvertex(c * 3 + 2, readPoint3f(stl, pos))
          .Faces.setface(c, c * 3, c * 3 + 1, c * 3 + 2)
          .Normals.SetNormal(c * 3, tempvect)
          .Normals.SetNormal(c * 3 + 1, tempvect)
          .Normals.SetNormal(c * 3 + 2, tempvect)
        End With
      Next
      tempmesh.Weld(math.PI)
    Else
      print("STL file length does not match the number of triangle faces")
    End If
    Mesh = tempmesh
# ---------- vb: VB additional code ----------
  '
  Private Function readSingle(ByRef stl As Byte(), ByRef pos As Integer) As Single
    readSingle = BitConverter.ToSingle(stl, pos)
    pos = pos + 4
  End Function

  Private Function readVect3f(ByRef stl As Byte(), ByRef pos As Integer) As Vector3f
    readVect3f = New Vector3f(readSingle(stl, pos), readSingle(stl, pos), readSingle(stl, pos))
  End Function

  Private Function readPoint3f(ByRef stl As Byte(), ByRef pos As Integer) As Point3f
    readPoint3f = New Point3f(readSingle(stl, pos), readSingle(stl, pos), readSingle(stl, pos))
  End Function
# ---------- end vb ----------
disjoint = DisjointMesh(Mesh=vb.Mesh)
preview = CustomPreview(
    Geometry=vb.Mesh,
    Shader={ambient=RGB(0, 0, 0), diffuse=RGB(255, 105, 180), emission=RGB(76, 32, 54), shine=0.5, specular=RGB(255, 255, 255), transparency=0})  # disabled

# ----
python_3 = PythonScript(meshes=disjoint)  # -> out, simplify(valid), inval; inputs meshes: list of Mesh
# ---------- python_3: Python ----------
import rhinoscriptsyntax as rs
import Rhino.Geometry as rg

valid = []
inval = []

for m in meshes:
    if m.IsValid:
        print m, ('yes')
        valid.append(m)
    else:
        print m, ("NO!")
        inval.append(m)
# ---------- end python_3 ----------
explode = MeshExplode(Mesh=python_3.inval, Interpolate=False)  # -> simplify(Faces)
# Repair Invalid Meshes
pshift = ShiftPaths(Data=python_3.valid, Offset=-1)
mjoin = MeshJoin(Meshes=explode)  # -> flatten(Mesh)
mesh = Mesh([pshift, mjoin])

python_4 = PythonScript(pi=panel_4, meshes=mesh, toler=tolerance)  # -> out, planes, direction, cut, stitch, virgin; inputs meshes: list of Mesh
# ---------- python_4: Python ----------
import Rhino.Geometry as rg
import rhinoscriptsyntax as rs

x_pos = rg.Plane(rg.Point3d(pi + toler,0,0),rg.Vector3d(pi,0,0))
x_neg = rg.Plane(rg.Point3d(-pi - toler,0,0),rg.Vector3d(-pi,0,0))
y_pos = rg.Plane(rg.Point3d(0,pi + toler,0),rg.Vector3d(0,pi,0))
y_neg = rg.Plane(rg.Point3d(0,-pi - toler,0),rg.Vector3d(0,-pi,0))
z_pos = rg.Plane(rg.Point3d(0,0,pi + toler),rg.Vector3d(0,0,pi))
z_neg = rg.Plane(rg.Point3d(0,0,-pi - toler),rg.Vector3d(0,0,-pi))

orig_planes = [x_neg, x_pos, y_pos, y_neg, x_pos, z_neg]
planes = []
direction = None
cut = []
stitch = []
virgin = []

for m in meshes:
    # X
    if rg.Intersect.Intersection.MeshPlane(m, x_pos):
        cut.append(m)
        planes.append(x_pos)
        direction = 'X'
    elif rg.Intersect.Intersection.MeshPlane(m, x_neg):
        stitch.append(m)
        planes.append(x_neg)
    
    # Y
    elif rg.Intersect.Intersection.MeshPlane(m, y_pos):
        cut.append(m)
        planes.append(y_pos)
        direction = 'Y'
    elif rg.Intersect.Intersection.MeshPlane(m, y_neg):
        stitch.append(m)
        planes.append(y_neg)
    
    # Z
    elif rg.Intersect.Intersection.MeshPlane(m, z_pos):
        cut.append(m)
        planes.append(z_pos)
        direction = 'Z'
    elif rg.Intersect.Intersection.MeshPlane(m, z_neg):
        stitch.append(m)
        planes.append(z_neg)
    
    # Untouched
    else:
        virgin.append(m)

if len(meshes)== len(cut) + len(stitch) + len(virgin) and len(cut) == len(stitch):
    print 'PASSES - ' + direction
else:
    print 'FAILS - ' + direction 

print '-'
print 'Total -', len(meshes)
print 'Cut -', len(cut), 'Stitch -', len(stitch)
print 'Untouched -', len(virgin)
print '-'
print 'To Export -', len(virgin) + len(cut)
# ---------- end python_4 ----------
# Sort Meshes
panel_10 = Panel(python_4.out)
python_5 = PythonScript(direction=python_4.direction, two_pi=panel_2)  # -> v_out, sort_vec
# ---------- python_5: Python ----------
import rhinoscriptsyntax as rs
import Rhino.Geometry as rg

"""
Takes Filament direction of the file and
returns Vector3d for that direction.
Only x,y, or z
"""

print direction

sort_vec = None

if direction == 'X':
    v_out = rg.Vector3d(two_pi,0,0)
    sort_vec = 'Y'
elif direction == 'Y':
    v_out = rg.Vector3d(0,two_pi,0)
    sort_vec = 'Z'
elif direction == 'Z':
    v_out = rg.Vector3d(0,0,two_pi)
    sort_vec = 'X'
# ---------- end python_5 ----------

mesh_virgin = Mesh(simplify(flatten(python_4.virgin)))
mesh_stitch = Mesh(graft(python_4.stitch))
mesh_cut = Mesh(graft(python_4.cut))

rev = Reverse(Vector=python_5.v_out)
# Move
move = Move(Geometry=mesh_cut, Motion=rev)  # -> graft(Geometry), Transform

# ---- group: Cull tiny, unused meshes
python_6 = PythonScript(meshes=mesh_virgin)  # -> out, a, culled; inputs meshes: list of Mesh
# ---------- python_6: Python ----------
import Rhino.Geometry as rg

a = []
culled = []

min_faces = 100

print "Min faces =", min_faces

for m in meshes:
    print m.Faces.Count
    if m.Faces.Count > min_faces:
        a.append(m)
    else:
        culled.append(m)
# ---------- end python_6 ----------

# ---- group: Sort in Plane
wbnaked = WeaverbirdsNakedBoundary(MeshClosedPolylines=mesh_cut)  # -> flatten(NakedCurves)
wbnaked_2 = WeaverbirdsNakedBoundary(MeshClosedPolylines=mesh_stitch)  # -> flatten(NakedCurves)

# ----
# Align Data
python_7 = PythonScript(crv=wbnaked)  # -> crvs; inputs crv: list of Curve
# ---------- python_7: Python ----------
import Rhino.Geometry as rg
import rhinoscriptsyntax as rs

"""
Input: Crv List
Output: Crv List
    culls small curves (from double cuts)
"""

crvs = []

for c in crv:
    if len(rs.CurvePoints(c)) < 10:
        pass
    else:
        crvs.append(c)
# ---------- end python_7 ----------
python_8 = PythonScript(crv=python_7)  # -> graft(kinda_ctrs), pts; inputs crv: list of Curve
# ---------- python_8: Python ----------
import Rhino.Geometry as rg
import rhinoscriptsyntax as rs

"""
Input: List of Crvs
Output: List of Points
    Points are the average of all Control Points on the Crv
    (In lieu of geometric centroid)
"""


kinda_ctrs = []

pts = []

for c in crv:

    all_Pts = rs.CurvePoints(c)
    
    print all_Pts[0]

    aveX = 0
    aveY = 0
    aveZ = 0

    for a in all_Pts:
        aveX += a[0]
        aveY += a[1]
        aveZ += a[2]

    denom = len(all_Pts)
    
    avg_Pt = rg.Point3d(aveX/denom, aveY/denom, aveZ/denom)
    
    kinda_ctrs.append(avg_Pt)
# ---------- end python_8 ----------
python_9 = PythonScript(crv=wbnaked_2, ms=flatten(mesh_stitch))  # -> crvs; inputs crv: list of Curve, ms: list of Mesh
# ---------- python_9: Python ----------
import Rhino.Geometry as rg
import rhinoscriptsyntax as rs

"""
Input: Crv List
Output: Crv List
    culls small curves (from double cuts)
"""

crvs = []
testcrvs = []
meshes = []

all_verts = []

for i, m in enumerate(ms):
    for c in crv:
        if rs.CurveEndPoint(c) in m.Vertices:
            testcrvs[i] = c

    #all_verts.append(m.Vertices)
print len(ms)
print len(testcrvs)

for c in crv:
    # if crv start point is part of mesh AND not in mesh already, add crv, mesh
    start = rs.CurveEndPoint(c)
    
    if start in ms.Vertices and ms not in meshes:
        crvs.append(c)
    else:
        pass
# ---------- end python_9 ----------
python_10 = PythonScript(crv=python_9)  # -> graft(pseudo_centroid); inputs crv: list of Curve
# ---------- python_10: Python ----------
import Rhino.Geometry as rg
import rhinoscriptsyntax as rs

"""
Input: List of Crvs
Output: List of Points
    Points are the average of all Control Points on the Crv
    (In lieu of geometric centroid)
"""

kinda_ctrs = []
pts = []

for c in crv:

    all_Pts = rs.CurvePoints(c)
    
    print all_Pts[0]

    aveX = 0
    aveY = 0
    aveZ = 0

    for a in all_Pts:
        aveX += a[0]
        aveY += a[1]
        aveZ += a[2]

    denom = len(all_Pts)
    
    avg_Pt = rg.Point3d(aveX/denom, aveY/denom, aveZ/denom)
    
    kinda_ctrs.append(avg_Pt)
# ---------- end python_10 ----------

# ---- group: Sort in Plane (continued)
pdecon = Deconstruct(Point=python_10)  # -> flatten(XComponent), flatten(YComponent), flatten(ZComponent)
pdecon_2 = Deconstruct(Point=python_8.kinda_ctrs)  # -> flatten(XComponent), flatten(YComponent), flatten(ZComponent)
python_11 = PythonScript(X=pdecon.XComponent, Y=pdecon.YComponent, Z=pdecon.ZComponent, sort_vec=python_5.sort_vec)  # -> keys; inputs X: list, Y: list, Z: list
# ---------- python_11: Python ----------
print X, Y, Z


if sort_vec == 'X':
    keys = [t for t in X]
elif sort_vec == 'Y':
    keys = [t for t in Y]
elif sort_vec == 'Z':
    keys = [t for t in Z]
# ---------- end python_11 ----------
python_12 = PythonScript(X=pdecon_2.XComponent, Y=pdecon_2.YComponent, Z=pdecon_2.ZComponent, sort_vec=python_5.sort_vec)  # -> keys; inputs X: list, Y: list, Z: list; same code as python_11
sort = SortList(Keys=python_11, ValuesA=flatten(mesh_stitch))  # -> Keys, simplify(graft(ValuesA))
sort_2 = SortList(Keys=python_12, ValuesA=flatten(move.Geometry))  # -> Keys, simplify(graft(ValuesA))
mesh_2 = Mesh(simplify(sort.ValuesA))
mesh_3 = Mesh(simplify(sort_2.ValuesA))

# ----
# WELD Seams
wbjoin = WeaverbirdsJoinMeshesAndWeld(Mesh=[mesh_3, mesh_2], Weld=True)

# ---- group: Average Edge Length
medges = MeshEdges(Mesh=wbjoin)  # -> NakedEdges, InteriorEdges, NonManifoldEdges; disabled
len = Length(Curve=medges.NakedEdges)  # -> flatten(Length); disabled
avr = Average(Input=len)  # disabled
avg_edge_length = Panel(avr)  # disabled

# ----
weldvertices = MeshWeldVertices(Mesh=wbjoin, Tolerance="0.01")  # -> RuntimeMessage, flatten(Mesh)

# ---- group: Fresh Sewn Chips
mesh_4 = Mesh(weldvertices.Mesh)

# ---- group: All Chips
mesh_5 = Mesh([python_6.a, mesh_4])

# ----
# Export to Individual 3dms
python_13 = PythonScript(meshes=mesh_5)  # -> out, a, num_meshes; inputs meshes: list of Mesh
# ---------- python_13: Python ----------
import Rhino.Geometry as rg

a = []

for m in meshes:
    print m.Faces.Count
    if m.Faces.Count > 100:
        a.append(m)
    else:
        pass

num_meshes = len(a)
# ---------- end python_13 ----------
panel_11 = Panel("""_RunPythonScript in Rhino
"Automate_Export_Individual_Meshes_01"
""")
mesh_6 = Mesh(python_13.a)
panel_12 = Panel(python_13.num_meshes)
meshes = PythonScript(num_meshes=python_13.num_meshes)  # -> out; inputs num_meshes: Int32
# ---------- meshes: Python ----------
import scriptcontext as sc


sc.sticky["Meshes_To_Export"] = num_meshes

print num_meshes, ' variable copied to sticky variable to Rhino Python editor'
# ---------- end meshes ----------
item = ListItem(List=mesh_6, Index=mesh_to_export, Wrap=False)

# ---- group: DONT DELETE - Baked in Python
geo_to_export = Geometry(item)
