# Grasshopper definition 170515_Sim1_Vorticity_joinmesh_11.gh (Grasshopper 0.9.76)
# plug-ins: MeshEdit Components, Python Interpreter, gHowl, LunchBox, Weaverbird

rhinopython_filepath = Panel("C:\Users\Scott\Dropbox\NBI\Vorticity\OUTPUT\Sim_0\FBXs")
panel = Panel("C:\Users\Scott\Dropbox\NBI\Vorticity\OUTPUT\Sim_0\Thin_STLs")
panel_2 = Panel("C:\Users\Scott\Dropbox\NBI\Vorticity\OUTPUT\Sim_1\Thin_STLs")

# ---- group: BBox info
panel_3 = Panel("6.28318530718")
# Plane Pi Numbers
panel_4 = Panel("-3.1415926535")
panel_5 = Panel("+3.1415926535")

# ----
tolerance = Panel("-0.0001")
# IF the Cut and Stitch mesh lists are different:
#    DO closest point
#    WELD the shorter ones
#    CAP the longer ones
python = PythonScript()  # -> out, open, closed; inputs m: list of Mesh
# ---------- python: Python ----------
import Rhino.Geometry as rg
import Rhino as rh

open = []
closed = []

for mesh in m:
    naked = mesh.GetNakedEdges

    if mesh.IsClosed:
        print 'yes - Closed', naked
        closed.append(mesh)
    else:
        print 'no - Open'#, naked
        open.append(mesh)

#rh.Collections.Point3dList.ClosestPointInList(
# ---------- end python ----------

python_2 = PythonScript()  # -> SliderNickNames, SliderGuids
# ---------- python_2: Python ----------
import Grasshopper as gh

# Get the Grasshopper component, document and objects
ghComp = ghenv.Component
ghDoc = ghComp.OnPingDocument()
ghObjects = ghDoc.Objects

# Iterate the GH objects and get their name/guid if they are a slider
SliderNickNames = []
SliderGuids = []

for obj in ghObjects:
    if type(obj) is gh.Kernel.Special.GH_NumberSlider:
        
        # Get the slider nick name
        name = obj.NickName
        SliderNickNames.append(name)
        
        # Get instance guid
        guid = obj.InstanceGuid
        SliderGuids.append(str(guid))
        
        # Set the value of the sliders named "Foo" and "Ham"
        if name == "Foo" or name == "Ham":
            obj.Slider.Value = 0.42
            obj.ExpireSolution(True)
# ---------- end python_2 ----------
panel_6 = Panel(python_2.SliderGuids)
panel_7 = Panel(python_2.SliderNickNames)

# ---- group: DONT DELETE - Iterated in Python
mesh_to_export = Slider(361, range=0..600)

# ----
which_file_number = Slider(86, range=0..425)

# ----
# Read thin STL files in Dir
python_3 = PythonScript(walk_dir=panel_2, y=which_file_number)  # -> out, a, how_many, current; inputs y: Int32
# ---------- python_3: Python ----------
import os
from os.path import isfile, join

#print('walk_dir = ' + walk_dir)
#print('walk_dir (absolute) = ' + os.path.abspath(walk_dir))

def all_Files_in(direct):
    allFiles = []
    for r, s, f in os.walk(direct):
        for filenavn in f:
            file_path = os.path.join(r, filenavn)
            allFiles.append(file_path)
            #print('\t- file %s (full path: %s)' % (filename, file_path))
    return allFiles

stlfiles = all_Files_in(walk_dir)

for s in stlfiles:
    print s.split('\\')[-1]
    
a = stlfiles[y]
how_many = len(stlfiles)
current = stlfiles[y].split('\\')[-1][:-9]
print current[:-9]
# ---------- end python_3 ----------
panel_8 = Panel(python_3.current)
panel_9 = Panel(python_3.out)
panel_10 = Panel(python_3.how_many)

# ---- group: http://www.grasshopper3d.com/forum/topics/import-an-stl-file-direct-in-grasshopper
# Parse STLs to Mesh
path = FilePath(python_3.a)
vb = VBScript(F=path)  # -> out, Mesh
# ---------- vb: VB ----------
    Dim stl = My.Computer.FileSystem.ReadAllBytes(F)
    print("File length: " & stl.length() & " bytes")
    Dim numtris As Long = BitConverter.ToInt32(stl, 80)
    print("Number of triangles: " & numtris)
    Dim c,pos As Integer
    Dim tempmesh As New mesh
    Dim tempvect As Vector3f
    If (numtris * 50 + 84 = stl.length()) Then
      print("STL file length matches the number of triangle faces")
      For c = 0 To numtris - 1
        pos = c * 50 + 84
        tempvect = readVect3f(stl, pos)
        With tempmesh
          .Vertices.setvertex(c * 3, readPoint3f(stl, pos))
          .Vertices.setvertex(c * 3 + 1, readPoint3f(stl, pos))
          .Vertices.setvertex(c * 3 + 2, readPoint3f(stl, pos))
          .Faces.setface(c, c * 3, c * 3 + 1, c * 3 + 2)
          .Normals.SetNormal(c * 3, tempvect)
          .Normals.SetNormal(c * 3 + 1, tempvect)
          .Normals.SetNormal(c * 3 + 2, tempvect)
        End With
      Next
      tempmesh.Weld(math.PI)
    Else
      print("STL file length does not match the number of triangle faces")
    End If
    Mesh = tempmesh
# ---------- vb: VB additional code ----------
  '
  Private Function readSingle(ByRef stl As Byte(), ByRef pos As Integer) As Single
    readSingle = BitConverter.ToSingle(stl, pos)
    pos = pos + 4
  End Function

  Private Function readVect3f(ByRef stl As Byte(), ByRef pos As Integer) As Vector3f
    readVect3f = New Vector3f(readSingle(stl, pos), readSingle(stl, pos), readSingle(stl, pos))
  End Function

  Private Function readPoint3f(ByRef stl As Byte(), ByRef pos As Integer) As Point3f
    readPoint3f = New Point3f(readSingle(stl, pos), readSingle(stl, pos), readSingle(stl, pos))
  End Function
# ---------- end vb ----------
disjoint = DisjointMesh(Mesh=vb.Mesh)
preview = CustomPreview(
    Geometry=vb.Mesh,
    Shader={ambient=RGB(0, 0, 0), diffuse=RGB(255, 105, 180), emission=RGB(76, 32, 54), shine=0.5, specular=RGB(255, 255, 255), transparency=0})  # disabled

# ----
cull_tiny = PythonScript(meshes=disjoint, min_faces="5")  # -> out, a, culled; inputs meshes: list of Mesh, min_faces: Int32
# ---------- cull_tiny: Python ----------
import Rhino.Geometry as rg

a = []
culled = []

print "Min faces =", min_faces

for m in meshes:
    #print m.Faces.Count
    if m.Faces.Count > min_faces:
        a.append(m)
        print m.Faces.Count, ' - a'
    else:
        culled.append(m)
        print m.Faces.Count, ' - cull'
# ---------- end cull_tiny ----------

# ----
# Repair Invalid Meshes
python_4 = PythonScript(meshes=cull_tiny.a)  # -> out, simplify(valid), simplify(inval); inputs meshes: list of Mesh
# ---------- python_4: Python ----------
import rhinoscriptsyntax as rs
import Rhino.Geometry as rg

valid = []
inval = []

for m in meshes:
    if m.IsValid:
        print m, ('yes')
        valid.append(m)
    else:
        print m, ("NO!")
        inval.append(m)
# ---------- end python_4 ----------
explode = MeshExplode(Mesh=python_4.inval, Interpolate=False)  # -> simplify(Faces)
pshift = ShiftPaths(Data=python_4.valid, Offset=-1)
mjoin = MeshJoin(Meshes=explode)  # -> flatten(Mesh)
mesh = Mesh(flatten([pshift, mjoin]))

clean = CleanTree(RemoveNulls=True, RemoveInvalid=True, RemoveEmpty=False, Tree=mesh)
python_5 = PythonScript(pi=panel_5, meshes=clean, toler=tolerance, two_pi=panel_3)  # -> out, planes, direction, cut, stitch, virgin; inputs meshes: list of Mesh
# ---------- python_5: Python ----------
import Rhino.Geometry as rg
import rhinoscriptsyntax as rs

x_pos = rg.Plane(rg.Point3d(pi + toler,0,0),rg.Vector3d(pi,0,0))
x_neg = rg.Plane(rg.Point3d(-pi - toler,0,0),rg.Vector3d(-pi,0,0))
y_pos = rg.Plane(rg.Point3d(0,pi + toler,0),rg.Vector3d(0,pi,0))
y_neg = rg.Plane(rg.Point3d(0,-pi - toler,0),rg.Vector3d(0,-pi,0))
z_pos = rg.Plane(rg.Point3d(0,0,pi + toler),rg.Vector3d(0,0,pi))
z_neg = rg.Plane(rg.Point3d(0,0,-pi - toler),rg.Vector3d(0,0,-pi))

orig_planes = [x_neg, x_pos, y_pos, y_neg, x_pos, z_neg]
planes = []
direction = []
cut = []
stitch = []
virgin = []

for m in meshes:
    # X
    if rg.Intersect.Intersection.MeshPlane(m, x_pos):
        # MOVE CUTS HERE BEFORE APPEND
        m.Translate(rg.Vector3d(-two_pi,0,0))
        cut.append(m)
        planes.append(x_pos)
        direction.append('X')
    elif rg.Intersect.Intersection.MeshPlane(m, x_neg):
        stitch.append(m)
        planes.append(x_neg)
        direction.append('X')
    
    # Y
    elif rg.Intersect.Intersection.MeshPlane(m, y_pos):
        m.Translate(rg.Vector3d(0, -two_pi, 0))
        cut.append(m)
        planes.append(y_pos)
        direction.append('Y')
    elif rg.Intersect.Intersection.MeshPlane(m, y_neg):
        stitch.append(m)
        planes.append(y_neg)
        direction.append('Y')
    
    # Z
    elif rg.Intersect.Intersection.MeshPlane(m, z_pos):
        m.Translate(rg.Vector3d(0, 0, -two_pi))
        cut.append(m)
        planes.append(z_pos)
        direction.append('Z')
    elif rg.Intersect.Intersection.MeshPlane(m, z_neg):
        stitch.append(m)
        planes.append(z_neg)
        direction.append('Z')
    
    # Untouched
    else:
        virgin.append(m)

"""
if len(meshes)== len(cut) + len(stitch) + len(virgin) and len(cut) == len(stitch):
    print 'PASSES - ' + direction
else:
    print 'FAILS - ' + direction 
"""
print '-'
print 'Total -', len(meshes)
print 'Cut -', len(cut), 'Stitch -', len(stitch)
print 'Untouched -', len(virgin)
print '-'
print 'To Export -', len(virgin) + len(cut)

print direction
# ---------- end python_5 ----------
# Sort and Move Meshes
panel_11 = Panel(python_5.out)

mesh_virgin = Mesh(simplify(python_5.virgin))
mesh_stitch = Mesh(simplify(python_5.stitch))
# Moved
mesh_cut = Mesh(simplify(python_5.cut))

python_6 = PythonScript(mesh=mesh_stitch)  # -> avg_pt; inputs mesh: list of Mesh
# ---------- python_6: Python ----------
import Rhino.Geometry as rg 

"""
Returns a pseudo-centroid, an average of all mesh Face centroid
"""

avg_pt = []

for m in mesh:

    face_ctrs = []
    totalFac = m.Faces.Count

    x = m.Faces.GetFaceCenter(0).X
    y = m.Faces.GetFaceCenter(0).Y
    z = m.Faces.GetFaceCenter(0).Z
    
    for i in range(0, m.Faces.Count):
        face_ctrs.append(m.Faces.GetFaceCenter(i))
        
        center = m.Faces.GetFaceCenter(i)
        
        x += center.X
        y += center.Y
        z += center.Z
        
        print x
        #print totalFac * 10
    average = rg.Point3d(x/totalFac * 1, y/totalFac * 1, z/totalFac * 1)

    avg_pt.append(average)

    #averaged = [sum(y) / len(y) for y in zip(*x)]
print "# faces ", m.Faces.Count
# ---------- end python_6 ----------
python_7 = PythonScript(mesh=mesh_cut)  # -> avg_pt; inputs mesh: list of Mesh; same code as python_6
cp = ClosestPoint(Point=python_7, Cloud=python_6)  # -> ClosestPoint, CPIndex, Distance

# ---- group: Viz Analysis
ln = Line(StartPoint=python_7, EndPoint=python_6)
# Align Data
# Sort Weld order
points = PointList(Points=python_7, Size=0.6)
points_2 = PointList(Points=python_6, Size=0.6)

# ----
mesh_2 = Mesh(graft(mesh_cut))
item = ListItem(List=mesh_stitch, Index=cp.CPIndex, Wrap=True)
mesh_3 = Mesh(simplify(graft(item)))
mesh_4 = Mesh(simplify(mesh_2))
python_8 = PythonScript(mesh=mesh_3)  # -> avg_pt; inputs mesh: list of Mesh; same code as python_6
python_9 = PythonScript(mesh=mesh_2)  # -> avg_pt; inputs mesh: list of Mesh; same code as python_6
ln_2 = Line(StartPoint=python_9, EndPoint=python_8)
# WELD Seams
wbjoin = WeaverbirdsJoinMeshesAndWeld(Mesh=[mesh_4, mesh_3], Weld=True)

# ---- group: Average Edge Length
medges = MeshEdges(Mesh=wbjoin)  # -> NakedEdges, InteriorEdges, NonManifoldEdges; disabled
len = Length(Curve=medges.NakedEdges)  # -> flatten(Length); disabled
avr = Average(Input=len)  # disabled
avg_edge_length = Panel(avr)  # disabled

# ----
weldvertices = MeshWeldVertices(Mesh=wbjoin, Tolerance="0.05")  # -> RuntimeMessage, flatten(Mesh)

python_10 = PythonScript(meshes=weldvertices.Mesh, min_faces="10")  # -> out, a, culled; inputs meshes: list of Mesh, min_faces: Int32
# ---------- python_10: Python ----------
import Rhino.Geometry as rg

a = []
culled = []

#min_faces = 10

print "Min faces =", min_faces

for m in meshes:
    print m.Faces.Count
    if m.Faces.Count > min_faces:
        a.append(m)
    else:
        culled.append(m)
# ---------- end python_10 ----------

# ---- group: Cull tiny, unused meshes
python_11 = PythonScript(meshes=mesh_virgin, min_faces="10")  # -> out, flatten(a), culled; inputs meshes: list of Mesh, min_faces: Int32
# ---------- python_11: Python ----------
import Rhino.Geometry as rg

a = []
culled = []

print "Min faces =", min_faces

for m in meshes:
    print m.Faces.Count
    if m.Faces.Count > min_faces:
        a.append(m)
    else:
        culled.append(m)
# ---------- end python_11 ----------

# ---- group: Fresh Sewn Chips
mesh_5 = Mesh(python_10.a)

# ----
python_12 = PythonScript(m=mesh_5)  # -> out, open, closed; inputs m: list of Mesh
# ---------- python_12: Python ----------
import Rhino.Geometry as rg
import Rhino as rh

open = []
closed = []

for mesh in m:
    naked = mesh.GetNakedEdges

    if mesh.IsClosed:
        print 'yes - Closed', naked
        closed.append(mesh)
    else:
        print 'no - Open'#, naked
        open.append(mesh)
# ---------- end python_12 ----------
mesh_6 = Mesh(python_12.closed)
mesh_7 = Mesh(python_12.open)

# ---- group: All Chips
mesh_8 = Mesh([python_11.a, mesh_5])

# ----
# Euler‐Poincaré formula
# V + F - E = 2
euler_poincaré = EulerPoincaré(M_2=mesh_5, M=mesh_5)

# ----
# The start of a BBox
# optimization algo
cluster = Cluster(C=mesh_8)

panel_12 = Panel(euler_poincaré)

# ----
# Export to Individual 3dms
python_13 = PythonScript(meshes=mesh_8)  # -> out, a, num_meshes; inputs meshes: list of Mesh
# ---------- python_13: Python ----------
import Rhino.Geometry as rg

a = []

for m in meshes:
    print m.Faces.Count
    if m.Faces.Count > 10:
        a.append(m)
    else:
        pass

num_meshes = len(a)
# ---------- end python_13 ----------
panel_13 = Panel("""_RunPythonScript in Rhino
"Automate_Export_Individual_Meshes_01"
""")
panel_14 = Panel(python_13.num_meshes)
mesh_9 = Mesh(python_13.a)
meshes = PythonScript(num_meshes=python_13.num_meshes)  # -> out; inputs num_meshes: Int32
# ---------- meshes: Python ----------
import scriptcontext as sc


sc.sticky["Meshes_To_Export"] = num_meshes

print num_meshes, ' variable copied to sticky variable to Rhino Python editor'
# ---------- end meshes ----------
item_2 = ListItem(List=mesh_9, Index=mesh_to_export, Wrap=False)

# ---- group: DONT DELETE - Baked in Python
geo_to_export = Geometry(item_2)

# ----
# Write Mesh Data to CSV
panel_15 = Panel("C:\Users\Scott\Desktop\test\dataout.csv")
# Data to WRITE:
# Mesh Name
# Vol Centroid
# Volume
# Euler-Poincare formula
volume = MeshVolume(Mesh=python_13.a)  # -> Volume, Centroid
spreadsheet_writer = SpreadsheetWriter(Path=panel_15, SheetData1=volume.Volume)
index = ItemIndex(List=python_13.a, Item=python_13.a)
excelwrite = ExcelWrite(
    WriteExcelData=Button(),
    WorkbookPath=panel_15,
    WorksheetName="Sheet1",
    ColumnHeadings="Valence",
    Data=index,
    ClearSheet=False)

wbnaked = WeaverbirdsNakedBoundary(MeshClosedPolylines=mesh_7)
explode_2 = Explode(Curve=wbnaked, Recursive=True)  # -> Segments, Vertices
cp_2 = ControlPoints(Curve=explode_2.Segments)  # -> Points, Weights, Knots
viewer = ParamViewer(explode_2.Segments)
pshift_2 = ShiftPaths(Data=cp_2.Points, Offset=-1)  # -> simplify(Data)

cull_3 = PythonScript(tree=pshift_2)  # -> dataTree; inputs tree: tree
# ---------- cull_3: Python ----------
import Grasshopper as gh

# Create a GH data tree (note the parentheses and type declaration)
dataTree = gh.DataTree[object]()


for i in range(tree.BranchCount):
    branchList = tree.Branch(i)
    if len(branchList) > 2:
        for b in branchList:
            dataTree.Add(b,gh.Kernel.Data.GH_Path(i))

"""
firstItems = []
for i in range(tree.BranchCount):
    branchList = tree.Branch(i)
    firstItems.append(branchList[0])



# Add the data from the nested list to the datatree
for i, v in enumerate(list):
    for d in v:
        dataTree.Add(d,gh.Kernel.Data.GH_Path(i))

# Add other stuff to the data tree using custom paths
for i in range(10):
    dataTree.Add(i,gh.Kernel.Data.GH_Path(69))
    dataTree.Add(i*5,gh.Kernel.Data.GH_Path(666))

# Return the tree to GH
ghTree = dataTree
"""
# ---------- end cull_3 ----------

del = DelaunayMesh(Points=cull_3, Plane=PlaneXY(0, 0, 0))

# ==== cluster EulerPoincaré
M = ClusterInput()
M_2 = ClusterInput()
demesh = DeconstructMesh(Mesh=M)  # -> Vertices, Faces, Colours, Normals
medges = MeshEdges(Mesh=M_2)  # -> NakedEdges, InteriorEdges, NonManifoldEdges
lng = ListLength(List=medges.NakedEdges)
lng_2 = ListLength(List=medges.InteriorEdges)
lng_3 = ListLength(List=medges.NonManifoldEdges)
lng_4 = ListLength(List=demesh.Vertices)
lng_5 = ListLength(List=demesh.Faces)
addition = Addition(A=lng, B=lng_2, C=lng_3)
eval = Evaluate(F="v+f-e", v=lng_4, f=lng_5, e=addition)  # -> flatten(r)
sort = SortList(Keys=eval, ValuesA=eval)  # -> Keys, ValuesA
K = ClusterOutput(sort.Keys)

# ==== cluster Cluster
C = ClusterInput()
bbox = BoundingBox(Content=C, Plane=PlaneXY(0, 0, 0))  # -> Box, Box_2
boxprop = BoxProperties(Box=bbox.Box_2)  # -> Center, Diagonal, Area, Volume, Degeneracy
cp = ClosestPoint(Point=boxprop.Center, Cloud=boxprop.Center)  # -> ClosestPoint, CPIndex, Distance
avr = Average(Input=boxprop.Volume)
bnd = Bounds(Numbers=boxprop.Volume)
larger = LargerThan(FirstNumber=boxprop.Volume, SecondNumber=avr)  # -> LargerThan, OrEqualTo
panel = Panel(bnd)
cull = CullPattern(CullPattern=larger.LargerThan)
