# Grasshopper definition 170530_Sim1_Vorticity_joinmesh_12.gh (Grasshopper 0.9.76)
# plug-ins: MeshEdit Components, Python Interpreter, gHowl, LunchBox, Weaverbird

rhinopython_filepath = Panel("C:\Users\Scott\Dropbox\NBI\Vorticity\OUTPUT\Sim_0\FBXs")
panel = Panel("C:\Users\Scott\Dropbox\NBI\Vorticity\OUTPUT\Sim_0\Thin_STLs")
panel_2 = Panel("C:\Users\Scott\Dropbox\NBI\Vorticity\OUTPUT\Sim_1\Thin_STLs")

# ---- group: BBox info
panel_3 = Panel("6.28318530718")
# Plane Pi Numbers
panel_4 = Panel("-3.1415926535")
panel_5 = Panel("+3.1415926535")

# ----
tolerance = Panel("-0.0001")
previously = Panel("0.03")
min_faces = Panel("10")
min_faces_2 = Panel("10")

python = PythonScript()  # -> SliderNickNames, SliderGuids
# ---------- python: Python ----------
import Grasshopper as gh

# Get the Grasshopper component, document and objects
ghComp = ghenv.Component
ghDoc = ghComp.OnPingDocument()
ghObjects = ghDoc.Objects

# Iterate the GH objects and get their name/guid if they are a slider
SliderNickNames = []
SliderGuids = []

for obj in ghObjects:
    if type(obj) is gh.Kernel.Special.GH_NumberSlider:
        
        # Get the slider nick name
        name = obj.NickName
        SliderNickNames.append(name)
        
        # Get instance guid
        guid = obj.InstanceGuid
        SliderGuids.append(str(guid))
        
        # Set the value of the sliders named "Foo" and "Ham"
        if name == "Foo" or name == "Ham":
            obj.Slider.Value = 0.42
            obj.ExpireSolution(True)
# ---------- end python ----------
panel_6 = Panel(python.SliderGuids)
panel_7 = Panel(python.SliderNickNames)

# ---- group: DONT DELETE - Iterated in Python
mesh_to_export = Slider(315, range=0..600)

# ----
weld_tolerance = Panel("0.08")

which_file_number = Slider(422, range=0..425)

# ----
# Read thin STL files in Dir
python_2 = PythonScript(walk_dir=panel_2, y=which_file_number)  # -> out, a, how_many, current; inputs y: Int32
# ---------- python_2: Python ----------
import os
from os.path import isfile, join

#print('walk_dir = ' + walk_dir)
#print('walk_dir (absolute) = ' + os.path.abspath(walk_dir))

def all_Files_in(direct):
    allFiles = []
    for r, s, f in os.walk(direct):
        for filenavn in f:
            file_path = os.path.join(r, filenavn)
            allFiles.append(file_path)
            #print('\t- file %s (full path: %s)' % (filename, file_path))
    return allFiles

stlfiles = all_Files_in(walk_dir)

for s in stlfiles:
    print s.split('\\')[-1]
    
a = stlfiles[y]
how_many = len(stlfiles)
current = stlfiles[y].split('\\')[-1][:-9]
print current[:-9]
# ---------- end python_2 ----------
panel_8 = Panel(python_2.current)
panel_9 = Panel(python_2.out)
panel_10 = Panel(python_2.how_many)

# ---- group: http://www.grasshopper3d.com/forum/topics/import-an-stl-file-direct-in-grasshopper
# Parse STLs to Mesh
path = FilePath(python_2.a)
vb = VBScript(F=path)  # -> out, Mesh
# ---------- vb: VB ----------
    Dim stl = My.Computer.FileSystem.ReadAllBytes(F)
    print("File length: " & stl.length() & " bytes")
    Dim numtris As Long = BitConverter.ToInt32(stl, 80)
    print("Number of triangles: " & numtris)
    Dim c,pos As Integer
    Dim tempmesh As New mesh
    Dim tempvect As Vector3f
    If (numtris * 50 + 84 = stl.length()) Then
      print("STL file length matches the number of triangle faces")
      For c = 0 To numtris - 1
        pos = c * 50 + 84
        tempvect = readVect3f(stl, pos)
        With tempmesh
          .Vertices.setvertex(c * 3, readPoint3f(stl, pos))
          .Vertices.setvertex(c * 3 + 1, readPoint3f(stl, pos))
          .Vertices.setvertex(c * 3 + 2, readPoint3f(stl, pos))
          .Faces.setface(c, c * 3, c * 3 + 1, c * 3 + 2)
          .Normals.SetNormal(c * 3, tempvect)
          .Normals.SetNormal(c * 3 + 1, tempvect)
          .Normals.SetNormal(c * 3 + 2, tempvect)
        End With
      Next
      tempmesh.Weld(math.PI)
    Else
      print("STL file length does not match the number of triangle faces")
    End If
    Mesh = tempmesh
# ---------- vb: VB additional code ----------
  '
  Private Function readSingle(ByRef stl As Byte(), ByRef pos As Integer) As Single
    readSingle = BitConverter.ToSingle(stl, pos)
    pos = pos + 4
  End Function

  Private Function readVect3f(ByRef stl As Byte(), ByRef pos As Integer) As Vector3f
    readVect3f = New Vector3f(readSingle(stl, pos), readSingle(stl, pos), readSingle(stl, pos))
  End Function

  Private Function readPoint3f(ByRef stl As Byte(), ByRef pos As Integer) As Point3f
    readPoint3f = New Point3f(readSingle(stl, pos), readSingle(stl, pos), readSingle(stl, pos))
  End Function
# ---------- end vb ----------
disjoint = DisjointMesh(Mesh=vb.Mesh)
preview = CustomPreview(
    Geometry=vb.Mesh,
    Shader={ambient=RGB(0, 0, 0), diffuse=RGB(255, 105, 180), emission=RGB(76, 32, 54), shine=0.5, specular=RGB(255, 255, 255), transparency=0})  # disabled

# ----
cull_tiny = PythonScript(meshes=disjoint, min_faces="50")  # -> out, a, culled; inputs meshes: list of Mesh, min_faces: Int32
# ---------- cull_tiny: Python ----------
import Rhino.Geometry as rg

a = []
culled = []

print "Min faces =", min_faces

for m in meshes:
    #print m.Faces.Count
    if m.Faces.Count > min_faces:
        a.append(m)
        print m.Faces.Count, ' - a'
    else:
        culled.append(m)
        print m.Faces.Count, ' - cull'
# ---------- end cull_tiny ----------

# ----
# Repair Invalid Meshes
python_3 = PythonScript(meshes=cull_tiny.a)  # -> out, simplify(valid), simplify(inval); inputs meshes: list of Mesh
# ---------- python_3: Python ----------
import rhinoscriptsyntax as rs
import Rhino.Geometry as rg

valid = []
inval = []

for m in meshes:
    if m.IsValid:
        print m, ('yes')
        valid.append(m)
    else:
        print m, ("NO!")
        inval.append(m)
# ---------- end python_3 ----------
explode = MeshExplode(Mesh=python_3.inval, Interpolate=False)  # -> simplify(Faces)
pshift = ShiftPaths(Data=python_3.valid, Offset=-1)
mjoin = MeshJoin(Meshes=explode)  # -> flatten(Mesh)
mesh = Mesh(flatten([pshift, mjoin]))

clean = CleanTree(RemoveNulls=True, RemoveInvalid=True, RemoveEmpty=False, Tree=mesh)
python_4 = PythonScript(pi=panel_5, meshes=clean, toler=tolerance, two_pi=panel_3)  # -> out, planes, direction, cut, stitch, virgin; inputs meshes: list of Mesh
# ---------- python_4: Python ----------
import Rhino.Geometry as rg
import rhinoscriptsyntax as rs

x_pos = rg.Plane(rg.Point3d(pi + toler,0,0),rg.Vector3d(pi,0,0))
x_neg = rg.Plane(rg.Point3d(-pi - toler,0,0),rg.Vector3d(-pi,0,0))
y_pos = rg.Plane(rg.Point3d(0,pi + toler,0),rg.Vector3d(0,pi,0))
y_neg = rg.Plane(rg.Point3d(0,-pi - toler,0),rg.Vector3d(0,-pi,0))
z_pos = rg.Plane(rg.Point3d(0,0,pi + toler),rg.Vector3d(0,0,pi))
z_neg = rg.Plane(rg.Point3d(0,0,-pi - toler),rg.Vector3d(0,0,-pi))

orig_planes = [x_neg, x_pos, y_pos, y_neg, x_pos, z_neg]
planes = []
direction = []
cut = []
stitch = []
virgin = []

for m in meshes:
    # X
    if rg.Intersect.Intersection.MeshPlane(m, x_pos):
        # MOVE CUTS HERE BEFORE APPEND
        m.Translate(rg.Vector3d(-two_pi,0,0))
        cut.append(m)
        planes.append(x_pos)
        direction.append('X')
    elif rg.Intersect.Intersection.MeshPlane(m, x_neg):
        stitch.append(m)
        planes.append(x_neg)
        direction.append('X')
    
    # Y
    elif rg.Intersect.Intersection.MeshPlane(m, y_pos):
        m.Translate(rg.Vector3d(0, -two_pi, 0))
        cut.append(m)
        planes.append(y_pos)
        direction.append('Y')
    elif rg.Intersect.Intersection.MeshPlane(m, y_neg):
        stitch.append(m)
        planes.append(y_neg)
        direction.append('Y')
    
    # Z
    elif rg.Intersect.Intersection.MeshPlane(m, z_pos):
        m.Translate(rg.Vector3d(0, 0, -two_pi))
        cut.append(m)
        planes.append(z_pos)
        direction.append('Z')
    elif rg.Intersect.Intersection.MeshPlane(m, z_neg):
        stitch.append(m)
        planes.append(z_neg)
        direction.append('Z')
    
    # Untouched
    else:
        virgin.append(m)

"""
if len(meshes)== len(cut) + len(stitch) + len(virgin) and len(cut) == len(stitch):
    print 'PASSES - ' + direction
else:
    print 'FAILS - ' + direction 
"""
print '-'
print 'Total -', len(meshes)
print 'Cut -', len(cut), 'Stitch -', len(stitch)
print 'Untouched -', len(virgin)
print '-'
print 'To Export -', len(virgin) + len(cut)

print direction
# ---------- end python_4 ----------
# Sort and Move Meshes
panel_11 = Panel(python_4.out)
mesh_stitch = Mesh(simplify(python_4.stitch))
mesh_virgin = Mesh(simplify(python_4.virgin))
# Moved
mesh_cut = Mesh(simplify(python_4.cut))
python_5 = PythonScript(m1=mesh_cut, m2=mesh_stitch)  # -> short, long; inputs m1: list of Mesh, m2: list
# ---------- python_5: Python ----------
import Rhino.Geometry as rg
import Rhino as rh

long = []
short = []

if len(m1) > len(m2):
    long = m1#[m for m in m1]
    short = m2#[x for x in m2]
else:
    short = m1#[m for m in m1]
    long = m2#[x for x in m2]

print len(m1), len(m2)
print len(long), len(short)


#rh.Collections.Point3dList.ClosestPointInList(
# ---------- end python_5 ----------
# Order Lists
# (short/long)
# IF it has a pair:
#     WELD them
python_6 = PythonScript(mesh=python_5.short)  # -> avg_pt; inputs mesh: list of Mesh
# ---------- python_6: Python ----------
import Rhino.Geometry as rg 

"""
Returns a pseudo-centroid, an average of all mesh Face centroid
"""

avg_pt = []

for m in mesh:

    face_ctrs = []
    totalFac = m.Faces.Count

    x = m.Faces.GetFaceCenter(0).X
    y = m.Faces.GetFaceCenter(0).Y
    z = m.Faces.GetFaceCenter(0).Z
    
    for i in range(0, m.Faces.Count):
        face_ctrs.append(m.Faces.GetFaceCenter(i))
        
        center = m.Faces.GetFaceCenter(i)
        
        x += center.X
        y += center.Y
        z += center.Z
        
        print x
        #print totalFac * 10
    average = rg.Point3d(x/totalFac * 1, y/totalFac * 1, z/totalFac * 1)

    avg_pt.append(average)

    #averaged = [sum(y) / len(y) for y in zip(*x)]
print "# faces ", m.Faces.Count
# ---------- end python_6 ----------
python_7 = PythonScript(mesh=python_5.long)  # -> avg_pt; inputs mesh: list of Mesh
# ---------- python_7: Python ----------
import Rhino.Geometry as rg 

"""
Returns a pseudo-centroid, an average of all mesh Face centroid
"""

avg_pt = []

for m in mesh:

    face_ctrs = []
    totalFac = m.Faces.Count

    x = m.Faces.GetFaceCenter(0).X
    y = m.Faces.GetFaceCenter(0).Y
    z = m.Faces.GetFaceCenter(0).Z
    
    for i in range(0, m.Faces.Count):
        face_ctrs.append(m.Faces.GetFaceCenter(i))
        
        center = m.Faces.GetFaceCenter(i)
        
        x += center.X
        y += center.Y
        z += center.Z
        
        #print x
        #print totalFac * 10
    average = rg.Point3d(x/totalFac * 1, y/totalFac * 1, z/totalFac * 1)

    avg_pt.append(average)

    #averaged = [sum(y) / len(y) for y in zip(*x)]
print "# faces ", m.Faces.Count
# ---------- end python_7 ----------

# ---- group: First CP
# 1st CP
cp = ClosestPoint(Point=python_6, Cloud=python_7)  # -> ClosestPoint, CPIndex, Distance

# ---- group: Points
item = ListItem(List=python_7, Index=cp.CPIndex, Wrap=True)

# ---- group: Solo Meshes 1
# IF no pair:
#     CAP it
python_8 = PythonScript(long=python_7, matched=item)  # -> solos, solo_i; inputs long: list of Point3d, matched: list of Point3d
# ---------- python_8: Python ----------
solos = []
solo_i = []

for iter, l in enumerate(long):
    if l in matched:
        pass
    else:
        solos.append(l)
        solo_i.append(iter)
# ---------- end python_8 ----------
item_2 = ListItem(List=python_5.long, Index=python_8.solo_i, Wrap=True)

# ---- group: Reverse CP
# 2nd CP - (reverse cp)
cp_2 = ClosestPoint(Point=item, Cloud=python_6)  # -> ClosestPoint, CPIndex, Distance
item_3 = ListItem(List=cp.ClosestPoint, Index=cp_2.CPIndex, Wrap=True)

# ---- group: Solo Meshes 2
python_9 = PythonScript(long=python_6, matched=cp_2.ClosestPoint)  # -> solos, solo_i; inputs long: list of Point3d, matched: list of Point3d; same code as python_8
item_4 = ListItem(List=python_5.short, Index=python_9.solo_i, Wrap=True)

# ---- group: Pair Visualization
ln = Line(StartPoint=cp_2.ClosestPoint, EndPoint=item_3)
polygon = Polygon(Plane=[item_3, cp_2.ClosestPoint], Radius=0.15, Segments=3, FilletRadius=0)  # -> Polygon, Length

# ---- group: SHORT PAIR
item_5 = ListItem(List=python_5.short, Index=cp_2.CPIndex, Wrap=True)

# ---- group: LONG PAIR
item_6 = ListItem(List=python_5.long, Index=cp.CPIndex, Wrap=True)

# ---- group: All Solo Meshes
mesh_2 = Mesh(simplify([item_2, item_4]))

# ---- group: Short list mesh halfs
mesh_3 = Mesh(item_5)

# ---- group: Long list mesh halfs
mesh_4 = Mesh(item_6)

# ---- group: Visualize Solo Pts
python_10 = PythonScript(mesh=mesh_2)  # -> avg_pt; inputs mesh: list of Mesh; same code as python_7
box = CenterBox(Base=python_10, X="0.1", Y="0.1", Z="0.1")

# ---- group: Viz Analysis
# Visual Verify
python_11 = PythonScript(mesh=mesh_3)  # -> avg_pt; inputs mesh: list of Mesh; same code as python_6
python_12 = PythonScript(mesh=mesh_4)  # -> avg_pt; inputs mesh: list of Mesh; same code as python_6
points = PointList(Points=flatten(item_3), Size=0.6)
ln_2 = Line(StartPoint=python_11, EndPoint=python_12)
points_2 = PointList(Points=flatten(cp_2.ClosestPoint), Size=0.6)

# ---- group: Short list mesh halfs
mesh_5 = Mesh(simplify(graft(mesh_3)))

# ---- group: Long list mesh halfs
mesh_6 = Mesh(simplify(graft(mesh_4)))

# ----
# WELD Seams
wbjoin = WeaverbirdsJoinMeshesAndWeld(Mesh=[mesh_5, mesh_6], Weld=True)
weldvertices = MeshWeldVertices(Mesh=wbjoin, Tolerance=weld_tolerance)  # -> RuntimeMessage, flatten(Mesh)

# ---- group: Average Edge Length
cluster = Cluster(M=wbjoin)  # disabled
avg_edge_length = Panel(cluster)

# ----
print_v_f = PythonScript(mesh=flatten(wbjoin))  # -> out; inputs mesh: list of Mesh
# ---------- print_v_f: Python ----------
import Rhino.Geometry as rg

#rg.Mesh.
vfs = []

for m in mesh:
    vfs.append([m.Vertices.Count, m.Faces.Count])

vfs.sort()
for v in vfs:
    print 'V:%d F:%d' % (v[0], v[1])
# ---------- end print_v_f ----------
panel_12 = Panel(print_v_f)

python_13 = PythonScript(meshes=weldvertices.Mesh, min_faces=min_faces)  # -> out, a, culled; inputs meshes: list of Mesh, min_faces: Int32
# ---------- python_13: Python ----------
import Rhino.Geometry as rg

a = []
culled = []

#min_faces = 10

print "Min faces =", min_faces

for m in meshes:
    print m.Faces.Count
    if m.Faces.Count > min_faces:
        a.append(m)
    else:
        culled.append(m)
# ---------- end python_13 ----------

# ---- group: All Solo Meshes
mesh_7 = Mesh(mesh_2)

# ---- group: Fresh Sewn Chips
mesh_8 = Mesh(python_13.a)

# ----
pshift_2 = ShiftPaths(Data=[mesh_8, mesh_7], Offset=-1)
python_14 = PythonScript(m=pshift_2)  # -> msg, simplify(open), closed; inputs m: list of Mesh
# ---------- python_14: Python ----------
import Rhino.Geometry as rg
import Rhino as rh

open = []
closed = []

for mesh in m:
    naked = mesh.GetNakedEdges

    if mesh.IsClosed:
        print 'yes - Closed', naked
        closed.append(mesh)
    else:
        print 'no - Open'#, naked
        open.append(mesh)

msg = 'Open: %d, Closed: %d' % (len(open), len(closed))
# ---------- end python_14 ----------
# Keep Already Closed Meshes
mesh_9 = Mesh(python_14.closed)

# ---- group: Fan Fill Mesh Hole
# Close Open Meshes
# (Fan Cap)
cluster_2 = Cluster_2(M=python_14.open)

# ----
# Euler‐Poincaré
# V + F - E = 2
euler = Euler(M_2=mesh_9, M=mesh_9)
panel_13 = Panel(euler)

mesh_10 = Mesh([python_14.open, cluster_2])
mjoin_2 = MeshJoin(Meshes=mesh_10)
disjoint_2 = DisjointMesh(Mesh=mjoin_2)
# Basic Utility Clean
pshift_3 = ShiftPaths(Data=disjoint_2, Offset=-1)

python_15 = PythonScript(m=mesh_10)  # -> msg, open, closed; inputs m: list of Mesh; same code as python_14
panel_14 = Panel(python_15.msg)

merge = Merge(Data1=pshift_3, Data2=mesh_9)
unifynormals = MeshUnifyNormals(Mesh=merge)
cullvertices = MeshCullUnusedVertices(Mesh=unifynormals)
weldvertices_2 = MeshWeldVertices(Mesh=cullvertices, Tolerance=0.01)  # -> RuntimeMessage, Mesh
python_16 = PythonScript(m=weldvertices_2.Mesh)  # -> msg, open, closed; inputs m: list of Mesh; same code as python_14
panel_15 = Panel(python_16.msg)

mesh_virgin_2 = Mesh(mesh_virgin)
mesh_stitched_capped = Mesh(weldvertices_2.Mesh)
pshift_4 = ShiftPaths(Data=mesh_virgin_2, Offset=-1)

# ---- group: All Chips
mesh_11 = Mesh([mesh_stitched_capped, pshift_4])

# ---- group: Cull tiny, unused meshes
python_17 = PythonScript(meshes=mesh_11, min_faces=min_faces_2)  # -> out, flatten(a), culled; inputs meshes: list of Mesh, min_faces: Int32
# ---------- python_17: Python ----------
import Rhino.Geometry as rg

a = []
culled = []

print "Min faces =", min_faces

for m in meshes:
    print m.Faces.Count
    if m.Faces.Count > min_faces:
        a.append(m)
    else:
        culled.append(m)
# ---------- end python_17 ----------

# ---- group: All Chips Capped
mesh_12 = Mesh(python_17.a)

# ----
python_18 = PythonScript(m=mesh_12)  # -> msg, open, closed; inputs m: list of Mesh; same code as python_14
panel_16 = Panel(python_18.msg)

# ----
# Export to Individual 3dms
python_19 = PythonScript(meshes=mesh_12)  # -> out, a, num_meshes; inputs meshes: list of Mesh
# ---------- python_19: Python ----------
import Rhino.Geometry as rg

a = []

for m in meshes:
    print m.Faces.Count
    if m.Faces.Count > 10:
        a.append(m)
    else:
        pass

num_meshes = len(a)
# ---------- end python_19 ----------
panel_17 = Panel("""_RunPythonScript in Rhino
"Automate_Export_Individual_Meshes_01"
""")
panel_18 = Panel(python_19.num_meshes)
mesh_13 = Mesh(python_19.a)
meshes = PythonScript(num_meshes=python_19.num_meshes)  # -> out; inputs num_meshes: Int32
# ---------- meshes: Python ----------
import scriptcontext as sc


sc.sticky["Meshes_To_Export"] = num_meshes

print num_meshes, ' variable copied to sticky variable to Rhino Python editor'
# ---------- end meshes ----------
item_7 = ListItem(List=mesh_13, Index=mesh_to_export, Wrap=False)

# ---- group: DONT DELETE - Baked in Python
geo_to_export = Geometry(item_7)

# ----
# Write Mesh Data to CSV
panel_19 = Panel("C:\Users\Scott\Desktop\test\dataout.csv")  # disabled
# Data to WRITE:
# Mesh Name
# Vol Centroid
# Volume
# Euler-Poincare formula
volume = MeshVolume(Mesh=python_19.a)  # -> Volume, Centroid; disabled
spreadsheet_writer = SpreadsheetWriter(Path=panel_19, SheetData1=volume.Volume)  # disabled
index = ItemIndex(List=python_19.a, Item=python_19.a)  # disabled
button = Button()  # disabled
excelwrite = ExcelWrite(
    WriteExcelData=button,
    WorkbookPath=panel_19,
    WorksheetName="Sheet1",
    ColumnHeadings="Valence",
    Data=index,
    ClearSheet=False)  # disabled

# ==== cluster Euler
M = ClusterInput()
M_2 = ClusterInput()
demesh = DeconstructMesh(Mesh=M)  # -> Vertices, Faces, Colours, Normals
medges = MeshEdges(Mesh=M_2)  # -> NakedEdges, InteriorEdges, NonManifoldEdges
lng = ListLength(List=medges.NakedEdges)
lng_2 = ListLength(List=medges.InteriorEdges)
lng_3 = ListLength(List=medges.NonManifoldEdges)
lng_4 = ListLength(List=demesh.Vertices)
lng_5 = ListLength(List=demesh.Faces)
addition = Addition(A=lng, B=lng_2, C=lng_3)
eval = Evaluate(F="v+f-e", v=lng_4, f=lng_5, e=addition)  # -> flatten(r)
sort = SortList(Keys=eval, ValuesA=eval)  # -> Keys, ValuesA
K = ClusterOutput(sort.Keys)

# ==== cluster Cluster
M = ClusterInput()
medges = MeshEdges(Mesh=M)  # -> NakedEdges, InteriorEdges, NonManifoldEdges
len = Length(Curve=medges.NakedEdges)  # -> flatten(Length)
avr = Average(Input=len)
am = ClusterOutput(avr)

# ==== cluster Cluster_2
M = ClusterInput()
wbnaked = WeaverbirdsNakedBoundary(MeshClosedPolylines=M)
cp = ControlPoints(Curve=wbnaked)  # -> Points, Weights, Knots
explode = Explode(Curve=wbnaked, Recursive=True)  # -> Segments, Vertices
avr = Average(Input=cp.Points)
end = EndPoints(Curve=explode.Segments)  # -> Start, End
long = LongestList(ListA=avr, ListB=end.Start, PaddingMode=2)  # -> ListA, ListB
merge = Merge(Data1=graft(long.ListA), Data2=graft(end.Start), Data3=graft(end.End))
conmesh = ConstructMesh(Vertices=merge, Faces={A=0, B=1, C=2, D=2})
pshift = ShiftPaths(Data=conmesh, Offset=-1)
mjoin = MeshJoin(Meshes=pshift)  # -> flatten(Mesh)
M_2 = ClusterOutput(mjoin)
