# Grasshopper definition 170705_Sim0_Export_Screencaps.gh (Grasshopper 0.9.76)
# plug-ins: MeshEdit Components, Python Interpreter

panel = Panel("C:\Users\Scott\Dropbox\NBI\Vorticity\OUTPUT\Sim_0\Thin_STLs")
# Read thin STL files in Dir
rhinopython_filepath = Panel("C:\Users\Scott\Dropbox\NBI\Vorticity\OUTPUT\Sim_0\FBXs")

python = PythonScript()  # -> SliderNickNames, SliderGuids
# ---------- python: Python ----------
import Grasshopper as gh

# Get the Grasshopper component, document and objects
ghComp = ghenv.Component
ghDoc = ghComp.OnPingDocument()
ghObjects = ghDoc.Objects

# Iterate the GH objects and get their name/guid if they are a slider
SliderNickNames = []
SliderGuids = []

for obj in ghObjects:
    if type(obj) is gh.Kernel.Special.GH_NumberSlider:
        
        # Get the slider nick name
        name = obj.NickName
        SliderNickNames.append(name)
        
        # Get instance guid
        guid = obj.InstanceGuid
        SliderGuids.append(str(guid))
        
        # Set the value of the sliders named "Foo" and "Ham"
        if name == "Foo" or name == "Ham":
            obj.Slider.Value = 0.42
            obj.ExpireSolution(True)
# ---------- end python ----------
panel_2 = Panel(python.SliderGuids)
panel_3 = Panel(python.SliderNickNames)

which_file_number = Slider(419, range=0..425)

# ----
# Sim 0 ONLY
python_2 = PythonScript(walk_dir=panel, y=which_file_number)  # -> out, a, how_many, current; inputs y: Int32
# ---------- python_2: Python ----------
import os
from os.path import isfile, join

#print('walk_dir = ' + walk_dir)
#print('walk_dir (absolute) = ' + os.path.abspath(walk_dir))

def all_Files_in(direct):
    allFiles = []
    for r, s, f in os.walk(direct):
        for filenavn in f:
            file_path = os.path.join(r, filenavn)
            allFiles.append(file_path)
            #print('\t- file %s (full path: %s)' % (filename, file_path))
    return allFiles

stlfiles = all_Files_in(walk_dir)

for s in stlfiles:
    print s.split('\\')[-1]
    
a = stlfiles[y]
how_many = len(stlfiles)
current = stlfiles[y].split('\\')[-1][:-9]
print current[:-9]
# ---------- end python_2 ----------
panel_4 = Panel(python_2.current)
panel_5 = Panel(python_2.out)
panel_6 = Panel(python_2.how_many)

# ---- group: http://www.grasshopper3d.com/forum/topics/import-an-stl-file-direct-in-grasshopper
# Parse STLs to Mesh
path = FilePath(python_2.a)
vb = VBScript(F=path)  # -> out, Mesh
# ---------- vb: VB ----------
    Dim stl = My.Computer.FileSystem.ReadAllBytes(F)
    print("File length: " & stl.length() & " bytes")
    Dim numtris As Long = BitConverter.ToInt32(stl, 80)
    print("Number of triangles: " & numtris)
    Dim c,pos As Integer
    Dim tempmesh As New mesh
    Dim tempvect As Vector3f
    If (numtris * 50 + 84 = stl.length()) Then
      print("STL file length matches the number of triangle faces")
      For c = 0 To numtris - 1
        pos = c * 50 + 84
        tempvect = readVect3f(stl, pos)
        With tempmesh
          .Vertices.setvertex(c * 3, readPoint3f(stl, pos))
          .Vertices.setvertex(c * 3 + 1, readPoint3f(stl, pos))
          .Vertices.setvertex(c * 3 + 2, readPoint3f(stl, pos))
          .Faces.setface(c, c * 3, c * 3 + 1, c * 3 + 2)
          .Normals.SetNormal(c * 3, tempvect)
          .Normals.SetNormal(c * 3 + 1, tempvect)
          .Normals.SetNormal(c * 3 + 2, tempvect)
        End With
      Next
      tempmesh.Weld(math.PI)
    Else
      print("STL file length does not match the number of triangle faces")
    End If
    Mesh = tempmesh
# ---------- vb: VB additional code ----------
  '
  Private Function readSingle(ByRef stl As Byte(), ByRef pos As Integer) As Single
    readSingle = BitConverter.ToSingle(stl, pos)
    pos = pos + 4
  End Function

  Private Function readVect3f(ByRef stl As Byte(), ByRef pos As Integer) As Vector3f
    readVect3f = New Vector3f(readSingle(stl, pos), readSingle(stl, pos), readSingle(stl, pos))
  End Function

  Private Function readPoint3f(ByRef stl As Byte(), ByRef pos As Integer) As Point3f
    readPoint3f = New Point3f(readSingle(stl, pos), readSingle(stl, pos), readSingle(stl, pos))
  End Function
# ---------- end vb ----------
disjoint = DisjointMesh(Mesh=vb.Mesh)
preview = CustomPreview(
    Geometry=vb.Mesh,
    Shader={ambient=RGB(0, 0, 0), diffuse=RGB(255, 105, 180), emission=RGB(76, 32, 54), shine=0.5, specular=RGB(255, 255, 255), transparency=0})  # disabled

# ----
cull_tiny = PythonScript(meshes=disjoint, min_faces="50")  # -> out, a, culled; inputs meshes: list of Mesh, min_faces: Int32
# ---------- cull_tiny: Python ----------
import Rhino.Geometry as rg

a = []
culled = []

print "Min faces =", min_faces

for m in meshes:
    #print m.Faces.Count
    if m.Faces.Count > min_faces:
        a.append(m)
        print m.Faces.Count, ' - a'
    else:
        culled.append(m)
        print m.Faces.Count, ' - cull'
# ---------- end cull_tiny ----------

# ----
# Repair Invalid Meshes
python_3 = PythonScript(meshes=cull_tiny.a)  # -> out, simplify(valid), simplify(inval); inputs meshes: list of Mesh
# ---------- python_3: Python ----------
import rhinoscriptsyntax as rs
import Rhino.Geometry as rg

valid = []
inval = []

for m in meshes:
    if m.IsValid:
        print m, ('yes')
        valid.append(m)
    else:
        print m, ("NO!")
        inval.append(m)
# ---------- end python_3 ----------
explode = MeshExplode(Mesh=python_3.inval, Interpolate=False)  # -> simplify(Faces)
pshift = ShiftPaths(Data=python_3.valid, Offset=-1)
mjoin = MeshJoin(Meshes=explode)  # -> flatten(Mesh)
mesh = Mesh(flatten([pshift, mjoin]))

null = NullItem(Item=mesh)  # -> NullFlags, InvalidFlags, Description
cull = CullPattern(List=mesh, CullPattern=invert(null.NullFlags))

python_4 = PythonScript(meshes=cull)  # -> out, a, num_meshes; inputs meshes: list of Mesh
# ---------- python_4: Python ----------
import Rhino.Geometry as rg

a = []

for m in meshes:
    print m.Faces.Count
    if m.Faces.Count > 10:
        a.append(m)
    else:
        pass

num_meshes = len(a)
# ---------- end python_4 ----------
panel_7 = Panel("""_RunPythonScript in Rhino
"Automate_Export_Individual_Meshes_01"
""")
panel_8 = Panel(python_4.num_meshes)

# ---- group: DONT DELETE - Baked in Python
geo_to_export = Geometry(python_4.a)
