# Grasshopper definition 171216c_Sim1_Vorticity_joinmesh_16.gh (Grasshopper 1.0.4)
# plug-ins: MeshEdit Components, gHowl, LunchBox, Weaverbird

panel = Panel("C:\Users\Scott\Dropbox\NBI\Vorticity\OUTPUT\Sim_1\Thin_STLs")
# Read thin STL files in Dir
rhinopython_filepath = Panel("C:\Users\Scott\Dropbox\NBI\Vorticity\OUTPUT\Sim_1\FBXs")

# ---- group: BBox info
panel_2 = Panel("6.28318530718")
# Plane Pi Numbers
panel_3 = Panel("-3.1415926535")
panel_4 = Panel("+3.1415926535")

# ----
tolerance = Panel("-0.0001")
min_faces = Panel("10")
min_faces_2 = Panel("10")

python = PythonScript()  # -> SliderNickNames, SliderGuids
# ---------- python: Python ----------
import Grasshopper as gh

# Get the Grasshopper component, document and objects
ghComp = ghenv.Component
ghDoc = ghComp.OnPingDocument()
ghObjects = ghDoc.Objects

# Iterate the GH objects and get their name/guid if they are a slider
SliderNickNames = []
SliderGuids = []

for obj in ghObjects:
    if type(obj) is gh.Kernel.Special.GH_NumberSlider:
        
        # Get the slider nick name
        name = obj.NickName
        SliderNickNames.append(name)
        
        # Get instance guid
        guid = obj.InstanceGuid
        SliderGuids.append(str(guid))
        
        # Set the value of the sliders named "Foo" and "Ham"
        if name == "Foo" or name == "Ham":
            obj.Slider.Value = 0.42
            obj.ExpireSolution(True)
# ---------- end python ----------
panel_5 = Panel(python.SliderGuids)
panel_6 = Panel(python.SliderNickNames)

# ---- group: DONT DELETE - Iterated in Python
mesh_to_export = Slider(0, range=0..600)

# ---- group: Visualize Solo Pts
panel_7 = Panel("0.1")  # disabled

# ----
which_file_number = Slider(178, range=0..425)

# ----
# Sim 1 ONLY
python_2 = PythonScript(walk_dir=panel, y=which_file_number)  # -> out, a, how_many, current; inputs y: Int32
# ---------- python_2: Python ----------
import os
from os.path import isfile, join

#print('walk_dir = ' + walk_dir)
#print('walk_dir (absolute) = ' + os.path.abspath(walk_dir))

def all_Files_in(direct):
    allFiles = []
    for r, s, f in os.walk(direct):
        for filenavn in f:
            file_path = os.path.join(r, filenavn)
            allFiles.append(file_path)
            #print('\t- file %s (full path: %s)' % (filename, file_path))
    return allFiles

stlfiles = all_Files_in(walk_dir)

for s in stlfiles:
    print s.split('\\')[-1]
    
a = stlfiles[y]
how_many = len(stlfiles)
current = stlfiles[y].split('\\')[-1][:-9]
print current[:-9]
# ---------- end python_2 ----------
panel_8 = Panel(python_2.current)
panel_9 = Panel(python_2.out)
panel_10 = Panel(python_2.how_many)

# ---- group: http://www.grasshopper3d.com/forum/topics/import-an-stl-file-direct-in-grasshopper
# Parse STLs to Mesh
path = FilePath(python_2.a)
vb = VBScript(F=path)  # -> out, Mesh
# ---------- vb: VB ----------
    Dim stl = My.Computer.FileSystem.ReadAllBytes(F)
    print("File length: " & stl.length() & " bytes")
    Dim numtris As Long = BitConverter.ToInt32(stl, 80)
    print("Number of triangles: " & numtris)
    Dim c,pos As Integer
    Dim tempmesh As New mesh
    Dim tempvect As Vector3f
    If (numtris * 50 + 84 = stl.length()) Then
      print("STL file length matches the number of triangle faces")
      For c = 0 To numtris - 1
        pos = c * 50 + 84
        tempvect = readVect3f(stl, pos)
        With tempmesh
          .Vertices.setvertex(c * 3, readPoint3f(stl, pos))
          .Vertices.setvertex(c * 3 + 1, readPoint3f(stl, pos))
          .Vertices.setvertex(c * 3 + 2, readPoint3f(stl, pos))
          .Faces.setface(c, c * 3, c * 3 + 1, c * 3 + 2)
          .Normals.SetNormal(c * 3, tempvect)
          .Normals.SetNormal(c * 3 + 1, tempvect)
          .Normals.SetNormal(c * 3 + 2, tempvect)
        End With
      Next
      tempmesh.Weld(math.PI)
    Else
      print("STL file length does not match the number of triangle faces")
    End If
    Mesh = tempmesh
# ---------- vb: VB additional code ----------
  '
  Private Function readSingle(ByRef stl As Byte(), ByRef pos As Integer) As Single
    readSingle = BitConverter.ToSingle(stl, pos)
    pos = pos + 4
  End Function

  Private Function readVect3f(ByRef stl As Byte(), ByRef pos As Integer) As Vector3f
    readVect3f = New Vector3f(readSingle(stl, pos), readSingle(stl, pos), readSingle(stl, pos))
  End Function

  Private Function readPoint3f(ByRef stl As Byte(), ByRef pos As Integer) As Point3f
    readPoint3f = New Point3f(readSingle(stl, pos), readSingle(stl, pos), readSingle(stl, pos))
  End Function
# ---------- end vb ----------
disjoint = DisjointMesh(Mesh=vb.Mesh)
preview = CustomPreview(Geometry=vb.Mesh)  # disabled

# ----
cull_tiny = PythonScript(meshes=disjoint, min_faces="50")  # -> out, a, culled; inputs meshes: list of Mesh, min_faces: Int32
# ---------- cull_tiny: Python ----------
import Rhino.Geometry as rg

a = []
culled = []

print "Min faces =", min_faces

for m in meshes:
    #print m.Faces.Count
    if m.Faces.Count > min_faces:
        a.append(m)
        print m.Faces.Count, ' - a'
    else:
        culled.append(m)
        print m.Faces.Count, ' - cull'
# ---------- end cull_tiny ----------

# ----
# Repair Invalid Meshes
python_3 = PythonScript(meshes=cull_tiny.a)  # -> out, simplify(valid), simplify(inval); inputs meshes: list of Mesh
# ---------- python_3: Python ----------
import rhinoscriptsyntax as rs
import Rhino.Geometry as rg

valid = []
inval = []

for m in meshes:
    if m.IsValid:
        print m, ('yes')
        valid.append(m)
    else:
        print m, ("NO!")
        inval.append(m)
# ---------- end python_3 ----------
explode = MeshExplode(Mesh=python_3.inval, Interpolate=False)  # -> simplify(Faces)
pshift = ShiftPaths(Data=python_3.valid, Offset=-1)
mjoin = MeshJoin(Meshes=explode)  # -> flatten(Mesh)
mesh = Mesh(flatten([pshift, mjoin]))

clean = CleanTree(RemoveNulls=True, RemoveInvalid=True, RemoveEmpty=False, Tree=mesh)
python_4 = PythonScript(pi=panel_4, meshes=clean, toler=tolerance, two_pi=panel_2)  # -> out, planes, direction, cut, stitch, virgin; inputs meshes: list of Mesh
# ---------- python_4: Python ----------
import Rhino.Geometry as rg
import rhinoscriptsyntax as rs

x_pos = rg.Plane(rg.Point3d(pi + toler,0,0),rg.Vector3d(pi,0,0))
x_neg = rg.Plane(rg.Point3d(-pi - toler,0,0),rg.Vector3d(-pi,0,0))
y_pos = rg.Plane(rg.Point3d(0,pi + toler,0),rg.Vector3d(0,pi,0))
y_neg = rg.Plane(rg.Point3d(0,-pi - toler,0),rg.Vector3d(0,-pi,0))
z_pos = rg.Plane(rg.Point3d(0,0,pi + toler),rg.Vector3d(0,0,pi))
z_neg = rg.Plane(rg.Point3d(0,0,-pi - toler),rg.Vector3d(0,0,-pi))

orig_planes = [x_neg, x_pos, y_pos, y_neg, x_pos, z_neg]
planes = []
direction = []
cut = []
stitch = []
virgin = []

for m in meshes:
    # X
    if rg.Intersect.Intersection.MeshPlane(m, x_pos):
        # MOVE CUTS HERE BEFORE APPEND
        m.Translate(rg.Vector3d(-two_pi,0,0))
        cut.append(m)
        planes.append(x_pos)
        direction.append('X')
    elif rg.Intersect.Intersection.MeshPlane(m, x_neg):
        stitch.append(m)
        planes.append(x_neg)
        direction.append('X')
    
    # Y
    elif rg.Intersect.Intersection.MeshPlane(m, y_pos):
        m.Translate(rg.Vector3d(0, -two_pi, 0))
        cut.append(m)
        planes.append(y_pos)
        direction.append('Y')
    elif rg.Intersect.Intersection.MeshPlane(m, y_neg):
        stitch.append(m)
        planes.append(y_neg)
        direction.append('Y')
    
    # Z
    elif rg.Intersect.Intersection.MeshPlane(m, z_pos):
        m.Translate(rg.Vector3d(0, 0, -two_pi))
        cut.append(m)
        planes.append(z_pos)
        direction.append('Z')
    elif rg.Intersect.Intersection.MeshPlane(m, z_neg):
        stitch.append(m)
        planes.append(z_neg)
        direction.append('Z')
    
    # Untouched
    else:
        virgin.append(m)

"""
if len(meshes)== len(cut) + len(stitch) + len(virgin) and len(cut) == len(stitch):
    print 'PASSES - ' + direction
else:
    print 'FAILS - ' + direction 
"""
print '-'
print 'Total -', len(meshes)
print 'Cut -', len(cut), 'Stitch -', len(stitch)
print 'Untouched -', len(virgin)
print '-'
print 'To Export -', len(virgin) + len(cut)

print direction
# ---------- end python_4 ----------
# Sort and Move Meshes
panel_11 = Panel(python_4.out)
mesh_stitch = Mesh(simplify(python_4.stitch))
# Moved
mesh_cut = Mesh(simplify(python_4.cut))
mesh_virgin = Mesh(simplify(python_4.virgin))
python_5 = PythonScript(m1=mesh_cut, m2=mesh_stitch)  # -> short, long; inputs m1: list of Mesh, m2: list
# ---------- python_5: Python ----------
import Rhino.Geometry as rg
import Rhino as rh

long = []
short = []

if len(m1) > len(m2):
    long = m1       #[m for m in m1]
    short = m2      #[x for x in m2]
else:
    short = m1      #[m for m in m1]
    long = m2       #[x for x in m2]

print len(m1), len(m2)
print len(long), len(short)


#rh.Collections.Point3dList.ClosestPointInList(
# ---------- end python_5 ----------

# ---- group: Average all pts
python_6 = PythonScript(mesh=python_5.long)  # -> avg_pt; inputs mesh: list of Mesh
# ---------- python_6: Python ----------
import Rhino.Geometry as rg 

"""
Returns a pseudo-centroid, an average of all mesh Face centroid
"""

avg_pt = []

for m in mesh:


    totalFac = m.Faces.Count
    #print totalFac
    x = 0 #m.Faces.GetFaceCenter(0).X
    y = 0 #m.Faces.GetFaceCenter(0).Y
    z = 0 #m.Faces.GetFaceCenter(0).Z
    
    
    for i in range(0, m.Faces.Count):       # ONLY AVERAGING EVERY 10
        center = m.Faces.GetFaceCenter(i)
        
        x += center.X
        y += center.Y
        z += center.Z
        average = rg.Point3d(x/totalFac, y/totalFac, z/totalFac)
    
    avg_pt.append(average)
    print "# faces ", m.Faces.Count
# ---------- end python_6 ----------
# Order Lists
# (short/long)
# IF it has a pair:
#     WELD them
python_7 = PythonScript(mesh=python_5.short)  # -> avg_pt; inputs mesh: list of Mesh; same code as python_6

# ---- group: First CP
cp = ClosestPoint(Point=python_7, Cloud=python_6)  # -> ClosestPoint, CPIndex, Distance

# ----
cset = CreateSet(List=cp.CPIndex)  # -> Set, Map

# ---- group: Points
item = ListItem(List=python_6, Index=cset.Set, Wrap=True)

# ---- group: Solo Meshes 1
# IF no pair:
#     CAP it
python_8 = PythonScript(long=python_6, matched=item)  # -> solos, solo_i; inputs long: list of Point3d, matched: list of Point3d
# ---------- python_8: Python ----------
solos = []
solo_i = []

for iter, l in enumerate(long):
    if l in matched:
        pass
    else:
        solos.append(l)
        solo_i.append(iter)
# ---------- end python_8 ----------
item_2 = ListItem(List=python_5.long, Index=python_8.solo_i, Wrap=True)  # -> simplify(graft(Item))

# ---- group: LONG PAIR
item_3 = ListItem(List=python_5.long, Index=cset.Set, Wrap=True)

# ----
mesh_virgin_2 = Mesh(mesh_virgin)
pshift_2 = ShiftPaths(Data=mesh_virgin_2, Offset=-1)

# ---- group: Reverse CP
# 1st CP
# 2nd CP -
# (reverse cp)
cp_2 = ClosestPoint(Point=item, Cloud=python_7)  # -> ClosestPoint, CPIndex, Distance

# ----
cset_2 = CreateSet(List=cp_2.CPIndex)  # -> Set, Map

# ---- group: Reverse CP (continued)
item_4 = ListItem(List=python_7, Index=cset_2.Set, Wrap=True)

# ---- group: Solo Meshes 2
python_9 = PythonScript(long=python_7, matched=item_4)  # -> solos, solo_i; inputs long: list of Point3d, matched: list of Point3d; same code as python_8
item_5 = ListItem(List=python_5.short, Index=python_9.solo_i, Wrap=True)  # -> simplify(graft(Item))

# ---- group: SHORT PAIR
item_6 = ListItem(List=python_5.short, Index=cset_2.Set, Wrap=True)

# ----
short = ShortestList(ListA=item_6, ListB=item_3, TrimMode=2)  # -> ListA, ListB
python_10 = PythonScript(mesh=short.ListA)  # -> avg_pt; inputs mesh: list of Mesh; same code as python_6
python_11 = PythonScript(mesh=short.ListB)  # -> avg_pt; inputs mesh: list of Mesh; same code as python_6
dist = Distance(PointA=python_10, PointB=python_11)

# ---- group: Viz Analysis
points = PointList(Points=flatten(python_10), Size=0.4)  # disabled
points_2 = PointList(Points=flatten(python_11), Size=0.6)  # disabled

# ----
python_12 = PythonScript(dists=dist, A=short.ListA, B=short.ListB)  # -> out, a, b, solo; inputs dists: list, A: list of Mesh, B: list of Mesh
# ---------- python_12: Python ----------
"""
If A and B are out of tolerance, send to SOLO Mesh bin
If not, pass them through
"""

solo_indices = []
solo = []   # put meshes to split up here

tolerance = 0.4

for i, d in enumerate(dists):
    if d > tolerance:
        print i, ' - ', d
        solo_indices.append(i)

for j in solo_indices:
    print j
    solo.append(A[j])
    solo.append(B[j])

for k in sorted(solo_indices, reverse=True):
    del A[k]
    del B[k]

a = A
b = B
# ---------- end python_12 ----------

# ---- group: Out of Tolerance Matches
mesh_2 = Mesh(simplify(graft(python_12.solo)))
wbnaked = WeaverbirdsNakedBoundary(MeshClosedPolylines=mesh_2)
m_fill = FillMeshHoles(P=wbnaked)  # -> out, graft(M); inputs P: Curve, clr: list of Color
# ---------- m_fill: VB ----------
    Component.Params.Input(0).Name = "Curves"
    Component.Params.Input(0).Description = "A list of open or closed curves"
    Component.Params.Input(1).Name = "Vertex Color "
    Component.Params.Input(1).Description = "A an optional list of colors corresponding to each control point of the input curve, and additional color can be added for the center of the new mesh."

    Component.Params.Output(1).Name = "Mesh"
    Component.Params.Output(1).Description = "If successful, a valid mesh"

    If P IsNot Nothing Then
      Dim ncrv As NurbsCurve
      Dim npts As rhino.Geometry.Collections.NurbsCurvePointList
      Dim pline As polyline

      Dim avgClr,tclr As color
      Dim ov As New list(Of point3d)
      Dim oc As New list(Of Color)
      Dim ofc As New list(Of MeshFace)

      Dim i,j As Integer
      ncrv = P.ToNurbsCurve()
      npts = ncrv.Points
      pline = npts.ControlPolygon

      ov = pline.toarray().ToList()
      If P.IsClosed() Then ov.removeat(ov.count() - 1)
      j = ov.count() - 1
      ov.add(pline.CenterPoint)

      For i = 0 To j Step 1
        If (clr.count()) > 0 Then
          If i > (clr.count() - 1) Then tclr = clr.item(clr.count() - 1) Else tclr = clr.item(i)
          If i = 0 Then avgClr = tclr Else avgClr = colorAverage(avgClr, tclr, 0.5)
          oc.add(tclr)
        End If

        If ((i = j) And (P.IsClosed())) Then
          ofc.add(New meshface(i, 0, j + 1))
        Else
          ofc.add(New meshface(i, i + 1, j + 1))
        End If
      Next

      If (clr.count()) > 0 Then If(j + 1) = (clr.count() - 1) Then oc.add(clr.item(j + 1)) Else oc.add(avgClr)

      Dim msh As New mesh
      msh.Vertices.AddVertices(ov.toarray())
      msh.Faces.AddFaces(ofc.toarray())
      If (clr.count()) > 0 Then msh.VertexColors.AppendColors(oc.toarray())

      M = msh
    End If
# ---------- m_fill: VB additional code ----------
  Function colorAverage(ByVal clrA As color, ByVal clrB As color, ByVal t As Double)
    Dim clrOut As color
    Dim R,G,B As Integer

    If CInt(clrA.r * t + clrB.r * (1 - t)) > 255 Then
      R = 255
    ElseIf CInt(clrA.r * t + clrB.r * (1 - t)) < 0 Then
      R = 0
    Else
      R = CInt(clrA.r * t + clrB.r * (1 - t))
    End If

    If CInt(clrA.g * t + clrB.g * (1 - t)) > 255 Then
      G = 255
    ElseIf CInt(clrA.g * t + clrB.g * (1 - t)) < 0 Then
      G = 0
    Else
      G = CInt(clrA.g * t + clrB.g * (1 - t))
    End If

    If CInt(clrA.b * t + clrB.b * (1 - t)) > 255 Then
      B = 255
    ElseIf CInt(clrA.b * t + clrB.b * (1 - t)) < 0 Then
      B = 0
    Else
      B = CInt(clrA.b * t + clrB.b * (1 - t))
    End If

    clrOut = color.fromargb(R, G, B)
    Return clrOut
  End Function
# ---------- end m_fill ----------
pshift_3 = ShiftPaths(Data=m_fill.M, Offset=-1)
mjoin_2 = MeshJoin(Meshes=[pshift_3, mesh_2])
mesh_3 = Mesh(simplify(mjoin_2))

# ----
# Visual Verify
python_13 = PythonScript(mesh=python_12.b)  # -> avg_pt; inputs mesh: list of Mesh; disabled; same code as python_6
python_14 = PythonScript(mesh=python_12.a)  # -> avg_pt; inputs mesh: list of Mesh; disabled; same code as python_6

# ---- group: Pair Visualization
polygon = Polygon(Plane=[python_13, python_14], Radius=0.15, Segments=3, FilletRadius=0)  # -> Polygon, Length; disabled
ln = Line(StartPoint=python_14, EndPoint=python_13)  # disabled
pipe = Pipe(Curve=ln, Radius=0.05, Caps=2)  # disabled

# ---- group: All Solo Meshes
mesh_4 = Mesh(flatten([item_5, item_2, mesh_3]))

# ----
len = Length(Curve=ln)  # disabled
sort = SortList(Keys=len)  # -> Keys, ValuesA; disabled
centroid_dist_apart = Panel(sort.Keys)  # disabled

clean_2 = CleanTree(RemoveNulls=True, RemoveInvalid=True, RemoveEmpty=False, Tree=mesh_4)

# ---- group: Long list mesh halfs
mesh_5 = Mesh(python_12.b)

# ---- group: Short list mesh halfs
mesh_6 = Mesh(python_12.a)

# ---- group: Visualize Solo Pts (continued)
python_15 = PythonScript(mesh=clean_2)  # -> avg_pt; inputs mesh: list of Mesh; disabled
# ---------- python_15: Python ----------
"""
Returns a pseudo-centroid, an average of all mesh Face centroid
"""

import Rhino.Geometry as rg 

avg_pt = []

for m in mesh:


    totalFac = m.Faces.Count
    #print totalFac
    x = 0 #m.Faces.GetFaceCenter(0).X
    y = 0 #m.Faces.GetFaceCenter(0).Y
    z = 0 #m.Faces.GetFaceCenter(0).Z
    
    
    for i in range(0, m.Faces.Count):       # ONLY AVERAGING EVERY 10
        center = m.Faces.GetFaceCenter(i)
        
        x += center.X
        y += center.Y
        z += center.Z
        average = rg.Point3d(x/totalFac, y/totalFac, z/totalFac)
    
    avg_pt.append(average)
    print "# faces ", m.Faces.Count
# ---------- end python_15 ----------
box = CenterBox(Base=python_15, X=panel_7, Y=panel_7, Z=panel_7)  # disabled

# ---- group: Short list mesh halfs
mesh_7 = Mesh(simplify(graft(mesh_6)))

# ---- group: Long list mesh halfs
mesh_8 = Mesh(simplify(graft(mesh_5)))

# ---- group: All Solo Meshes
mesh_9 = Mesh(clean_2)

# ----
wbjoin = WeaverbirdsJoinMeshesAndWeld(Mesh=[mesh_7, mesh_8], Weld=True)
# WELD Seams
wbnaked_2 = WeaverbirdsNakedBoundary(MeshClosedPolylines=wbjoin)
m_loft = MeshLoft(P=wbnaked_2, T=5, O=True, F=False, C=False)  # -> out, M; inputs P: list of Curve, clr: list
# ---------- m_loft: VB ----------
    Component.Params.Input(0).Name = "Curves"
    Component.Params.Input(0).Description = "A list of open or closed curves"
    Component.Params.Input(1).Name = "Face Type"
    Component.Params.Input(1).Description = "0=Quad, 1=Triangulate, 2=Zig Zag, 3=Wave, 4=Diamond, 5=Shortest, 6=Longest"
    Component.Params.Input(2).Name = "Attempt Orientation"
    Component.Params.Input(2).Description = "An optional boolean input which if true will attempt to shift each curves control points to reduce torsion"
    Component.Params.Input(3).Name = "Flip"
    Component.Params.Input(3).Description = "An optional boolean input which if true will reverse the direction of triangulation when possible"
    Component.Params.Input(4).Name = "Closed"
    Component.Params.Input(4).Description = "An optional boolean input which if true will connect the last curve back to the first"
    Component.Params.Input(5).Name = "Color [Vertex]"
    Component.Params.Input(5).Description = "An optional color or list of colors corresponding to each new vertex of the mesh"

    Component.Params.Output(1).Name = "Mesh"
    Component.Params.Output(1).Description = "If successful, a valid mesh"

    If P.count() > 1 Then
      Dim MO As New mesh
      Dim mt As New mesh
      Dim i,j,k,r,s,n,u,v,w,x,y As Integer
      Dim arrFc As New list(Of MeshFace)
      Dim arrClr As New list(Of color)
      Dim blnC As New list(Of Boolean)
      Dim us() As Integer
      Dim cen(2), tpt(1) As point3d
      Dim mv As Rhino.Geometry.Collections.MeshVertexList
      Dim oc As New list(Of color)
      mv = mt.Vertices

      'Optional Colors
      Dim tclr As New datatree(Of color)
      Dim tcx As Integer
      For j = 0 To P.count() - 1 Step 1
        Dim tncr As New nurbscurve(P.item(j).tonurbscurve)
        Dim tpln As New polyline(tncr.Points.ControlPolygon())

        Dim cs As New dictionary(Of Integer,Object)
        Dim blnX As New Boolean
        If ((j > clr.count()) Or (clr.count() = 0)) Then
          cs.add(0, color.White)
          cs.add(1, color.White)
        Else
          cs = clr.item(j)
          If cs.count() > 0 Then blnX = True
        End If

        If blnX Then
          For k = 0 To cs.count() - 2 Step 1
            tclr.add(color.FromArgb(cs.item(k).R, cs.item(k).G, cs.item(k).B), New gh_path(j))
          Next
        End If

        If tpln.count() > cs.count() Then
          tcx = cs.count() - 1
          For k = cs.count() To tpln.count() - 2 Step 1
            tclr.add(color.FromArgb(cs.item(tcx).R, cs.item(tcx).G, cs.item(tcx).B), New gh_path(j))
          Next
        End If
      Next

      'Vertices
      s = 0
      If C Then y = 0 Else y = 1
      If f Then x = 0 Else x = 1
      For i = 0 To P.count() - y Step 1
        If i < P.count() Then
          Dim ncrv As New nurbscurve(P.item(i).tonurbscurve())
          Dim npts As Rhino.Geometry.Collections.NurbsCurvePointList
          npts = ncrv.Points()
          Dim pline As polyline = npts.ControlPolygon
          cen(1) = pline.CenterPoint
          If i = 0 Then cen(2) = cen(1)
          If P.item(i).IsClosed() Then
            pline.RemoveAt(pline.Count() - 1)
            blnC.add(True)
          Else
            blnC.add(False)
          End If
          v = pline.Count() - 1
          If o Then
            If (i > 0) Then
              If (blnC.item(i) And blnC.item(i - 1)) Then pline = radSrtPt(cen(1), tpt(0), tpt(1), cen(0), pline)(0)
            Else
              Dim ncrvA As New nurbscurve(P.item(1).tonurbscurve())
              Dim plineA As polyline = ncrvA.points.ControlPolygon
              If P.item(1).IsClosed() Then plineA.RemoveAt(plineA.Count() - 1)
              If (blnC.item(i) And P.item(1).isclosed()) Then pline = radSrtPt(plineA.CenterPoint, pline.item(0), pline.item(pline.count() - 1), pline.CenterPoint, pline)(0)
            End If
          End If

          tpt(0) = pline.item(0)
          tpt(1) = pline.item(pline.count() - 1)
          cen(0) = cen(1)

          mv.AddVertices(pline.ToArray())
          oc.addrange(tclr.branch(i))
          n = s
          us = Series(pline.count() - 1)
        Else
          If o Then
            Dim ncrvA As New nurbscurve(P.item(0).tonurbscurve())
            Dim plineA As polyline = ncrvA.points.ControlPolygon
            If P.item(0).IsClosed() Then plineA.RemoveAt(plineA.Count() - 1)
            us = radSrtPt(cen(2), tpt(0), tpt(1), cen(0), plineA)(1)
          Else
            us = Series(r)
          End If
          n = -1
          If P.item(0).isclosed() Then blnC.add(True) Else blnC.add(False)
        End If

        Dim tu(),tv() As Integer
        If i > 0 Then
          If i = P.count() Then v = r
          If blnC.item(i) Then tv = appendprepend(v) Else tv = prepend(v)
          If blnC.item(i - 1) Then tu = appendprepend(u) Else tu = prepend(u)
          If ubound(tu) > ubound(tv) Then k = ubound(tu) Else k = ubound(tv)
          Dim blnU, blnV As New Boolean
          For j = 1 To k Step 1

            If ((j < ubound(tv)) And (j < ubound(tu))) Then
              'This is where faces with 4 valid vertices go

              Dim d(1) As Double
              Dim viD(3) As Double

              viD(0) = s - u + tu(j)
              viD(1) = s - u + tu(j + 1)
              viD(2) = n + 1 + us(tv(j + 1))
              viD(3) = n + 1 + us(tv(j))

              d(0) = mv.item(viD(0)).distanceto(mv.item(viD(2)))
              d(1) = mv.item(viD(1)).distanceto(mv.item(viD(3)))

              'set edge pattern
              If t = 1 Then'Triangulate
                w = x
              ElseIf t = 2 Then 'ZigZag
                If ((i + 1 + x) Mod 2) Then w = 1 Else w = 0
              ElseIf t = 3 Then 'Wave
                If ((j + 1 + x) Mod 2) Then w = 1 Else w = 0
              ElseIf t = 4 Then 'Diamond
                If ((i + 1 + x) Mod 2) Then
                  If ((j + 1) Mod 2) Then w = 1 Else w = 0
                Else
                  If ((j + 1) Mod 2) Then w = 0 Else w = 1
                End If
              ElseIf t = 5 Then 'Shortest
                If d(0) > d(1) Then w = 0 Else w = 1
              ElseIf t = 6 Then 'Longest Length
                If d(0) > d(1) Then w = 1 Else w = 0
              Else
                w = 2
              End If


              'Assign Faces
              If w = 0 Then
                arrFc.add(New meshface(viD(0), viD(1), viD(3)))
                arrFc.add(New meshface(viD(1), viD(2), viD(3)))
              ElseIf w = 1 Then
                arrFc.add(New meshface(viD(0), viD(1), viD(2)))
                arrFc.add(New meshface(viD(0), viD(2), viD(3)))
              Else
                arrFc.add(New meshface(viD(0), viD(1), viD(2), viD(3)))
              End If

            ElseIf ((j < ubound(tv))) Then
              arrFc.add(New meshface(s - u + tu(ubound(tu)), n + 1 + us(tv(j + 1)), n + 1 + us(tv(j))))
            ElseIf ((j < ubound(tu)))  Then
              arrFc.add(New meshface(s - u + tu(j), s - u + tu(j + 1), n + 1 + us(tv(ubound(tv)))))
            End If
          Next

        Else
          r = v
        End If
        u = v
        s = mv.count() - 1
      Next

      MO.Vertices.AddVertices(mv)
      If clr.count() > 0 Then MO.VertexColors.AppendColors(oc.toarray())
      MO.Faces.AddFaces(arrFc.toarray())
      MO.Normals.ComputeNormals()
      MO.FaceNormals.ComputeFaceNormals()

      M = MO
    End If
# ---------- m_loft: VB additional code ----------
  Private Function appendprepend(ByVal i As Integer)
    Dim srsEnum As IEnumerable(Of Integer) = Enumerable.Range(0, i + 1)
    Dim arrVal As New list(Of Integer)
    arrVal = srsEnum.tolist()
    arrVal.add(0)
    arrVal.insert(0, i)
    Return arrVal.toarray()
  End Function

  Private Function prepend(ByVal i As Integer)
    Dim srsEnum As IEnumerable(Of Integer) = Enumerable.Range(0, i + 1)
    Dim arrVal As New list(Of Integer)
    arrVal = srsEnum.tolist()
    arrVal.insert(0, i)
    Return arrVal.toarray()
  End Function

  Private Function Series(ByVal i As Integer)
    Dim srsEnum As IEnumerable(Of Integer) = Enumerable.Range(0, i + 1)
    Dim arrVal As New list(Of Integer)
    arrVal = srsEnum.tolist()
    Return arrVal.toarray()
  End Function

  Private Function radSrtPt(ByVal cenA As point3d, ByVal ptA As point3d, ByVal ptB As point3d, ByVal cenB As point3d, ByVal ptList As polyline)
    Dim i As Integer
    Dim arrOut() As point3d
    Dim vecA, vecB, vecC As New Vector3d
    vecA = (ptA + ptB) / 2 - cenB
    vecB = cenB - cenA
    vecC = vector3d.CrossProduct(vecB, vecA)

    Dim pln As New plane(cenB, vecB, vecA)
    pln = New plane(cenB, pln.YAxis, pln.ZAxis)
    Dim ptTemp As New list(Of point3d)
    Dim dblAng(),dblAngA() As Double
    Dim intSrt() As Integer

    ReDim dblAng(ptList.count() - 1)
    ReDim dblAngA(ptList.count() - 1)
    ReDim intSrt(ptList.count() - 1)

    For i = 0 To ptList.count() - 1 Step 1
      Dim vec As vector3d
      ptTemp.add(ptList.item(i))
      intSrt(i) = i
      vec = pln.ClosestPoint(ptList.item(i)) - cenA
      dblAng(i) = vector3d.VectorAngle(vec, pln.XAxis, pln)
      dblAngA(i) = dblAng(i)
    Next

    arrOut = ptTemp.toarray()
    array.Sort(dblAng, arrOut)
    array.Sort(dblAngA, intSrt)

    Dim plineO As New Polyline(arrOut)

    Return {plineO,intSrt}
  End Function
# ---------- end m_loft ----------

# ---- group: Average Edge Length
cluster = Cluster(M=wbjoin)  # disabled
avg_edge_length = Panel(cluster)  # disabled

# ----
wbjoin_2 = WeaverbirdsJoinMeshesAndWeld(Mesh=[m_loft.M, wbjoin], Weld=True)

print_v_f = PythonScript(mesh=flatten(wbjoin))  # -> out; inputs mesh: list of Mesh; disabled
# ---------- print_v_f: Python ----------
import Rhino.Geometry as rg

#rg.Mesh.
vfs = []

for m in mesh:
    vfs.append([m.Vertices.Count, m.Faces.Count])

vfs.sort()
for v in vfs:
    print 'V:%d F:%d' % (v[0], v[1])
# ---------- end print_v_f ----------
panel_12 = Panel(print_v_f)  # disabled

weldvertices = MeshWeldVertices(Mesh=wbjoin_2, Tolerance="0.03")  # -> RuntimeMessage, flatten(Mesh)

python_16 = PythonScript(meshes=weldvertices.Mesh, min_faces=min_faces)  # -> out, a, culled; inputs meshes: list of Mesh, min_faces: Int32
# ---------- python_16: Python ----------
import Rhino.Geometry as rg

a = []
culled = []

#min_faces = 10

print "Min faces =", min_faces

for m in meshes:
    print m.Faces.Count
    if m.Faces.Count > min_faces:
        a.append(m)
    else:
        culled.append(m)
# ---------- end python_16 ----------

# ---- group: Fresh Sewn Chips
mesh_10 = Mesh(python_16.a)

# ----
pshift_4 = ShiftPaths(Data=mesh_10, Offset=-1)
mesh_11 = Mesh([pshift_4, mesh_9])
python_17 = PythonScript(m=mesh_11)  # -> msg, simplify(open), closed; inputs m: list of Mesh
# ---------- python_17: Python ----------
import Rhino.Geometry as rg
import Rhino as rh

open = []
closed = []

for mesh in m:
    naked = mesh.GetNakedEdges

    if mesh.IsClosed:
        print 'yes - Closed', naked
        closed.append(mesh)
    else:
        print 'no - Open'#, naked
        open.append(mesh)

msg = 'Open: %d, Closed: %d' % (len(open), len(closed))
# ---------- end python_17 ----------
weldvertices_2 = MeshWeldVertices(Mesh=python_17.open, Tolerance="0.08")  # -> RuntimeMessage, flatten(Mesh)
mesh_12 = Mesh(python_17.closed)
# Keep Already Closed Meshes
python_18 = PythonScript(m=weldvertices_2.Mesh)  # -> msg, simplify(open), closed; inputs m: list of Mesh; same code as python_17

# ----
# Euler‐Poincaré
# V + F - E = 2
euler = Euler(M_2=mesh_12, M=mesh_12)  # disabled
panel_13 = Panel(euler)  # disabled

panel_14 = Panel(python_18.msg)  # disabled
merge = Merge(Data1=weldvertices_2.Mesh, Data2=mesh_12)
mesh_stitched_capped = Mesh(merge)

# ---- group: All Chips
mesh_13 = Mesh([mesh_stitched_capped, pshift_2])

# ---- group: Cull tiny, unused meshes
python_19 = PythonScript(meshes=mesh_13, min_faces=min_faces_2)  # -> out, flatten(a), culled; inputs meshes: list of Mesh, min_faces: Int32
# ---------- python_19: Python ----------
import Rhino.Geometry as rg

a = []
culled = []

print "Min faces =", min_faces

for m in meshes:
    print m.Faces.Count
    if m.Faces.Count > min_faces:
        a.append(m)
    else:
        culled.append(m)
# ---------- end python_19 ----------

# ---- group: All Chips Capped
mesh_14 = Mesh(python_19.a)

# ----
python_20 = PythonScript(m=mesh_14)  # -> msg, open, closed; inputs m: list of Mesh; disabled; same code as python_17
panel_15 = Panel(python_20.msg)  # disabled

# ----
# Export to Individual 3dms
python_21 = PythonScript(meshes=mesh_14)  # -> out, a, num_meshes; inputs meshes: list of Mesh
# ---------- python_21: Python ----------
import Rhino.Geometry as rg

a = []

for m in meshes:
    print m.Faces.Count
    if m.Faces.Count > 10:
        a.append(m)
    else:
        pass

num_meshes = len(a)
# ---------- end python_21 ----------
panel_16 = Panel("""_RunPythonScript in Rhino
"Automate_Export_Individual_Meshes_01"
""")
panel_17 = Panel(python_21.num_meshes)
mesh_15 = Mesh(python_21.a)
meshes = PythonScript(num_meshes=python_21.num_meshes)  # -> out; inputs num_meshes: Int32
# ---------- meshes: Python ----------
import scriptcontext as sc


sc.sticky["Meshes_To_Export"] = num_meshes

print num_meshes, ' variable copied to sticky variable to Rhino Python editor'
# ---------- end meshes ----------
item_7 = ListItem(List=mesh_15, Index=mesh_to_export, Wrap=False)

# ---- group: DONT DELETE - Baked in Python
geo_to_export = Geometry(item_7)

# ----
# Write Mesh Data to CSV
panel_18 = Panel("C:\Users\Scott\Desktop\test\dataout.csv")  # disabled
# Data to WRITE:
# Mesh Name
# Vol Centroid
# Volume
# Euler-Poincare formula
volume = MeshVolume(Mesh=python_21.a)  # -> Volume, Centroid; disabled
spreadsheet_writer = SpreadsheetWriter(Path=panel_18, SheetData1=volume.Volume)  # disabled
index = ItemIndex(List=python_21.a, Item=python_21.a)  # disabled
button = Button()  # disabled
excelwrite = ExcelWrite(
    WriteExcelData=button,
    WorkbookPath=panel_18,
    WorksheetName="Sheet1",
    ColumnHeadings="Valence",
    Data=index,
    ClearSheet=False)  # disabled

# ==== cluster Euler
M = ClusterInput()
M_2 = ClusterInput()
demesh = DeconstructMesh(Mesh=M)  # -> Vertices, Faces, Colours, Normals
medges = MeshEdges(Mesh=M_2)  # -> NakedEdges, InteriorEdges, NonManifoldEdges
lng = ListLength(List=medges.NakedEdges)
lng_2 = ListLength(List=medges.InteriorEdges)
lng_3 = ListLength(List=medges.NonManifoldEdges)
lng_4 = ListLength(List=demesh.Vertices)
lng_5 = ListLength(List=demesh.Faces)
addition = Addition(A=lng, B=lng_2, C=lng_3)
eval = Evaluate(F="v+f-e", v=lng_4, f=lng_5, e=addition)  # -> flatten(r)
sort = SortList(Keys=eval, ValuesA=eval)  # -> Keys, ValuesA
K = ClusterOutput(sort.Keys)

# ==== cluster Cluster
M = ClusterInput()
medges = MeshEdges(Mesh=M)  # -> NakedEdges, InteriorEdges, NonManifoldEdges
len = Length(Curve=medges.NakedEdges)  # -> flatten(Length)
avr = Average(Input=len)
am = ClusterOutput(avr)
