# Grasshopper definition Vorticity_joinmesh_5.gh (Grasshopper 0.9.76)
# plug-ins: Python Interpreter, Weaverbird

panel = Panel("C:\Users\Scott\Desktop\29-31\0_30_0.stl")
list = ValueList({"X": 0, "Y": 1, "Z": 2}, selected="X")

# ---- group: BBox info
panel_2 = Panel("6.28318530718")
dom = ConstructDomain(DomainStart="-3.1415926535", DomainEnd="+3.1415926535")
box = DomainBox(Base=PlaneXY(0, 0, 0), X=dom, Y=dom, Z=dom)
debrep = DeconstructBrep(Brep=box)  # -> Faces, Edges, Vertices

# ----
mesh = Mesh([<mesh referenced from the Rhino model> x120])

# ---- group: Cull tiny meshes
# Orig Meshes
# BBox
python = PythonScript(meshes=mesh)  # -> out, a; inputs meshes: list of Mesh
# ---------- python: Python ----------
import Rhino.Geometry as rg

a = []

for m in meshes:
    print m.Faces.Count
    if m.Faces.Count > 100:
        a.append(m)
    else:
        pass
# ---------- end python ----------

# ----
item = ListItem(List=debrep.Faces, Index="1", Wrap=True)
item_2 = ListItem(List=debrep.Faces, Index="3", Wrap=True)
# Planes
X = UnitX(Factor="-0.0001")

rev = Reverse(Vector=X)
move = Move(Geometry=item_2, Motion=rev)  # -> Geometry, Transform
move_2 = Move(Geometry=item, Motion=X)  # -> Geometry, Transform
pln = Plane(move_2.Geometry)
pln_2 = Plane(move.Geometry)

# ----
# Sort Meshes
python_2 = PythonScript(meshes=python.a, c_pln=pln, s_pln=pln_2)  # -> out, cut, stitch, virgin; inputs meshes: list of Mesh, c_pln: Plane, s_pln: Plane
# ---------- python_2: Python ----------
import Rhino.Geometry as rg
import rhinoscriptsyntax as rs

cut = []
stitch = []
virgin = []

for m in meshes:
    if rg.Intersect.Intersection.MeshPlane(m, c_pln):
        cut.append(m)
    elif rg.Intersect.Intersection.MeshPlane(m, s_pln):
        stitch.append(m)
    else:
        virgin.append(m)

if len(meshes)== len(cut) + len(stitch) + len(virgin) and len(cut) == len(stitch):
    print 'PASSES'
else:
    print 'FAILS'

print '-'
print 'Total -', len(meshes)
print 'Cut -', len(cut), 'Stitch -', len(stitch)
print 'Untouched -', len(virgin)
# ---------- end python_2 ----------
panel_3 = Panel(python_2.out)

mesh_stitch = Mesh(graft(python_2.stitch))
mesh_cut = Mesh(python_2.cut)
mesh_virgin = Mesh(simplify(flatten(python_2.virgin)))

demesh = DeconstructMesh(Mesh=mesh_stitch)  # -> flatten(Vertices), Faces, Colours, Normals
demesh_2 = DeconstructMesh(Mesh=mesh_cut)  # -> flatten(Vertices), Faces, Colours, Normals
X_2 = UnitX(Factor=panel_2)
rev_2 = Reverse(Vector=X_2)
# Move
move_3 = Move(Geometry=mesh_cut, Motion=rev_2)  # -> graft(Geometry), Transform
average_pt = PythonScript(pts=demesh_2.Vertices)  # -> out, a; inputs pts: list of Point3d
# ---------- average_pt: Python ----------
import Rhino.Geometry as rg

avg_pt = [0,0,0]

for p in pts:
    avg_pt[0] += p[0]
    avg_pt[1] += p[1]
    avg_pt[2] += p[2]

for n, coord in enumerate(avg_pt):
    print avg_pt[n]
    avg_pt[n] = coord/len(pts)
    print avg_pt[n]
    
print avg_pt

a = rg.Point3d(avg_pt[0], avg_pt[1], avg_pt[2])
# ---------- end average_pt ----------

# ---- group: Sort Vertically
wbnaked = WeaverbirdsNakedBoundary(MeshClosedPolylines=mesh_stitch)  # -> flatten(NakedCurves)
# Align Data
wbnaked_2 = WeaverbirdsNakedBoundary(MeshClosedPolylines=mesh_cut)  # -> flatten(NakedCurves)
area = Area(Geometry=wbnaked_2)  # -> Area, graft(Centroid)
area_2 = Area(Geometry=wbnaked)  # -> Area, graft(Centroid)
pdecon = Deconstruct(Point=area_2.Centroid)  # -> XComponent, YComponent, flatten(ZComponent)
pdecon_2 = Deconstruct(Point=area.Centroid)  # -> XComponent, YComponent, flatten(ZComponent)
sort = SortList(Keys=pdecon.ZComponent, ValuesA=flatten(mesh_stitch))  # -> Keys, simplify(graft(ValuesA))
sort_2 = SortList(Keys=pdecon_2.ZComponent, ValuesA=flatten(move_3.Geometry))  # -> Keys, simplify(graft(ValuesA))

# ----
pt = Point(average_pt.a)
mesh_2 = Mesh(sort.ValuesA)
mesh_3 = Mesh(sort_2.ValuesA)

# ---- group: Cull Tiny Edges
wbnaked_3 = WeaverbirdsNakedBoundary(MeshClosedPolylines=mesh_2)  # -> flatten(NakedCurves)
# Prep Seams
wbnaked_4 = WeaverbirdsNakedBoundary(MeshClosedPolylines=mesh_3)  # -> flatten(NakedCurves)
python_3 = PythonScript(crvs=wbnaked_3)  # -> c_out; inputs crvs: list of Curve
# ---------- python_3: Python ----------
import Rhino.Geometry as rg
import rhinoscriptsyntax as rs

c_out = []

for c in crvs:
    print rs.CurveLength(c)
    if rs.CurveLength(c) > .08:
        c_out.append(c)
    else:
        pass
# ---------- end python_3 ----------
python_4 = PythonScript(crvs=wbnaked_4)  # -> c_out; inputs crvs: list of Curve
# ---------- python_4: Python ----------
import Rhino.Geometry as rg
import rhinoscriptsyntax as rs

c_out = []

for c in crvs:
    print rs.CurveLength(c)
    if rs.CurveLength(c) > .09:
        c_out.append(c)
    else:
        pass
# ---------- end python_4 ----------

# ----
area_3 = Area(Geometry=flatten(wbnaked_4))  # -> Area, Centroid
points = PointList(Points=area_3.Centroid, Size=0.8)
flip = FlipCurve(Curve=python_3)  # -> Curve, Flag

# ---- group: Mesh Seam
# Mesh at Seams
cluster = Cluster(crv=python_4, crv_2=python_3)

# ---- group: Remove Naked Faces - hopefully firelice style
cluster_2 = Cluster_2(mesh=mesh_2)  # -> simplify(M); disabled
cluster_3 = Cluster_2(mesh=mesh_3)  # -> simplify(M); disabled

# ----
mesh_seam = Mesh(cluster)
mesh_moved = Mesh(sort_2.ValuesA)
mesh_no_move = Mesh(mesh_2)

# ---- group: Fresh Sewn Chips
mjoin = MeshJoin(Meshes=[mesh_moved, mesh_no_move, mesh_seam])  # -> flatten(Mesh)

# ---- group: All Chips
mesh_4 = Mesh([mjoin, mesh_virgin])

# ----
python_5 = PythonScript()  # -> SliderNickNames, SliderGuids
# ---------- python_5: Python ----------
import Grasshopper as gh

# Get the Grasshopper component, document and objects
ghComp = ghenv.Component
ghDoc = ghComp.OnPingDocument()
ghObjects = ghDoc.Objects

# Iterate the GH objects and get their name/guid if they are a slider
SliderNickNames = []
SliderGuids = []

for obj in ghObjects:
    if type(obj) is gh.Kernel.Special.GH_NumberSlider:
        
        # Get the slider nick name
        name = obj.NickName
        SliderNickNames.append(name)
        
        # Get instance guid
        guid = obj.InstanceGuid
        SliderGuids.append(str(guid))
        
        # Set the value of the sliders named "Foo" and "Ham"
        if name == "Foo" or name == "Ham":
            obj.Slider.Value = 0.42
            obj.ExpireSolution(True)
# ---------- end python_5 ----------
panel_4 = Panel(python_5.SliderGuids)
panel_5 = Panel(python_5.SliderNickNames)

# ---- group: DONT DELETE - Iterated in Python
mesh_to_export = Slider(42, range=0..99)

# ----
# Export to Individual 3dms
python_6 = PythonScript(meshes=mesh_4)  # -> out, a, num_meshes; inputs meshes: list of Mesh
# ---------- python_6: Python ----------
import Rhino.Geometry as rg

a = []

for m in meshes:
    print m.Faces.Count
    if m.Faces.Count > 100:
        a.append(m)
    else:
        pass

num_meshes = len(a)
# ---------- end python_6 ----------
panel_6 = Panel("""_RunPythonScript in Rhino
"Automate_Export_Individual_Meshes_01"
""")  # disabled
panel_7 = Panel(python_6.num_meshes)
mesh_5 = Mesh(python_6.a)
item_3 = ListItem(List=mesh_5, Index=mesh_to_export, Wrap=False)

# ---- group: DONT DELETE - Baked in Python
geo_to_export = Geometry(item_3)

# ==== cluster Cluster
crv = ClusterInput()
crv_2 = ClusterInput()
crv_3 = Curve(crv)
crv_4 = Curve(crv_2)

# ---- group: Align Crv Seams
xy = XYPlane(Origin=Point(0, 0, 0))
x_tremez = Extremes(Curve=crv_4, Plane=xy)  # -> Highest, Lowest
x_tremez_2 = Extremes(Curve=crv_3, Plane=xy)  # -> Highest, Lowest
crv_cp = CurveClosestPoint(Point=x_tremez.Lowest, Curve=crv_4)  # -> Point, Parameter, Distance
crv_cp_2 = CurveClosestPoint(Point=x_tremez_2.Lowest, Curve=crv_3)  # -> Point, Parameter, Distance
seam = Seam(Curve=graft(crv_4), Seam=graft(crv_cp.Parameter))
seam_2 = Seam(Curve=graft(crv_3), Seam=graft(crv_cp_2.Parameter))

# ----
flip = FlipCurve(Curve=seam)  # -> Curve, Flag
cp = ControlPoints(Curve=flip.Curve)  # -> Points, Weights, Knots
cp_2 = ControlPoints(Curve=seam_2)  # -> Points, Weights, Knots
long = LongestList(ListA=cp_2.Points, ListB=cp.Points, PaddingMode=2)  # -> simplify(ListA), simplify(ListB)

# ---- group: tree version
python_tree = PythonScript(crv1=long.ListA, crv2=long.ListB)  # -> out, a_Tree, b_Tree, c_Tree, d_Tree; inputs crv1: tree of Point3d, crv2: tree of Point3d
# ---------- python_tree: Python ----------
import Rhino.Geometry as rg
import rhinoscriptsyntax as rs
import Grasshopper as gh
import collections

def equalize(one_list, two_list):
    if len(one_list) > len(two_list):
        short = two_list
        llong = one_list
    else:
        short = one_list
        llong = two_list
    for i in range(len(short), len(llong)):
        print i
        short.append(short[-1])

print crv1.BranchCount
print crv2.BranchCount

a_Tree = gh.DataTree[object]()
b_Tree = gh.DataTree[object]()
c_Tree = gh.DataTree[object]()
d_Tree = gh.DataTree[object]()


for i in range(crv1.BranchCount):
    
    print i 
    
    c_one = crv1.Branch(i)        
    c_two = crv2.Branch(i)
    
    a = []
    b = []
    c = []
    d = []
    
    
    for n, pt in enumerate(c_one):
        
        if n == 0:
            pass
        
        if n == 0:
            a_Tree.Add(c_one[n],gh.Kernel.Data.GH_Path(i))
            b_Tree.Add(c_two[n],gh.Kernel.Data.GH_Path(i))
            c_Tree.Add(c_two[len(c_two)-1],gh.Kernel.Data.GH_Path(i))
            d_Tree.Add(c_one[len(c_one)-1],gh.Kernel.Data.GH_Path(i))
        
        if n > 0:
            #print 'N -', n
        
            a_Tree.Add(c_one[n],gh.Kernel.Data.GH_Path(i))
            b_Tree.Add(c_two[n],gh.Kernel.Data.GH_Path(i))
            c_Tree.Add(c_two[n-1],gh.Kernel.Data.GH_Path(i))
            d_Tree.Add(c_one[n-1],gh.Kernel.Data.GH_Path(i))
            
            m = [c_one[n], c_two[n], c_two[n-1], c_one[n-1]]
            
            #faces.append(rs.AddMesh(m,m))
        else:
            pass
# ---------- end python_tree ----------
merge = Merge(
    Data1=graft(python_tree.a_Tree),
    Data2=graft(python_tree.b_Tree),
    Data3=graft(python_tree.c_Tree),
    Data4=graft(python_tree.d_Tree))
conmesh = ConstructMesh(Vertices=merge, Faces={A=0, B=1, C=2, D=3})
pshift = ShiftPaths(Data=conmesh, Offset=-1)
mjoin = MeshJoin(Meshes=pshift)
wbjoin = WeaverbirdsJoinMeshesAndWeld(Mesh=pshift, Weld=False)

# ----
M = ClusterOutput(mjoin)

# ==== cluster Cluster_2
mesh = ClusterInput()

# ---- group: Remove naked faces
mesh_2 = Mesh(mesh)
python = PythonScript(mesh=mesh_2)  # -> bound, intern; inputs mesh: Mesh
# ---------- python: Python ----------
boundaryFaces = []
internalFaces = []

print mesh.Faces.Count



for i in range(mesh.Faces.Count):
    if mesh.Faces.HasNakedEdges(i):
        boundaryFaces.append(i);
    else:
        internalFaces.append(i);

bound = boundaryFaces;
intern = internalFaces;
# ---------- end python ----------
demesh = DeconstructMesh(Mesh=mesh_2)  # -> Vertices, Faces, Colours, Normals
item = ListItem(List=demesh.Faces, Index=python.intern, Wrap=True)
conmesh = ConstructMesh(Vertices=demesh.Vertices, Faces=item)

# ----
python_2 = PythonScript(mesh=conmesh)  # -> bound, intern; inputs mesh: Mesh; same code as python
demesh_2 = DeconstructMesh(Mesh=conmesh)  # -> Vertices, Faces, Colours, Normals
item_2 = ListItem(List=demesh_2.Faces, Index=python_2.intern, Wrap=True)
conmesh_2 = ConstructMesh(Vertices=demesh_2.Vertices, Faces=item_2)
M = ClusterOutput(conmesh_2)
