# Grasshopper definition Vorticity_joinmesh_7.gh (Grasshopper 0.9.76)
# plug-ins: MeshEdit Components, Python Interpreter, Weaverbird

rhinopython_filepath = Panel("C:\Users\Scott\Dropbox\NBI\Vorticity\OUTPUT\Thin_STLs")

# ---- group: BBox info
panel = Panel("6.28318530718")
# Plane Pi Numbers
panel_2 = Panel("-3.1415926535")
panel_3 = Panel("+3.1415926535")

# ----
tolerance = Panel("-0.0001")
which_file_number = Slider(5, range=0..5)
# Read thin STL files in Dir
python = PythonScript(walk_dir="C:\Users\Scott\Dropbox\NBI\Vorticity\OUTPUT\Thin_STLs", y=which_file_number)  # -> out, a, how_many, current; inputs y: Int32
# ---------- python: Python ----------
import os
from os.path import isfile, join

print('walk_dir = ' + walk_dir)
print('walk_dir (absolute) = ' + os.path.abspath(walk_dir))

stls = []

for root, subdirs, files in os.walk(walk_dir):
    for filename in files:
        file_path = os.path.join(root, filename)
        stls.append(file_path)
        #print('\t- file %s (full path: %s)' % (filename, file_path))

for s in stls:
    print s.split('\\')[-1]
    
a = stls[y]
how_many = len(stls)
current = stls[y].split('\\')[-1][:-9]
print current[:-9]
# ---------- end python ----------
panel_4 = Panel(python.current)
panel_5 = Panel(python.out)
panel_6 = Panel(python.how_many)

# ---- group: http://www.grasshopper3d.com/forum/topics/import-an-stl-file-direct-in-grasshopper
path = FilePath(python.a)
# Parse STLs to Mesh
vb = VBScript(F=path)  # -> out, Mesh
# ---------- vb: VB ----------
    Dim stl = My.Computer.FileSystem.ReadAllBytes(F)
    print("File length: " & stl.length() & " bytes")
    Dim numtris As Long = BitConverter.ToInt32(stl, 80)
    print("Number of triangles: " & numtris)
    Dim c,pos As Integer
    Dim tempmesh As New mesh
    Dim tempvect As Vector3f
    If (numtris * 50 + 84 = stl.length()) Then
      print("STL file length matches the number of triangle faces")
      For c = 0 To numtris - 1
        pos = c * 50 + 84
        tempvect = readVect3f(stl, pos)
        With tempmesh
          .Vertices.setvertex(c * 3, readPoint3f(stl, pos))
          .Vertices.setvertex(c * 3 + 1, readPoint3f(stl, pos))
          .Vertices.setvertex(c * 3 + 2, readPoint3f(stl, pos))
          .Faces.setface(c, c * 3, c * 3 + 1, c * 3 + 2)
          .Normals.SetNormal(c * 3, tempvect)
          .Normals.SetNormal(c * 3 + 1, tempvect)
          .Normals.SetNormal(c * 3 + 2, tempvect)
        End With
      Next
      tempmesh.Weld(math.PI)
    Else
      print("STL file length does not match the number of triangle faces")
    End If
    Mesh = tempmesh
# ---------- vb: VB additional code ----------
  '
  Private Function readSingle(ByRef stl As Byte(), ByRef pos As Integer) As Single
    readSingle = BitConverter.ToSingle(stl, pos)
    pos = pos + 4
  End Function

  Private Function readVect3f(ByRef stl As Byte(), ByRef pos As Integer) As Vector3f
    readVect3f = New Vector3f(readSingle(stl, pos), readSingle(stl, pos), readSingle(stl, pos))
  End Function

  Private Function readPoint3f(ByRef stl As Byte(), ByRef pos As Integer) As Point3f
    readPoint3f = New Point3f(readSingle(stl, pos), readSingle(stl, pos), readSingle(stl, pos))
  End Function
# ---------- end vb ----------
preview = CustomPreview(
    Geometry=vb.Mesh,
    Shader={ambient=RGB(0, 0, 0), diffuse=RGB(255, 105, 180), emission=RGB(76, 32, 54), shine=0.5, specular=RGB(255, 255, 255), transparency=0})
disjoint = DisjointMesh(Mesh=vb.Mesh)

# ----
python_2 = PythonScript(meshes=disjoint)  # -> out, simplify(valid), inval; inputs meshes: list of Mesh
# ---------- python_2: Python ----------
import rhinoscriptsyntax as rs
import Rhino.Geometry as rg

valid = []
inval = []

for m in meshes:
    if m.IsValid:
        print m, ('yes')
        valid.append(m)
    else:
        print m, ("NO!")
        inval.append(m)
# ---------- end python_2 ----------
explode = MeshExplode(Mesh=python_2.inval, Interpolate=False)  # -> simplify(Faces)
# Repair Invalid Meshes
pshift = ShiftPaths(Data=python_2.valid, Offset=-1)
mjoin = MeshJoin(Meshes=explode)  # -> flatten(Mesh)
mesh = Mesh([pshift, mjoin])

# ---- group: Cull tiny meshes
# Orig Meshes
python_3 = PythonScript(meshes=mesh)  # -> out, a, culled; inputs meshes: list of Mesh
# ---------- python_3: Python ----------
import Rhino.Geometry as rg

a = []
culled = []

for m in meshes:
    print m.Faces.Count
    if m.Faces.Count > 100:
        a.append(m)
    else:
        culled.append(m)
# ---------- end python_3 ----------

# ----
python_4 = PythonScript(pi=panel_3, meshes=python_3.a, toler=tolerance)  # -> out, planes, direction, cut, stitch, virgin; inputs meshes: list of Mesh
# ---------- python_4: Python ----------
import Rhino.Geometry as rg
import rhinoscriptsyntax as rs

x_pos = rg.Plane(rg.Point3d(pi + toler,0,0),rg.Vector3d(pi,0,0))
x_neg = rg.Plane(rg.Point3d(-pi - toler,0,0),rg.Vector3d(-pi,0,0))
y_pos = rg.Plane(rg.Point3d(0,pi + toler,0),rg.Vector3d(0,pi,0))
y_neg = rg.Plane(rg.Point3d(0,-pi - toler,0),rg.Vector3d(0,-pi,0))
z_pos = rg.Plane(rg.Point3d(0,0,pi + toler),rg.Vector3d(0,0,pi))
z_neg = rg.Plane(rg.Point3d(0,0,-pi - toler),rg.Vector3d(0,0,-pi))

planes = [x_neg, x_pos, y_pos, y_neg, x_pos, z_neg]
direction = None
cut = []
stitch = []
virgin = []

for m in meshes:
    # X
    if rg.Intersect.Intersection.MeshPlane(m, x_pos):
        cut.append(m)
        direction = 'X'
    elif rg.Intersect.Intersection.MeshPlane(m, x_neg):
        stitch.append(m)
    
    # Y
    elif rg.Intersect.Intersection.MeshPlane(m, y_pos):
        cut.append(m)
        direction = 'Y'
    elif rg.Intersect.Intersection.MeshPlane(m, y_neg):
        stitch.append(m)
    
    # Z
    elif rg.Intersect.Intersection.MeshPlane(m, z_pos):
        cut.append(m)
        direction = 'Z'
    elif rg.Intersect.Intersection.MeshPlane(m, z_neg):
        stitch.append(m)
    
    # Untouched
    else:
        virgin.append(m)

if len(meshes)== len(cut) + len(stitch) + len(virgin) and len(cut) == len(stitch):
    print 'PASSES - ' + direction
else:
    print 'FAILS - ' + direction 

print '-'
print 'Total -', len(meshes)
print 'Cut -', len(cut), 'Stitch -', len(stitch)
print 'Untouched -', len(virgin)
print '-'
print 'To Export -', len(virgin) + len(cut)
# ---------- end python_4 ----------
# Sort Meshes
panel_7 = Panel(python_4.out)
python_5 = PythonScript(direction=python_4.direction, two_pi=panel)  # -> v_out, sort_vec
# ---------- python_5: Python ----------
import rhinoscriptsyntax as rs
import Rhino.Geometry as rg

print direction

sort_vec = None

if direction == 'X':
    v_out = rg.Vector3d(two_pi,0,0)
    sort_vec = 'Y'
elif direction == 'Y':
    v_out = rg.Vector3d(0,two_pi,0)
    sort_vec = 'Z'
elif direction == 'Z':
    v_out = rg.Vector3d(0,0,two_pi)
    sort_vec = 'X'
# ---------- end python_5 ----------

mesh_virgin = Mesh(simplify(flatten(python_4.virgin)))
mesh_stitch = Mesh(graft(python_4.stitch))
mesh_cut = Mesh(python_4.cut)

rev = Reverse(Vector=python_5.v_out)
move = Move(Geometry=mesh_cut, Motion=rev)  # -> graft(Geometry), Transform

python_6 = PythonScript()  # -> SliderNickNames, SliderGuids
# ---------- python_6: Python ----------
import Grasshopper as gh

# Get the Grasshopper component, document and objects
ghComp = ghenv.Component
ghDoc = ghComp.OnPingDocument()
ghObjects = ghDoc.Objects

# Iterate the GH objects and get their name/guid if they are a slider
SliderNickNames = []
SliderGuids = []

for obj in ghObjects:
    if type(obj) is gh.Kernel.Special.GH_NumberSlider:
        
        # Get the slider nick name
        name = obj.NickName
        SliderNickNames.append(name)
        
        # Get instance guid
        guid = obj.InstanceGuid
        SliderGuids.append(str(guid))
        
        # Set the value of the sliders named "Foo" and "Ham"
        if name == "Foo" or name == "Ham":
            obj.Slider.Value = 0.42
            obj.ExpireSolution(True)
# ---------- end python_6 ----------
panel_8 = Panel(python_6.SliderGuids)
panel_9 = Panel(python_6.SliderNickNames)

# ---- group: DONT DELETE - Iterated in Python
mesh_to_export = Slider(54, range=0..80)

# ---- group: Sort Vertically
wbnaked = WeaverbirdsNakedBoundary(MeshClosedPolylines=mesh_stitch)  # -> flatten(NakedCurves)
# Move
wbnaked_2 = WeaverbirdsNakedBoundary(MeshClosedPolylines=mesh_cut)  # -> flatten(NakedCurves)
# Align Data
area = Area(Geometry=wbnaked_2)  # -> Area, graft(Centroid)
area_2 = Area(Geometry=wbnaked)  # -> Area, graft(Centroid)
pdecon = Deconstruct(Point=area_2.Centroid)  # -> flatten(XComponent), flatten(YComponent), flatten(ZComponent)
pdecon_2 = Deconstruct(Point=area.Centroid)  # -> flatten(XComponent), flatten(YComponent), flatten(ZComponent)

# ----
python_7 = PythonScript(X=pdecon.XComponent, Y=pdecon.YComponent, Z=pdecon.ZComponent, sort_vec=python_5.sort_vec)  # -> keys; inputs X: list, Y: list, Z: list
# ---------- python_7: Python ----------
print X, Y, Z


if sort_vec == 'X':
    keys = [t for t in X]
elif sort_vec == 'Y':
    keys = [t for t in Y]
elif sort_vec == 'Z':
    keys = [t for t in Z]
# ---------- end python_7 ----------
python_8 = PythonScript(X=pdecon_2.XComponent, Y=pdecon_2.YComponent, Z=pdecon_2.ZComponent, sort_vec=python_5.sort_vec)  # -> keys; inputs X: list, Y: list, Z: list; same code as python_7

# ---- group: Sort Vertically (continued)
sort = SortList(Keys=python_7, ValuesA=flatten(mesh_stitch))  # -> Keys, simplify(graft(ValuesA))
sort_2 = SortList(Keys=python_8, ValuesA=flatten(move.Geometry))  # -> Keys, simplify(graft(ValuesA))

# ----
mesh_2 = Mesh(sort.ValuesA)
mesh_3 = Mesh(sort_2.ValuesA)

# ---- group: Cull Tiny Edges
wbnaked_3 = WeaverbirdsNakedBoundary(MeshClosedPolylines=mesh_2)  # -> flatten(NakedCurves)
# Prep Seams
wbnaked_4 = WeaverbirdsNakedBoundary(MeshClosedPolylines=mesh_3)  # -> flatten(NakedCurves)
python_9 = PythonScript(crvs=wbnaked_3)  # -> c_out; inputs crvs: list of Curve
# ---------- python_9: Python ----------
import Rhino.Geometry as rg
import rhinoscriptsyntax as rs

c_out = []

for c in crvs:
    print rs.CurveLength(c)
    if rs.CurveLength(c) > .08:
        c_out.append(c)
    else:
        pass
# ---------- end python_9 ----------
python_10 = PythonScript(crvs=wbnaked_4)  # -> c_out; inputs crvs: list of Curve
# ---------- python_10: Python ----------
import Rhino.Geometry as rg
import rhinoscriptsyntax as rs

c_out = []

for c in crvs:
    print rs.CurveLength(c)
    if rs.CurveLength(c) > .09:
        c_out.append(c)
    else:
        pass
# ---------- end python_10 ----------

# ----
area_3 = Area(Geometry=flatten(wbnaked_4))  # -> Area, Centroid
points = PointList(Points=area_3.Centroid, Size=0.8)

flip = FlipCurve(Curve=python_9)  # -> Curve, Flag

# ---- group: Mesh Seam
# Mesh at Seams
cluster = Cluster(crv=python_10, crv_2=python_9)

# ----
mesh_no_move = Mesh(mesh_2)
mesh_moved = Mesh(sort_2.ValuesA)
mesh_seam = Mesh(cluster)

# ---- group: Fresh Sewn Chips
mjoin_2 = MeshJoin(Meshes=[mesh_moved, mesh_no_move, mesh_seam])  # -> flatten(Mesh)

# ---- group: All Chips
mesh_4 = Mesh([mjoin_2, mesh_virgin])

# ----
# Export to Individual 3dms
python_11 = PythonScript(meshes=mesh_4)  # -> out, a, num_meshes; inputs meshes: list of Mesh
# ---------- python_11: Python ----------
import Rhino.Geometry as rg

a = []

for m in meshes:
    print m.Faces.Count
    if m.Faces.Count > 100:
        a.append(m)
    else:
        pass

num_meshes = len(a)
# ---------- end python_11 ----------
panel_10 = Panel("""_RunPythonScript in Rhino
"Automate_Export_Individual_Meshes_01"
""")
panel_11 = Panel(python_11.num_meshes)
mesh_5 = Mesh(python_11.a)
item = ListItem(List=mesh_5, Index=mesh_to_export, Wrap=False)

# ---- group: DONT DELETE - Baked in Python
geo_to_export = Geometry(item)

# ==== cluster Cluster
crv = ClusterInput()
crv_2 = ClusterInput()
crv_3 = Curve(crv)
crv_4 = Curve(crv_2)

# ---- group: Align Crv Seams
xy = XYPlane(Origin=Point(0, 0, 0))
x_tremez = Extremes(Curve=crv_4, Plane=xy)  # -> Highest, Lowest
x_tremez_2 = Extremes(Curve=crv_3, Plane=xy)  # -> Highest, Lowest
crv_cp = CurveClosestPoint(Point=x_tremez.Lowest, Curve=crv_4)  # -> Point, Parameter, Distance
crv_cp_2 = CurveClosestPoint(Point=x_tremez_2.Lowest, Curve=crv_3)  # -> Point, Parameter, Distance
seam = Seam(Curve=graft(crv_4), Seam=graft(crv_cp.Parameter))
seam_2 = Seam(Curve=graft(crv_3), Seam=graft(crv_cp_2.Parameter))

# ----
flip = FlipCurve(Curve=seam)  # -> Curve, Flag
cp = ControlPoints(Curve=flip.Curve)  # -> Points, Weights, Knots
cp_2 = ControlPoints(Curve=seam_2)  # -> Points, Weights, Knots
long = LongestList(ListA=cp_2.Points, ListB=cp.Points, PaddingMode=2)  # -> simplify(ListA), simplify(ListB)

# ---- group: tree version
python_tree = PythonScript(crv1=long.ListA, crv2=long.ListB)  # -> out, a_Tree, b_Tree, c_Tree, d_Tree; inputs crv1: tree of Point3d, crv2: tree of Point3d
# ---------- python_tree: Python ----------
import Rhino.Geometry as rg
import rhinoscriptsyntax as rs
import Grasshopper as gh
import collections

def equalize(one_list, two_list):
    if len(one_list) > len(two_list):
        short = two_list
        llong = one_list
    else:
        short = one_list
        llong = two_list
    for i in range(len(short), len(llong)):
        print i
        short.append(short[-1])

print crv1.BranchCount
print crv2.BranchCount

a_Tree = gh.DataTree[object]()
b_Tree = gh.DataTree[object]()
c_Tree = gh.DataTree[object]()
d_Tree = gh.DataTree[object]()


for i in range(crv1.BranchCount):
    
    print i 
    
    c_one = crv1.Branch(i)        
    c_two = crv2.Branch(i)
    
    a = []
    b = []
    c = []
    d = []
    
    
    for n, pt in enumerate(c_one):
        
        if n == 0:
            pass
        
        if n == 0:
            a_Tree.Add(c_one[n],gh.Kernel.Data.GH_Path(i))
            b_Tree.Add(c_two[n],gh.Kernel.Data.GH_Path(i))
            c_Tree.Add(c_two[len(c_two)-1],gh.Kernel.Data.GH_Path(i))
            d_Tree.Add(c_one[len(c_one)-1],gh.Kernel.Data.GH_Path(i))
        
        if n > 0:
            #print 'N -', n
        
            a_Tree.Add(c_one[n],gh.Kernel.Data.GH_Path(i))
            b_Tree.Add(c_two[n],gh.Kernel.Data.GH_Path(i))
            c_Tree.Add(c_two[n-1],gh.Kernel.Data.GH_Path(i))
            d_Tree.Add(c_one[n-1],gh.Kernel.Data.GH_Path(i))
            
            m = [c_one[n], c_two[n], c_two[n-1], c_one[n-1]]
            
            #faces.append(rs.AddMesh(m,m))
        else:
            pass
# ---------- end python_tree ----------
merge = Merge(
    Data1=graft(python_tree.a_Tree),
    Data2=graft(python_tree.b_Tree),
    Data3=graft(python_tree.c_Tree),
    Data4=graft(python_tree.d_Tree))
conmesh = ConstructMesh(Vertices=merge, Faces={A=0, B=1, C=2, D=3})
pshift = ShiftPaths(Data=conmesh, Offset=-1)
wbjoin = WeaverbirdsJoinMeshesAndWeld(Mesh=pshift, Weld=False)
mjoin = MeshJoin(Meshes=pshift)

# ----
M = ClusterOutput(mjoin)
