# Grasshopper definition 170515_Sim1_Vorticity_joinmesh_11.gh (Grasshopper 0.9.76)
# plug-ins: MeshEdit Components, Python Interpreter, gHowl, LunchBox, Weaverbird

rhinopython_filepath = Panel("C:\Users\Scott\Dropbox\NBI\Vorticity\OUTPUT\Sim_0\FBXs")
panel = Panel("C:\Users\Scott\Dropbox\NBI\Vorticity\OUTPUT\Sim_0\Thin_STLs")
panel_2 = Panel("C:\Users\Scott\Dropbox\NBI\Vorticity\OUTPUT\Sim_1\Thin_STLs")

# ---- group: BBox info
panel_3 = Panel("6.28318530718")
# Plane Pi Numbers
panel_4 = Panel("-3.1415926535")
panel_5 = Panel("+3.1415926535")

# ----
tolerance = Panel("-0.0001")
# Get a set of INDEXES:
# 
# For every point:
#     if that INDEX has duplicates:
#         go through all others that have that index:
#             see if its the smallest one
#         save the smallest one
#         boot out the longer ones to cap
python = PythonScript()  # -> seen, ind_short, ind_long, ind_solos; inputs pts: list of Point3d, index: list of Int32, dist: list
# ---------- python: Python ----------
"""
pairs = {}
for i, p in enumerate(pts):
    pairs[p] = index[i]
print pairs
"""
multi= []

seen = set()
uniq = []
for x in index:
    if x not in seen:
        uniq.append(x)
        seen.add(x)
    else:
        multi.append(x)
print 'seen', seen

def all_same_indices(ind, list):
    same = []
    for l in list:
        if l == ind:
            same.append(l)
    return same


for s in seen:
    print '- - - - ', s
    shortdist = 10
    
    same = all_same_indices(s, pts)
    for s in same:
        print s
    """
    for iter, j in enumerate(index):
        
        if j == s:
            shortest = pts[s]
            if dist[s] < shortdist:
                shortdist = dist[s]
                
            print pts[j]
    """

ind_short = []
ind_long = []
ind_solos = []
# ---------- end python ----------
min_faces = Panel("10")

python_2 = PythonScript()  # -> SliderNickNames, SliderGuids
# ---------- python_2: Python ----------
import Grasshopper as gh

# Get the Grasshopper component, document and objects
ghComp = ghenv.Component
ghDoc = ghComp.OnPingDocument()
ghObjects = ghDoc.Objects

# Iterate the GH objects and get their name/guid if they are a slider
SliderNickNames = []
SliderGuids = []

for obj in ghObjects:
    if type(obj) is gh.Kernel.Special.GH_NumberSlider:
        
        # Get the slider nick name
        name = obj.NickName
        SliderNickNames.append(name)
        
        # Get instance guid
        guid = obj.InstanceGuid
        SliderGuids.append(str(guid))
        
        # Set the value of the sliders named "Foo" and "Ham"
        if name == "Foo" or name == "Ham":
            obj.Slider.Value = 0.42
            obj.ExpireSolution(True)
# ---------- end python_2 ----------
panel_6 = Panel(python_2.SliderGuids)
panel_7 = Panel(python_2.SliderNickNames)

# ---- group: DONT DELETE - Iterated in Python
mesh_to_export = Slider(361, range=0..600)

# ----
which_file_number = Slider(107, range=0..425)

# ----
# Read thin STL files in Dir
python_3 = PythonScript(walk_dir=panel_2, y=which_file_number)  # -> out, a, how_many, current; inputs y: Int32
# ---------- python_3: Python ----------
import os
from os.path import isfile, join

#print('walk_dir = ' + walk_dir)
#print('walk_dir (absolute) = ' + os.path.abspath(walk_dir))

def all_Files_in(direct):
    allFiles = []
    for r, s, f in os.walk(direct):
        for filenavn in f:
            file_path = os.path.join(r, filenavn)
            allFiles.append(file_path)
            #print('\t- file %s (full path: %s)' % (filename, file_path))
    return allFiles

stlfiles = all_Files_in(walk_dir)

for s in stlfiles:
    print s.split('\\')[-1]
    
a = stlfiles[y]
how_many = len(stlfiles)
current = stlfiles[y].split('\\')[-1][:-9]
print current[:-9]
# ---------- end python_3 ----------
panel_8 = Panel(python_3.current)
panel_9 = Panel(python_3.out)
panel_10 = Panel(python_3.how_many)

# ---- group: http://www.grasshopper3d.com/forum/topics/import-an-stl-file-direct-in-grasshopper
# Parse STLs to Mesh
path = FilePath(python_3.a)
vb = VBScript(F=path)  # -> out, Mesh
# ---------- vb: VB ----------
    Dim stl = My.Computer.FileSystem.ReadAllBytes(F)
    print("File length: " & stl.length() & " bytes")
    Dim numtris As Long = BitConverter.ToInt32(stl, 80)
    print("Number of triangles: " & numtris)
    Dim c,pos As Integer
    Dim tempmesh As New mesh
    Dim tempvect As Vector3f
    If (numtris * 50 + 84 = stl.length()) Then
      print("STL file length matches the number of triangle faces")
      For c = 0 To numtris - 1
        pos = c * 50 + 84
        tempvect = readVect3f(stl, pos)
        With tempmesh
          .Vertices.setvertex(c * 3, readPoint3f(stl, pos))
          .Vertices.setvertex(c * 3 + 1, readPoint3f(stl, pos))
          .Vertices.setvertex(c * 3 + 2, readPoint3f(stl, pos))
          .Faces.setface(c, c * 3, c * 3 + 1, c * 3 + 2)
          .Normals.SetNormal(c * 3, tempvect)
          .Normals.SetNormal(c * 3 + 1, tempvect)
          .Normals.SetNormal(c * 3 + 2, tempvect)
        End With
      Next
      tempmesh.Weld(math.PI)
    Else
      print("STL file length does not match the number of triangle faces")
    End If
    Mesh = tempmesh
# ---------- vb: VB additional code ----------
  '
  Private Function readSingle(ByRef stl As Byte(), ByRef pos As Integer) As Single
    readSingle = BitConverter.ToSingle(stl, pos)
    pos = pos + 4
  End Function

  Private Function readVect3f(ByRef stl As Byte(), ByRef pos As Integer) As Vector3f
    readVect3f = New Vector3f(readSingle(stl, pos), readSingle(stl, pos), readSingle(stl, pos))
  End Function

  Private Function readPoint3f(ByRef stl As Byte(), ByRef pos As Integer) As Point3f
    readPoint3f = New Point3f(readSingle(stl, pos), readSingle(stl, pos), readSingle(stl, pos))
  End Function
# ---------- end vb ----------
disjoint = DisjointMesh(Mesh=vb.Mesh)
preview = CustomPreview(
    Geometry=vb.Mesh,
    Shader={ambient=RGB(0, 0, 0), diffuse=RGB(255, 105, 180), emission=RGB(76, 32, 54), shine=0.5, specular=RGB(255, 255, 255), transparency=0})  # disabled

# ----
cull_tiny = PythonScript(meshes=disjoint, min_faces="50")  # -> out, a, culled; inputs meshes: list of Mesh, min_faces: Int32
# ---------- cull_tiny: Python ----------
import Rhino.Geometry as rg

a = []
culled = []

print "Min faces =", min_faces

for m in meshes:
    #print m.Faces.Count
    if m.Faces.Count > min_faces:
        a.append(m)
        print m.Faces.Count, ' - a'
    else:
        culled.append(m)
        print m.Faces.Count, ' - cull'
# ---------- end cull_tiny ----------

# ----
# Repair Invalid Meshes
python_4 = PythonScript(meshes=cull_tiny.a)  # -> out, simplify(valid), simplify(inval); inputs meshes: list of Mesh
# ---------- python_4: Python ----------
import rhinoscriptsyntax as rs
import Rhino.Geometry as rg

valid = []
inval = []

for m in meshes:
    if m.IsValid:
        print m, ('yes')
        valid.append(m)
    else:
        print m, ("NO!")
        inval.append(m)
# ---------- end python_4 ----------
explode = MeshExplode(Mesh=python_4.inval, Interpolate=False)  # -> simplify(Faces)
pshift = ShiftPaths(Data=python_4.valid, Offset=-1)
mjoin = MeshJoin(Meshes=explode)  # -> flatten(Mesh)
mesh = Mesh(flatten([pshift, mjoin]))

clean = CleanTree(RemoveNulls=True, RemoveInvalid=True, RemoveEmpty=False, Tree=mesh)
python_5 = PythonScript(pi=panel_5, meshes=clean, toler=tolerance, two_pi=panel_3)  # -> out, planes, direction, cut, stitch, virgin; inputs meshes: list of Mesh
# ---------- python_5: Python ----------
import Rhino.Geometry as rg
import rhinoscriptsyntax as rs

x_pos = rg.Plane(rg.Point3d(pi + toler,0,0),rg.Vector3d(pi,0,0))
x_neg = rg.Plane(rg.Point3d(-pi - toler,0,0),rg.Vector3d(-pi,0,0))
y_pos = rg.Plane(rg.Point3d(0,pi + toler,0),rg.Vector3d(0,pi,0))
y_neg = rg.Plane(rg.Point3d(0,-pi - toler,0),rg.Vector3d(0,-pi,0))
z_pos = rg.Plane(rg.Point3d(0,0,pi + toler),rg.Vector3d(0,0,pi))
z_neg = rg.Plane(rg.Point3d(0,0,-pi - toler),rg.Vector3d(0,0,-pi))

orig_planes = [x_neg, x_pos, y_pos, y_neg, x_pos, z_neg]
planes = []
direction = []
cut = []
stitch = []
virgin = []

for m in meshes:
    # X
    if rg.Intersect.Intersection.MeshPlane(m, x_pos):
        # MOVE CUTS HERE BEFORE APPEND
        m.Translate(rg.Vector3d(-two_pi,0,0))
        cut.append(m)
        planes.append(x_pos)
        direction.append('X')
    elif rg.Intersect.Intersection.MeshPlane(m, x_neg):
        stitch.append(m)
        planes.append(x_neg)
        direction.append('X')
    
    # Y
    elif rg.Intersect.Intersection.MeshPlane(m, y_pos):
        m.Translate(rg.Vector3d(0, -two_pi, 0))
        cut.append(m)
        planes.append(y_pos)
        direction.append('Y')
    elif rg.Intersect.Intersection.MeshPlane(m, y_neg):
        stitch.append(m)
        planes.append(y_neg)
        direction.append('Y')
    
    # Z
    elif rg.Intersect.Intersection.MeshPlane(m, z_pos):
        m.Translate(rg.Vector3d(0, 0, -two_pi))
        cut.append(m)
        planes.append(z_pos)
        direction.append('Z')
    elif rg.Intersect.Intersection.MeshPlane(m, z_neg):
        stitch.append(m)
        planes.append(z_neg)
        direction.append('Z')
    
    # Untouched
    else:
        virgin.append(m)

"""
if len(meshes)== len(cut) + len(stitch) + len(virgin) and len(cut) == len(stitch):
    print 'PASSES - ' + direction
else:
    print 'FAILS - ' + direction 
"""
print '-'
print 'Total -', len(meshes)
print 'Cut -', len(cut), 'Stitch -', len(stitch)
print 'Untouched -', len(virgin)
print '-'
print 'To Export -', len(virgin) + len(cut)

print direction
# ---------- end python_5 ----------
# Sort and Move Meshes
panel_11 = Panel(python_5.out)

# ----
# IF no pair:
#     CAP it
mesh_virgin = Mesh(simplify(python_5.virgin))
mesh_stitch = Mesh(simplify(python_5.stitch))
# Moved
mesh_cut = Mesh(simplify(python_5.cut))

python_6 = PythonScript(m1=mesh_cut, m2=mesh_stitch)  # -> short, long; inputs m1: list of Mesh, m2: list
# ---------- python_6: Python ----------
import Rhino.Geometry as rg
import Rhino as rh

long = []
short = []

if len(m1) > len(m2):
    long = m1#[m for m in m1]
    short = m2#[x for x in m2]
else:
    short = m1#[m for m in m1]
    long = m2#[x for x in m2]

print len(m1), len(m2)
print len(long), len(short)


#rh.Collections.Point3dList.ClosestPointInList(
# ---------- end python_6 ----------
# Order Lists
# (short/long)
python_7 = PythonScript(mesh=python_6.short)  # -> avg_pt; inputs mesh: list of Mesh
# ---------- python_7: Python ----------
import Rhino.Geometry as rg 

"""
Returns a pseudo-centroid, an average of all mesh Face centroid
"""

avg_pt = []

for m in mesh:

    face_ctrs = []
    totalFac = m.Faces.Count

    x = m.Faces.GetFaceCenter(0).X
    y = m.Faces.GetFaceCenter(0).Y
    z = m.Faces.GetFaceCenter(0).Z
    
    for i in range(0, m.Faces.Count):
        face_ctrs.append(m.Faces.GetFaceCenter(i))
        
        center = m.Faces.GetFaceCenter(i)
        
        x += center.X
        y += center.Y
        z += center.Z
        
        print x
        #print totalFac * 10
    average = rg.Point3d(x/totalFac * 1, y/totalFac * 1, z/totalFac * 1)

    avg_pt.append(average)

    #averaged = [sum(y) / len(y) for y in zip(*x)]
print "# faces ", m.Faces.Count
# ---------- end python_7 ----------
python_8 = PythonScript(mesh=python_6.long)  # -> avg_pt; inputs mesh: list of Mesh
# ---------- python_8: Python ----------
import Rhino.Geometry as rg 

"""
Returns a pseudo-centroid, an average of all mesh Face centroid
"""

avg_pt = []

for m in mesh:

    face_ctrs = []
    totalFac = m.Faces.Count

    x = m.Faces.GetFaceCenter(0).X
    y = m.Faces.GetFaceCenter(0).Y
    z = m.Faces.GetFaceCenter(0).Z
    
    for i in range(0, m.Faces.Count):
        face_ctrs.append(m.Faces.GetFaceCenter(i))
        
        center = m.Faces.GetFaceCenter(i)
        
        x += center.X
        y += center.Y
        z += center.Z
        
        #print x
        #print totalFac * 10
    average = rg.Point3d(x/totalFac * 1, y/totalFac * 1, z/totalFac * 1)

    avg_pt.append(average)

    #averaged = [sum(y) / len(y) for y in zip(*x)]
print "# faces ", m.Faces.Count
# ---------- end python_8 ----------

# ---- group: First CP
# IF it has a pair:
#     WELD them
cp = ClosestPoint(Point=python_7, Cloud=python_8)  # -> ClosestPoint, CPIndex, Distance
item = ListItem(List=python_8, Index=cp.CPIndex, Wrap=True)

# ----
python_9 = PythonScript(long=python_8, matched=item)  # -> solos, solo_i; inputs long: list of Point3d, matched: list of Point3d
# ---------- python_9: Python ----------
solos = []
solo_i = []

for iter, l in enumerate(long):
    if l in matched:
        pass
    else:
        solos.append(l)
        solo_i.append(iter)
# ---------- end python_9 ----------
item_2 = ListItem(List=python_6.long, Index=python_9.solo_i, Wrap=True)

# ---- group: Reverse CP
cp_2 = ClosestPoint(Point=item, Cloud=python_7)  # -> ClosestPoint, CPIndex, Distance
item_3 = ListItem(List=cp.ClosestPoint, Index=cp_2.CPIndex, Wrap=True)

# ---- group: SHORT PAIR
item_4 = ListItem(List=python_6.short, Index=item_3, Wrap=True)

# ---- group: LONG PAIR
item_5 = ListItem(List=python_6.long, Index=cp.CPIndex, Wrap=True)

# ----
python_10 = PythonScript(long=cp_2.ClosestPoint, matched=item_3)  # -> solos, solo_i; inputs long: list of Point3d, matched: list of Point3d; same code as python_9

# ---- group: Pair Visualization
polygon = Polygon(Plane=[item_3, cp_2.ClosestPoint], Radius=0.15, Segments=3, FilletRadius=0)  # -> Polygon, Length
ln = Line(StartPoint=cp_2.ClosestPoint, EndPoint=item_3)

# ---- group: Visualize Solo Pts
python_11 = PythonScript(mesh=item_2)  # -> avg_pt; inputs mesh: list of Mesh; same code as python_8
box = CenterBox(Base=python_11, X="0.1", Y="0.1", Z="0.1")

# ----
mesh_2 = Mesh(graft(mesh_cut))  # disabled
mesh_3 = Mesh(simplify(graft(item_2)))  # disabled
mesh_4 = Mesh(simplify(mesh_2))

# ---- group: Viz Analysis
python_12 = PythonScript(mesh=mesh_2)  # -> avg_pt; inputs mesh: list of Mesh; same code as python_7
python_13 = PythonScript(mesh=mesh_3)  # -> avg_pt; inputs mesh: list of Mesh; same code as python_7
points = PointList(Points=flatten(python_13), Size=0.6)
ln_2 = Line(StartPoint=python_12, EndPoint=python_13)
points_2 = PointList(Points=flatten(python_12), Size=0.6)

# ----
wbjoin = WeaverbirdsJoinMeshesAndWeld(Mesh=[mesh_4, mesh_3], Weld=True)

# ---- group: Average Edge Length
cluster = Cluster(M=wbjoin)  # disabled
avg_edge_length = Panel(cluster)

# ----
weldvertices = MeshWeldVertices(Mesh=wbjoin, Tolerance="0.05")  # -> RuntimeMessage, flatten(Mesh)

# ----
# WELD Seams
print_v_f = PythonScript(mesh=flatten(wbjoin))  # -> out; inputs mesh: list of Mesh
# ---------- print_v_f: Python ----------
import Rhino.Geometry as rg

#rg.Mesh.
vfs = []

for m in mesh:
    vfs.append([m.Vertices.Count, m.Faces.Count])

vfs.sort()
for v in vfs:
    print 'V:%d F:%d' % (v[0], v[1])
# ---------- end print_v_f ----------
panel_12 = Panel(print_v_f)
python_14 = PythonScript(meshes=weldvertices.Mesh, min_faces=min_faces)  # -> out, a, culled; inputs meshes: list of Mesh, min_faces: Int32
# ---------- python_14: Python ----------
import Rhino.Geometry as rg

a = []
culled = []

#min_faces = 10

print "Min faces =", min_faces

for m in meshes:
    print m.Faces.Count
    if m.Faces.Count > min_faces:
        a.append(m)
    else:
        culled.append(m)
# ---------- end python_14 ----------

# ---- group: Cull tiny, unused meshes
python_15 = PythonScript(meshes=mesh_virgin, min_faces=min_faces)  # -> out, flatten(a), culled; inputs meshes: list of Mesh, min_faces: Int32
# ---------- python_15: Python ----------
import Rhino.Geometry as rg

a = []
culled = []

print "Min faces =", min_faces

for m in meshes:
    print m.Faces.Count
    if m.Faces.Count > min_faces:
        a.append(m)
    else:
        culled.append(m)
# ---------- end python_15 ----------

# ----
python_16 = PythonScript(m=python_14.a)  # -> open, closed; inputs m: list of Mesh
# ---------- python_16: Python ----------
import Rhino.Geometry as rg
import Rhino as rh

open = []
closed = []

for mesh in m:
    naked = mesh.GetNakedEdges

    if mesh.IsClosed:
        print 'yes - Closed', naked
        closed.append(mesh)
    else:
        print 'no - Open'#, naked
        open.append(mesh)
# ---------- end python_16 ----------
mesh_5 = Mesh(flatten(python_16.closed))

# ----
# Euler‐Poincaré formula
# V + F - E = 2
euler_poincaré = EulerPoincaré(M_2=mesh_5, M=mesh_5)
panel_13 = Panel(euler_poincaré)

mesh_6 = Mesh(python_16.open)

# ---- group: Add Delaunay
wbnaked = WeaverbirdsNakedBoundary(MeshClosedPolylines=mesh_6)
explode_2 = Explode(Curve=wbnaked, Recursive=True)  # -> Segments, Vertices
cp_3 = ControlPoints(Curve=explode_2.Segments)  # -> Points, Weights, Knots
viewer = ParamViewer(explode_2.Segments)
pshift_2 = ShiftPaths(Data=cp_3.Points, Offset=-1)  # -> simplify(Data)
cull_3 = PythonScript(tree=pshift_2)  # -> dataTree; inputs tree: tree
# ---------- cull_3: Python ----------
import Grasshopper as gh

# Create a GH data tree (note the parentheses and type declaration)
dataTree = gh.DataTree[object]()


for i in range(tree.BranchCount):
    branchList = tree.Branch(i)
    if len(branchList) > 2:
        for b in branchList:
            dataTree.Add(b,gh.Kernel.Data.GH_Path(i))

"""
firstItems = []
for i in range(tree.BranchCount):
    branchList = tree.Branch(i)
    firstItems.append(branchList[0])



# Add the data from the nested list to the datatree
for i, v in enumerate(list):
    for d in v:
        dataTree.Add(d,gh.Kernel.Data.GH_Path(i))

# Add other stuff to the data tree using custom paths
for i in range(10):
    dataTree.Add(i,gh.Kernel.Data.GH_Path(69))
    dataTree.Add(i*5,gh.Kernel.Data.GH_Path(666))

# Return the tree to GH
ghTree = dataTree
"""
# ---------- end cull_3 ----------
del = DelaunayMesh(Points=cull_3, Plane=PlaneXY(0, 0, 0))  # -> flatten(Mesh)

# ---- group: Fresh Sewn Chips
mesh_7 = Mesh([del, mesh_5])

# ---- group: All Chips
mesh_8 = Mesh([python_15.a, mesh_7])

# ----
# Export to Individual 3dms
python_17 = PythonScript(meshes=mesh_8)  # -> out, a, num_meshes; inputs meshes: list of Mesh
# ---------- python_17: Python ----------
import Rhino.Geometry as rg

a = []

for m in meshes:
    print m.Faces.Count
    if m.Faces.Count > 10:
        a.append(m)
    else:
        pass

num_meshes = len(a)
# ---------- end python_17 ----------
panel_14 = Panel("""_RunPythonScript in Rhino
"Automate_Export_Individual_Meshes_01"
""")
panel_15 = Panel(python_17.num_meshes)
mesh_9 = Mesh(python_17.a)
meshes = PythonScript(num_meshes=python_17.num_meshes)  # -> out; inputs num_meshes: Int32
# ---------- meshes: Python ----------
import scriptcontext as sc


sc.sticky["Meshes_To_Export"] = num_meshes

print num_meshes, ' variable copied to sticky variable to Rhino Python editor'
# ---------- end meshes ----------
item_6 = ListItem(List=mesh_9, Index=mesh_to_export, Wrap=False)

# ---- group: DONT DELETE - Baked in Python
geo_to_export = Geometry(item_6)

# ----
# Write Mesh Data to CSV
panel_16 = Panel("C:\Users\Scott\Desktop\test\dataout.csv")
# Data to WRITE:
# Mesh Name
# Vol Centroid
# Volume
# Euler-Poincare formula
volume = MeshVolume(Mesh=python_17.a)  # -> Volume, Centroid
spreadsheet_writer = SpreadsheetWriter(Path=panel_16, SheetData1=volume.Volume)
index = ItemIndex(List=python_17.a, Item=python_17.a)
excelwrite = ExcelWrite(
    WriteExcelData=Button(),
    WorkbookPath=panel_16,
    WorksheetName="Sheet1",
    ColumnHeadings="Valence",
    Data=index,
    ClearSheet=False)

# ==== cluster EulerPoincaré
M = ClusterInput()
M_2 = ClusterInput()
demesh = DeconstructMesh(Mesh=M)  # -> Vertices, Faces, Colours, Normals
medges = MeshEdges(Mesh=M_2)  # -> NakedEdges, InteriorEdges, NonManifoldEdges
lng = ListLength(List=medges.NakedEdges)
lng_2 = ListLength(List=medges.InteriorEdges)
lng_3 = ListLength(List=medges.NonManifoldEdges)
lng_4 = ListLength(List=demesh.Vertices)
lng_5 = ListLength(List=demesh.Faces)
addition = Addition(A=lng, B=lng_2, C=lng_3)
eval = Evaluate(F="v+f-e", v=lng_4, f=lng_5, e=addition)  # -> flatten(r)
sort = SortList(Keys=eval, ValuesA=eval)  # -> Keys, ValuesA
K = ClusterOutput(sort.Keys)

# ==== cluster Cluster
M = ClusterInput()
medges = MeshEdges(Mesh=M)  # -> NakedEdges, InteriorEdges, NonManifoldEdges
len = Length(Curve=medges.NakedEdges)  # -> flatten(Length)
avr = Average(Input=len)
am = ClusterOutput(avr)
