# Grasshopper definition Export_stls_pre_reduction.gh (Grasshopper 0.9.76)
# plug-ins: Python Interpreter

# Export Meshs Only
mesh = Mesh([<mesh referenced from the Rhino model> x136])

demesh = DeconstructMesh(Mesh=flatten(mesh))  # -> Vertices, Faces, Colours, Normals
lng = ListLength(List=demesh.Faces)  # -> flatten(Length)
ma = MassAddition(Input=lng)  # -> Result, PartialResults
face_count = Panel(ma.Result)

# ---- group: Cull tiny meshes
python = PythonScript(meshes=mesh)  # -> out, a; inputs meshes: list of Mesh
# ---------- python: Python ----------
import Rhino.Geometry as rg

a = []

for m in meshes:
    print m.Faces.Count
    if m.Faces.Count > 100:
        a.append(m)
    else:
        pass
# ---------- end python ----------

# ---- group: All Chips
mesh_2 = Mesh(python.a)

# ----
python_2 = PythonScript()  # -> SliderNickNames, SliderGuids
# ---------- python_2: Python ----------
import Grasshopper as gh

# Get the Grasshopper component, document and objects
ghComp = ghenv.Component
ghDoc = ghComp.OnPingDocument()
ghObjects = ghDoc.Objects

# Iterate the GH objects and get their name/guid if they are a slider
SliderNickNames = []
SliderGuids = []

for obj in ghObjects:
    if type(obj) is gh.Kernel.Special.GH_NumberSlider:
        
        # Get the slider nick name
        name = obj.NickName
        SliderNickNames.append(name)
        
        # Get instance guid
        guid = obj.InstanceGuid
        SliderGuids.append(str(guid))
        
        # Set the value of the sliders named "Foo" and "Ham"
        if name == "Foo" or name == "Ham":
            obj.Slider.Value = 0.42
            obj.ExpireSolution(True)
# ---------- end python_2 ----------
panel = Panel(python_2.SliderGuids)
panel_2 = Panel(python_2.SliderNickNames)

# ---- group: DONT DELETE - Iterated in Python
mesh_to_export = Slider(42, range=0..99)

# ----
# Export to Individual 3dms
python_3 = PythonScript(meshes=mesh_2)  # -> out, a, num_meshes; inputs meshes: list of Mesh
# ---------- python_3: Python ----------
import Rhino.Geometry as rg

a = []

for m in meshes:
    print m.Faces.Count
    if m.Faces.Count > 100:
        a.append(m)
    else:
        pass

num_meshes = len(a)
# ---------- end python_3 ----------
panel_3 = Panel("""_RunPythonScript in Rhino
"Automate_Export_Individual_Meshes_01"
""")  # disabled
panel_4 = Panel(python_3.num_meshes)
mesh_3 = Mesh(python_3.a)
item = ListItem(List=mesh_3, Index=mesh_to_export, Wrap=False)

# ---- group: DONT DELETE - Baked in Python
geo_to_export = Geometry(item)
