# Grasshopper definition Read_STLs_from_dir_2.gh (Grasshopper 0.9.76)
# plug-ins: Python Interpreter

# Read files in Dir
panel = Panel("C:\Users\Scott\Desktop\OUTPUT\0_30_0_thin.stl")
python = PythonScript(walk_dir=panel, y=Slider(0, range=0..6))  # -> out, a; inputs y: Int32
# ---------- python: Python ----------
import os, sys
from os import listdir
from os.path import isfile, join

walk_dir = 'C:\Users\Scott\Desktop\OUTPUT'

print('walk_dir = ' + walk_dir)
print('walk_dir (absolute) = ' + os.path.abspath(walk_dir))

stls = []

for root, subdirs, files in os.walk(walk_dir):
    for filename in files:
        file_path = os.path.join(root, filename)
        stls.append(file_path)
        #print('\t- file %s (full path: %s)' % (filename, file_path))

for s in stls:
    print s
    
a = stls[y]
# ---------- end python ----------
panel_2 = Panel(python.out)
path = FilePath(python.a)

# ---- group: http://www.grasshopper3d.com/forum/topics/import-an-stl-file-direct-in-grasshopper
# Parse to Clean Mesh
path_2 = FilePath(panel)
vb = VBScript(F=path)  # -> out, Mesh
# ---------- vb: VB ----------
    Dim stl = My.Computer.FileSystem.ReadAllBytes(F)
    print("File length: " & stl.length() & " bytes")
    Dim numtris As Long = BitConverter.ToInt32(stl, 80)
    print("Number of triangles: " & numtris)
    Dim c,pos As Integer
    Dim tempmesh As New mesh
    Dim tempvect As Vector3f
    If (numtris * 50 + 84 = stl.length()) Then
      print("STL file length matches the number of triangle faces")
      For c = 0 To numtris - 1
        pos = c * 50 + 84
        tempvect = readVect3f(stl, pos)
        With tempmesh
          .Vertices.setvertex(c * 3, readPoint3f(stl, pos))
          .Vertices.setvertex(c * 3 + 1, readPoint3f(stl, pos))
          .Vertices.setvertex(c * 3 + 2, readPoint3f(stl, pos))
          .Faces.setface(c, c * 3, c * 3 + 1, c * 3 + 2)
          .Normals.SetNormal(c * 3, tempvect)
          .Normals.SetNormal(c * 3 + 1, tempvect)
          .Normals.SetNormal(c * 3 + 2, tempvect)
        End With
      Next
      tempmesh.Weld(math.PI)
    Else
      print("STL file length does not match the number of triangle faces")
    End If
    Mesh = tempmesh
# ---------- vb: VB additional code ----------
  '
  Private Function readSingle(ByRef stl As Byte(), ByRef pos As Integer) As Single
    readSingle = BitConverter.ToSingle(stl, pos)
    pos = pos + 4
  End Function

  Private Function readVect3f(ByRef stl As Byte(), ByRef pos As Integer) As Vector3f
    readVect3f = New Vector3f(readSingle(stl, pos), readSingle(stl, pos), readSingle(stl, pos))
  End Function

  Private Function readPoint3f(ByRef stl As Byte(), ByRef pos As Integer) As Point3f
    readPoint3f = New Point3f(readSingle(stl, pos), readSingle(stl, pos), readSingle(stl, pos))
  End Function
# ---------- end vb ----------
preview = CustomPreview(
    Geometry=vb.Mesh,
    Shader={ambient=RGB(0, 0, 0), diffuse=RGB(255, 105, 180), emission=RGB(76, 32, 54), shine=0.5, specular=RGB(255, 255, 255), transparency=0})

# ----
disjoint = DisjointMesh(Mesh=vb.Mesh)
