# Grasshopper definition Vorticity_joinmesh.gh (Grasshopper 0.9.76)
# plug-ins: Python Interpreter, Weaverbird

mesh = Mesh([<mesh referenced from the Rhino model> x288])
list = ValueList({"X": 0, "Y": 1, "Z": 2}, selected="X")
python = PythonScript(meshes=mesh)  # -> out, a; inputs meshes: list of Mesh
# ---------- python: Python ----------
import Rhino.Geometry as rg

a = []

for m in meshes:
    print m.Faces.Count
    if m.Faces.Count > 100:
        a.append(m)
    else:
        pass
# ---------- end python ----------

# ---- group: BBox info
bbox = BoundingBox(Content=python.a, Plane=PlaneXY(0, 0, 0), UnionBox=True)  # -> Box, Box_2
debox = DeconstructBox(Box=bbox.Box)  # -> Plane, X, Y, Z
debrep = DeconstructBrep(Brep=bbox.Box)  # -> Faces, Edges, Vertices
X = Number(debox.X)
Y = Number(debox.Y)
Z = Number(debox.Z)

# ---- group: Cut Plane
item = ListItem(List=debrep.Faces, Index="1", Wrap=True)
X_2 = UnitX(Factor="-0.01")
move = Move(Geometry=item, Motion=X_2)  # -> Geometry, Transform
pln = Plane(move.Geometry)

# ----
rev = Reverse(Vector=X_2)
X_3 = UnitX(Factor=X)
rev_2 = Reverse(Vector=X_3)
mesh_2 = MeshBrep(Settings={GridMaxCount=0, GridMinCount=16, JaggedSeams=False, MaxEdgeLength=0, MinEdgeLength=0.0001, MinTolerance=0, Refine=True, RefineAngle=0, RelativeTolerance=0.65, SimplePlanes=True, Tolerance=0})

# ---- group: Stitch Plane
item_2 = ListItem(List=debrep.Faces, Index="3", Wrap=True)

# ----
move_2 = Move(Geometry=item_2, Motion=rev)  # -> Geometry, Transform

# ---- group: Stitch Plane (continued)
pln_2 = Plane(move_2.Geometry)

# ----
python_2 = PythonScript(meshes=python.a, c_pln=pln, s_pln=pln_2)  # -> out, cut, stitch, virgin; inputs meshes: list of Mesh, c_pln: Plane, s_pln: Plane
# ---------- python_2: Python ----------
import Rhino.Geometry as rg
import rhinoscriptsyntax as rs

cut = []
stitch = []
virgin = []

for m in meshes:
    if rg.Intersect.Intersection.MeshPlane(m, c_pln):
        cut.append(m)
    elif rg.Intersect.Intersection.MeshPlane(m, s_pln):
        stitch.append(m)
    else:
        virgin.append(m)

print len(meshes)
print len(cut)
print len(stitch)
print len(virgin)
# ---------- end python_2 ----------
panel = Panel(python_2.out)
mesh_virgin = Mesh(simplify(python_2.virgin))
mesh_stitch = Mesh(graft(python_2.stitch))
mesh_cut = Mesh(python_2.cut)
move_3 = Move(Geometry=mesh_cut, Motion=rev_2)  # -> graft(Geometry), Transform

# ---- group: Sort Vertically
bbox_2 = BoundingBox(Content=move_3.Geometry, Plane=PlaneXY(0, 0, 0))  # -> Box, Box_2
bbox_3 = BoundingBox(Content=mesh_stitch, Plane=PlaneXY(0, 0, 0))  # -> Box, Box_2
box = EvaluateBox(Box=bbox_2.Box, UParameter=0.5, VParameter=0.5, WParameter=0.5)  # -> Plane, Point, Include
box_2 = EvaluateBox(Box=bbox_3.Box, UParameter=0.5, VParameter=0.5, WParameter=0.5)  # -> Plane, Point, Include
pdecon = Deconstruct(Point=box_2.Point)  # -> XComponent, YComponent, flatten(ZComponent)
pdecon_2 = Deconstruct(Point=box.Point)  # -> XComponent, YComponent, flatten(ZComponent)
sort = SortList(Keys=pdecon.ZComponent, ValuesA=flatten(mesh_stitch))  # -> Keys, graft(ValuesA)
sort_2 = SortList(Keys=pdecon_2.ZComponent, ValuesA=flatten(move_3.Geometry))  # -> Keys, graft(ValuesA)

# ----
wbnaked = WeaverbirdsNakedBoundary(MeshClosedPolylines=sort.ValuesA)
# Take these naked edges and Mesh Loft them, then Join 2 halfs and strip...
wbnaked_2 = WeaverbirdsNakedBoundary(MeshClosedPolylines=sort_2.ValuesA)
flip = FlipCurve(Curve=wbnaked)  # -> Curve, Flag
cluster = Cluster(input_curve_a=wbnaked_2, input_curve_b=wbnaked)  # -> single_mesh_2, u_mesh_strips_2, v_mesh_strips_2, individual_mesh_faces_2; disabled
mjoin = MeshJoin(Meshes=[sort_2.ValuesA, mesh_2])  # -> flatten(Mesh)
mesh_3 = Mesh([mjoin, mesh_virgin])

# ==== cluster Cluster
input_curve_a = ClusterInput()
input_curve_b = ClusterInput()
u_divisions = ClusterInput()
v_divisions = ClusterInput()

input_curve_a_2 = Curve(input_curve_a)
input_curve_b_2 = Curve(input_curve_b)
u_divisions_2 = Number(u_divisions)
v_divisions_2 = Number(v_divisions)
toggle = BooleanToggle(True)
divide = DivideCurve(Curve=reparameterize(input_curve_b_2), Count=u_divisions_2, Kinks=toggle)  # -> Points, Tangents, Parameters
divide_2 = DivideCurve(Curve=reparameterize(input_curve_a_2), Count=u_divisions_2, Kinks=toggle)  # -> Points, Tangents, Parameters
ln = Line(StartPoint=divide_2.Points, EndPoint=divide.Points)
divide_3 = DivideCurve(Curve=flatten(ln), Count=v_divisions_2, Kinks=toggle)  # -> simplify(Points), Tangents, Parameters
toggle_2 = BooleanToggle(False)
cls = Closed(Curve=input_curve_a_2)  # -> Closed, Periodic
relitem = RelativeItem(Tree=divide_3.Points, Offset="{0}(0)", WrapPaths=cls.Closed, WrapItems=toggle_2)  # -> ItemA, graft(ItemB)
relitem_2 = RelativeItem(Tree=divide_3.Points, Offset="{1}(0)", WrapPaths=cls.Closed, WrapItems=toggle_2)  # -> ItemA, graft(ItemB)
relitem_3 = RelativeItem(Tree=divide_3.Points, Offset="{0}(1)", WrapPaths=cls.Closed, WrapItems=toggle_2)  # -> ItemA, graft(ItemB)
relitem_4 = RelativeItem(Tree=divide_3.Points, Offset="{1}(1)", WrapPaths=cls.Closed, WrapItems=toggle_2)  # -> ItemA, graft(ItemB)
merge = Merge(Data1=relitem.ItemB, Data2=relitem_2.ItemB, Data3=relitem_4.ItemB, Data4=relitem_3.ItemB)
prune = PruneTree(Tree=merge, Minimum=4, Maximum=0)
conmesh = ConstructMesh(Vertices=prune, Faces={A=0, B=1, C=2, D=3})
pshift = ShiftPaths(Data=conmesh, Offset=-1)
pshift_2 = ShiftPaths(Data=conmesh, Offset=-1)
mjoin = MeshJoin(Meshes=flatten(conmesh))
mjoin_2 = MeshJoin(Meshes=pshift_2)
flip = FlipMatrix(Data=pshift)
mjoin_3 = MeshJoin(Meshes=flip)
individual_mesh_faces = Mesh(conmesh)
u_mesh_strips = Mesh(mjoin_3)
v_mesh_strips = Mesh(mjoin_2)
single_mesh = Mesh(mjoin)

single_mesh_2 = ClusterOutput(single_mesh)
u_mesh_strips_2 = ClusterOutput(u_mesh_strips)
v_mesh_strips_2 = ClusterOutput(v_mesh_strips)
individual_mesh_faces_2 = ClusterOutput(individual_mesh_faces)
