# Grasshopper definition Vorticity_joinmesh_2.gh (Grasshopper 0.9.76)
# plug-ins: Python Interpreter, Weaverbird

mesh = Mesh([<mesh referenced from the Rhino model> x288])
list = ValueList({"X": 0, "Y": 1, "Z": 2}, selected="X")
python = PythonScript(meshes=mesh)  # -> out, a; inputs meshes: list of Mesh
# ---------- python: Python ----------
import Rhino.Geometry as rg

a = []

for m in meshes:
    print m.Faces.Count
    if m.Faces.Count > 100:
        a.append(m)
    else:
        pass
# ---------- end python ----------

# ---- group: BBox info
bbox = BoundingBox(Content=python.a, Plane=PlaneXY(0, 0, 0), UnionBox=True)  # -> Box, Box_2
debox = DeconstructBox(Box=bbox.Box)  # -> Plane, X, Y, Z
debrep = DeconstructBrep(Brep=bbox.Box)  # -> Faces, Edges, Vertices
X = Number(debox.X)
Y = Number(debox.Y)
Z = Number(debox.Z)

# ---- group: Cut Plane
X_2 = UnitX(Factor="-0.01")
item = ListItem(List=debrep.Faces, Index="1", Wrap=True)
move = Move(Geometry=item, Motion=X_2)  # -> Geometry, Transform
pln = Plane(move.Geometry)

# ----
rev = Reverse(Vector=X_2)
X_3 = UnitX(Factor=X)
rev_2 = Reverse(Vector=X_3)
crv = Curve([<curve referenced from the Rhino model> x8])
crv_2 = Curve([<curve referenced from the Rhino model> x8])

# ---- group: Stitch Plane
item_2 = ListItem(List=debrep.Faces, Index="3", Wrap=True)

# ----
move_2 = Move(Geometry=item_2, Motion=rev)  # -> Geometry, Transform

# ---- group: Stitch Plane (continued)
pln_2 = Plane(move_2.Geometry)

# ----
python_2 = PythonScript(meshes=python.a, c_pln=pln, s_pln=pln_2)  # -> out, cut, stitch, virgin; inputs meshes: list of Mesh, c_pln: Plane, s_pln: Plane
# ---------- python_2: Python ----------
import Rhino.Geometry as rg
import rhinoscriptsyntax as rs

cut = []
stitch = []
virgin = []

for m in meshes:
    if rg.Intersect.Intersection.MeshPlane(m, c_pln):
        cut.append(m)
    elif rg.Intersect.Intersection.MeshPlane(m, s_pln):
        stitch.append(m)
    else:
        virgin.append(m)

print len(meshes)
print len(cut)
print len(stitch)
print len(virgin)
# ---------- end python_2 ----------
panel = Panel(python_2.out)
mesh_virgin = Mesh(simplify(python_2.virgin))
mesh_stitch = Mesh(graft(python_2.stitch))
mesh_cut = Mesh(python_2.cut)
move_3 = Move(Geometry=mesh_cut, Motion=rev_2)  # -> graft(Geometry), Transform

# ---- group: Sort Vertically
bbox_2 = BoundingBox(Content=move_3.Geometry, Plane=PlaneXY(0, 0, 0))  # -> Box, Box_2
bbox_3 = BoundingBox(Content=mesh_stitch, Plane=PlaneXY(0, 0, 0))  # -> Box, Box_2
box = EvaluateBox(Box=bbox_2.Box, UParameter=0.5, VParameter=0.5, WParameter=0.5)  # -> Plane, Point, Include
box_2 = EvaluateBox(Box=bbox_3.Box, UParameter=0.5, VParameter=0.5, WParameter=0.5)  # -> Plane, Point, Include
pdecon = Deconstruct(Point=box_2.Point)  # -> XComponent, YComponent, flatten(ZComponent)
pdecon_2 = Deconstruct(Point=box.Point)  # -> XComponent, YComponent, flatten(ZComponent)
sort = SortList(Keys=pdecon.ZComponent, ValuesA=flatten(mesh_stitch))  # -> Keys, graft(ValuesA)
sort_2 = SortList(Keys=pdecon_2.ZComponent, ValuesA=flatten(move_3.Geometry))  # -> Keys, graft(ValuesA)

# ----
wbnaked = WeaverbirdsNakedBoundary(MeshClosedPolylines=sort_2.ValuesA)  # -> flatten(NakedCurves)
wbnaked_2 = WeaverbirdsNakedBoundary(MeshClosedPolylines=sort.ValuesA)  # -> flatten(NakedCurves)
python_3 = PythonScript(crvs=wbnaked)  # -> c_out; inputs crvs: list of Curve
# ---------- python_3: Python ----------
import Rhino.Geometry as rg
import rhinoscriptsyntax as rs

c_out = []

for c in crvs:
    print rs.CurveLength(c)
    if rs.CurveLength(c) > .08:
        c_out.append(c)
    else:
        pass
# ---------- end python_3 ----------
python_4 = PythonScript(crvs=wbnaked_2)  # -> c_out; inputs crvs: list of Curve; same code as python_3
flip = FlipCurve(Curve=python_4)  # -> Curve, Flag

# ---- group: Mesh Loft trial
# Issues:
# - Same Dir
# - variable # of CPs
cluster = Cluster(crv_2=python_3, crv=flip.Curve)

# ----
mesh_2 = Mesh(cluster)
mjoin = MeshJoin(Meshes=[sort_2.ValuesA, mesh_2, sort.ValuesA])  # -> flatten(Mesh)
mesh_3 = Mesh([mjoin, mesh_virgin])

# ==== cluster Cluster
crv = ClusterInput()
crv_2 = ClusterInput()
crv_3 = Curve(crv)
crv_4 = Curve(crv_2)

# ---- group: Align Crv Seams
xy = XYPlane(Origin=Point(0, 0, 0))
x_tremez = Extremes(Curve=crv_3, Plane=xy)  # -> Highest, Lowest
x_tremez_2 = Extremes(Curve=crv_4, Plane=xy)  # -> Highest, Lowest
crv_cp = CurveClosestPoint(Point=x_tremez.Lowest, Curve=crv_3)  # -> Point, Parameter, Distance
crv_cp_2 = CurveClosestPoint(Point=x_tremez_2.Lowest, Curve=crv_4)  # -> Point, Parameter, Distance
seam = Seam(Curve=graft(crv_3), Seam=graft(crv_cp.Parameter))
seam_2 = Seam(Curve=graft(crv_4), Seam=graft(crv_cp_2.Parameter))

# ----
cp = ControlPoints(Curve=seam)  # -> Points, Weights, Knots
cp_2 = ControlPoints(Curve=seam_2)  # -> Points, Weights, Knots
long = LongestList(ListA=cp_2.Points, ListB=cp.Points, PaddingMode=2)  # -> simplify(ListA), simplify(ListB)

# ---- group: Even Faces
index = ItemIndex(List=long.ListA, Item=long.ListA)
index_2 = ItemIndex(List=long.ListB, Item=long.ListB)
item = ListItem(List=long.ListB, Index=index_2, Wrap=True)  # -> graft(Item), graft(Item1), graft(Item2)
item_2 = ListItem(List=long.ListA, Index=index, Wrap=True)  # -> graft(Item), graft(Item1), graft(Item2)
merge = Merge(Data1=item_2.Item, Data2=item.Item, Data3=item.Item1, Data4=item_2.Item1)
conmesh = ConstructMesh(Vertices=merge, Faces={A=0, B=1, C=2, D=3})

# ---- group: Last Face
item_3 = ListItem(List=long.ListA, Index=0, Wrap=True)  # -> graft(Item1), graft(Item)
item_4 = ListItem(List=long.ListB, Index=0, Wrap=True)  # -> graft(Item1), graft(Item)
merge_2 = Merge(Data1=item_3.Item1, Data2=item_3.Item, Data3=item_4.Item, Data4=item_4.Item)
conmesh_2 = ConstructMesh(Vertices=merge_2, Faces={A=0, B=1, C=2, D=3})  # -> simplify(Mesh)

# ----
panel = Panel("Enumeration Issue")

# ---- group: Replace above w scripting
python = PythonScript(crv1=cp_2.Points, crv2=cp.Points)  # -> out, a, b, c, d; inputs crv1: list of Point3d, crv2: list of Point3d
# ---------- python: Python ----------
import Rhino.Geometry as rg
import rhinoscriptsyntax as rs

print '1-', len(crv1)
print '2-', len(crv2)

a = []
b = []
c = []
d = []

if len(crv2) > len(crv1):
    big_crv = crv2
    sml_crv = crv1
else:
    big_crv = crv1
    sml_crv = crv2

for n, pt in enumerate(big_crv):

#    if n > len(sml_crv):
#        
    
    if n > 0:
        print 'N-', n

        a.append(pt)
        b.append(sml_crv[n])
        c.append(sml_crv[n-1])
        d.append(pt[n-1])
        print a
        print b
        print c
        print d

    #m_face = rs.AddMesh(m_verts, len(m_verts))

#print a, b, c, d
# ---------- end python ----------
merge_3 = Merge(Data1=python.a, Data2=python.b, Data3=python.c, Data4=python.d)
conmesh_3 = ConstructMesh(Vertices=merge_3, Faces={A=0, B=1, C=2, D=3})

# ----
pshift = ShiftPaths(Data=conmesh, Offset=-1)
flatten = FlattenTree(Tree=conmesh_2, Path="{0}")  # -> simplify(graft(Tree))
weld = WeldMesh(Mesh=[pshift, flatten], Angle=3.141592654)
mjoin = MeshJoin(Meshes=weld)  # -> flatten(Mesh)
M = ClusterOutput(mjoin)
