# Grasshopper definition Vorticity_joinmesh_3.gh (Grasshopper 0.9.76)
# plug-ins: Python Interpreter, Weaverbird

mesh = Mesh([<mesh referenced from the Rhino model> x288])
list = ValueList({"X": 0, "Y": 1, "Z": 2}, selected="X")
python = PythonScript(meshes=mesh)  # -> out, a; inputs meshes: list of Mesh
# ---------- python: Python ----------
import Rhino.Geometry as rg

a = []

for m in meshes:
    print m.Faces.Count
    if m.Faces.Count > 100:
        a.append(m)
    else:
        pass
# ---------- end python ----------

# ---- group: BBox info
bbox = BoundingBox(Content=python.a, Plane=PlaneXY(0, 0, 0), UnionBox=True)  # -> Box, Box_2
debox = DeconstructBox(Box=bbox.Box)  # -> Plane, X, Y, Z
debrep = DeconstructBrep(Brep=bbox.Box)  # -> Faces, Edges, Vertices
X = Number(debox.X)
Y = Number(debox.Y)
Z = Number(debox.Z)

# ---- group: Cut Plane
X_2 = UnitX(Factor="-0.01")
item = ListItem(List=debrep.Faces, Index="1", Wrap=True)
move = Move(Geometry=item, Motion=X_2)  # -> Geometry, Transform
pln = Plane(move.Geometry)

# ----
rev = Reverse(Vector=X_2)
X_3 = UnitX(Factor=X)
rev_2 = Reverse(Vector=X_3)

# ---- group: Remove naked faces
mesh_2 = Mesh(<mesh referenced from the Rhino model>)
python_2 = PythonScript(mesh=mesh_2)  # -> bound, intern; inputs mesh: Mesh
# ---------- python_2: Python ----------
boundaryFaces = []
internalFaces = []

print mesh.Faces.Count



for i in range(mesh.Faces.Count):
    if mesh.Faces.HasNakedEdges(i):
        boundaryFaces.append(i);
    else:
        internalFaces.append(i);

bound = boundaryFaces;
intern = internalFaces;
# ---------- end python_2 ----------
demesh = DeconstructMesh(Mesh=mesh_2)  # -> Vertices, Faces, Colours, Normals
item_2 = ListItem(List=demesh.Faces, Index=python_2.bound, Wrap=True)
conmesh = ConstructMesh(Vertices=demesh.Vertices, Faces=item_2)

# ----
wbjoin = WeaverbirdsJoinMeshesAndWeld(Weld=True)

# ---- group: Stitch Plane
item_3 = ListItem(List=debrep.Faces, Index="3", Wrap=True)

# ----
move_2 = Move(Geometry=item_3, Motion=rev)  # -> Geometry, Transform

# ---- group: Stitch Plane (continued)
pln_2 = Plane(move_2.Geometry)

# ----
python_3 = PythonScript(meshes=python.a, c_pln=pln, s_pln=pln_2)  # -> out, cut, stitch, virgin; inputs meshes: list of Mesh, c_pln: Plane, s_pln: Plane
# ---------- python_3: Python ----------
import Rhino.Geometry as rg
import rhinoscriptsyntax as rs

cut = []
stitch = []
virgin = []

for m in meshes:
    if rg.Intersect.Intersection.MeshPlane(m, c_pln):
        cut.append(m)
    elif rg.Intersect.Intersection.MeshPlane(m, s_pln):
        stitch.append(m)
    else:
        virgin.append(m)

print len(meshes)
print len(cut)
print len(stitch)
print len(virgin)
# ---------- end python_3 ----------
panel = Panel(python_3.out)
mesh_virgin = Mesh(simplify(python_3.virgin))
mesh_stitch = Mesh(graft(python_3.stitch))
mesh_cut = Mesh(python_3.cut)
move_3 = Move(Geometry=mesh_cut, Motion=rev_2)  # -> graft(Geometry), Transform

# ---- group: Sort Vertically
bbox_2 = BoundingBox(Content=move_3.Geometry, Plane=PlaneXY(0, 0, 0))  # -> Box, Box_2
bbox_3 = BoundingBox(Content=mesh_stitch, Plane=PlaneXY(0, 0, 0))  # -> Box, Box_2
box = EvaluateBox(Box=bbox_2.Box, UParameter=0.5, VParameter=0.5, WParameter=0.5)  # -> Plane, Point, Include
box_2 = EvaluateBox(Box=bbox_3.Box, UParameter=0.5, VParameter=0.5, WParameter=0.5)  # -> Plane, Point, Include
pdecon = Deconstruct(Point=box_2.Point)  # -> XComponent, YComponent, flatten(ZComponent)
pdecon_2 = Deconstruct(Point=box.Point)  # -> XComponent, YComponent, flatten(ZComponent)
sort = SortList(Keys=pdecon.ZComponent, ValuesA=flatten(mesh_stitch))  # -> Keys, graft(ValuesA)
sort_2 = SortList(Keys=pdecon_2.ZComponent, ValuesA=flatten(move_3.Geometry))  # -> Keys, graft(ValuesA)

# ----
panel_2 = Panel(sort_2.ValuesA)
wbnaked = WeaverbirdsNakedBoundary(MeshClosedPolylines=sort_2.ValuesA)  # -> flatten(NakedCurves)
wbnaked_2 = WeaverbirdsNakedBoundary(MeshClosedPolylines=sort.ValuesA)  # -> flatten(NakedCurves)
python_4 = PythonScript(crvs=wbnaked)  # -> c_out; inputs crvs: list of Curve
# ---------- python_4: Python ----------
import Rhino.Geometry as rg
import rhinoscriptsyntax as rs

c_out = []

for c in crvs:
    print rs.CurveLength(c)
    if rs.CurveLength(c) > .08:
        c_out.append(c)
    else:
        pass
# ---------- end python_4 ----------
python_5 = PythonScript(crvs=wbnaked_2)  # -> c_out; inputs crvs: list of Curve; same code as python_4
flip = FlipCurve(Curve=python_5)  # -> Curve, Flag

# ---- group: Mesh Seam
# Issues:
# - Same Dir
# - variable # of CPs
cluster = Cluster(crv=python_4, crv_2=python_5)

# ----
mesh_3 = Mesh(cluster)
mjoin = MeshJoin(Meshes=[sort_2.ValuesA, sort.ValuesA, mesh_3])  # -> flatten(Mesh)
mesh_4 = Mesh([mjoin, mesh_virgin])

# ==== cluster Cluster
crv = ClusterInput()
crv_2 = ClusterInput()
crv_3 = Curve(crv)
crv_4 = Curve(crv_2)

# ---- group: Align Crv Seams
xy = XYPlane(Origin=Point(0, 0, 0))
x_tremez = Extremes(Curve=crv_4, Plane=xy)  # -> Highest, Lowest
x_tremez_2 = Extremes(Curve=crv_3, Plane=xy)  # -> Highest, Lowest
crv_cp = CurveClosestPoint(Point=x_tremez.Lowest, Curve=crv_4)  # -> Point, Parameter, Distance
crv_cp_2 = CurveClosestPoint(Point=x_tremez_2.Lowest, Curve=crv_3)  # -> Point, Parameter, Distance
seam = Seam(Curve=graft(crv_4), Seam=graft(crv_cp.Parameter))
seam_2 = Seam(Curve=graft(crv_3), Seam=graft(crv_cp_2.Parameter))

# ----
flip = FlipCurve(Curve=seam)  # -> Curve, Flag
cp = ControlPoints(Curve=flip.Curve)  # -> Points, Weights, Knots
cp_2 = ControlPoints(Curve=seam_2)  # -> Points, Weights, Knots
long = LongestList(ListA=cp_2.Points, ListB=cp.Points, PaddingMode=2)  # -> simplify(ListA), simplify(ListB)

# ---- group: tree version
python_tree = PythonScript(crv1=long.ListA, crv2=long.ListB)  # -> out, a_Tree, b_Tree, c_Tree, d_Tree; inputs crv1: tree of Point3d, crv2: tree of Point3d
# ---------- python_tree: Python ----------
import Rhino.Geometry as rg
import rhinoscriptsyntax as rs
import Grasshopper as gh
import collections

def equalize(one_list, two_list):
    if len(one_list) > len(two_list):
        short = two_list
        llong = one_list
    else:
        short = one_list
        llong = two_list
    for i in range(len(short), len(llong)):
        print i
        short.append(short[-1])

print crv1.BranchCount
print crv2.BranchCount

a_Tree = gh.DataTree[object]()
b_Tree = gh.DataTree[object]()
c_Tree = gh.DataTree[object]()
d_Tree = gh.DataTree[object]()


for i in range(crv1.BranchCount):
    
    print i 
    
    c_one = crv1.Branch(i)        
    c_two = crv2.Branch(i)
    
    a = []
    b = []
    c = []
    d = []
    
    
    for n, pt in enumerate(c_one):
        
        if n == 0:
            pass
        
        if n == 0:
            a_Tree.Add(c_one[n],gh.Kernel.Data.GH_Path(i))
            b_Tree.Add(c_two[n],gh.Kernel.Data.GH_Path(i))
            c_Tree.Add(c_two[len(c_two)-1],gh.Kernel.Data.GH_Path(i))
            d_Tree.Add(c_one[len(c_one)-1],gh.Kernel.Data.GH_Path(i))
        
        if n > 0:
            #print 'N -', n
        
            a_Tree.Add(c_one[n],gh.Kernel.Data.GH_Path(i))
            b_Tree.Add(c_two[n],gh.Kernel.Data.GH_Path(i))
            c_Tree.Add(c_two[n-1],gh.Kernel.Data.GH_Path(i))
            d_Tree.Add(c_one[n-1],gh.Kernel.Data.GH_Path(i))
            
            m = [c_one[n], c_two[n], c_two[n-1], c_one[n-1]]
            
            #faces.append(rs.AddMesh(m,m))
        else:
            pass
# ---------- end python_tree ----------
merge = Merge(
    Data1=graft(python_tree.a_Tree),
    Data2=graft(python_tree.b_Tree),
    Data3=graft(python_tree.c_Tree),
    Data4=graft(python_tree.d_Tree))
conmesh = ConstructMesh(Vertices=merge, Faces={A=0, B=1, C=2, D=3})
pshift = ShiftPaths(Data=conmesh, Offset=-1)
wbjoin = WeaverbirdsJoinMeshesAndWeld(Mesh=pshift, Weld=False)
mjoin = MeshJoin(Meshes=pshift)

# ----
M = ClusterOutput(mjoin)
