# Grasshopper definition alt_mesh_seam_1.gh (Grasshopper 0.9.76)
# plug-ins: MeshEdit Components, Python Interpreter, Weaverbird

mesh = Mesh(<mesh referenced from the Rhino model>)
mesh_2 = Mesh(<mesh referenced from the Rhino model>)

mesh_3 = Mesh(<mesh referenced from the Rhino model>)
mesh_4 = Mesh(<mesh referenced from the Rhino model>)

python = PythonScript(mesh=mesh_2)  # -> Internal, Boundary; inputs mesh: Mesh
# ---------- python: Python ----------
BoundaryFaces = []
InternalFaces = []

print mesh.Faces.Count

for i in range(mesh.Faces.Count):
    if mesh.Faces.HasNakedEdges(i):
        BoundaryFaces.append(i)
    else:
        InternalFaces.append(i)

Boundary = BoundaryFaces
Internal = InternalFaces
# ---------- end python ----------
mcomp = Decompose(Mesh=mesh_2)  # -> Vertices, Faces, Colours, Normals
item = ListItem(List=mcomp.Faces, Index=python.Internal, Wrap=True)
mesh_5 = Mesh(Vertices=mcomp.Vertices, Faces=item)

python_2 = PythonScript(mesh=mesh)  # -> Internal, Boundary; inputs mesh: Mesh; same code as python
mcomp_2 = Decompose(Mesh=mesh)  # -> Vertices, Faces, Colours, Normals
item_2 = ListItem(List=mcomp_2.Faces, Index=python_2.Internal, Wrap=True)
mesh_6 = Mesh(Vertices=mcomp_2.Vertices, Faces=item_2)

mesh_7 = Mesh(<mesh referenced from the Rhino model>)
python_3 = PythonScript(mesh=mesh_3)  # -> bound, intern; inputs mesh: Mesh
# ---------- python_3: Python ----------
boundaryFaces = []
internalFaces = []

print mesh.Faces.Count

for i in range(mesh.Faces.Count):
    if mesh.Faces.HasNakedEdges(i):
        boundaryFaces.append(i);
    else:
        internalFaces.append(i);

bound = boundaryFaces;
intern = internalFaces;
# ---------- end python_3 ----------
python_4 = PythonScript(mesh=mesh_4)  # -> bound, intern; inputs mesh: Mesh; same code as python_3

# ----
# Weld w tolerance
mjoin = MeshJoin(Meshes=[mesh_4, mesh_3])
weldvertices = MeshWeldVertices(Mesh=mjoin, Tolerance="0.05")  # -> RuntimeMessage, Mesh

demesh = DeconstructMesh(Mesh=mesh_3)  # -> Vertices, Faces, Colours, Normals

# ---- group: Remove naked faces
# Remove faces and create new ones
demesh_2 = DeconstructMesh(Mesh=mesh_4)  # -> Vertices, Faces, Colours, Normals
item_3 = ListItem(List=demesh_2.Faces, Index=python_4.intern, Wrap=True)
conmesh = ConstructMesh(Vertices=demesh_2.Vertices, Faces=item_3)

# ----
wbnaked = WeaverbirdsNakedBoundary(MeshClosedPolylines=mesh_5)  # -> flatten(NakedCurves)
item_4 = ListItem(List=demesh.Faces, Index=python_3.intern, Wrap=True)
wbnaked_2 = WeaverbirdsNakedBoundary(MeshClosedPolylines=mesh_6)  # -> flatten(NakedCurves)
conmesh_2 = ConstructMesh(Vertices=demesh.Vertices, Faces=item_4)
crv = Curve(wbnaked_2)
crv_2 = Curve(wbnaked)
cp = ControlPoints(Curve=crv_2)  # -> Points, Weights, Knots
mb = MeshBurner(mesh=conmesh)  # -> nakedVerts; inputs mesh: Mesh
# ---------- mb: Python ----------
boundaryFaces = []
internalFaces = []

print mesh.Faces.Count

for i in range(mesh.Faces.Count):
    if mesh.Faces.HasNakedEdges(i):
        boundaryFaces.append(i);
    else:
        internalFaces.append(i);

bound = boundaryFaces;
intern = internalFaces;

nakedVerts = []



import Rhino as rc
import Grasshopper as gh


# Set component name/nick
ghenv.Component.Name = "MeshBurner"
ghenv.Component.NickName = "MB"

def listToTree(list):
    
    """ Returns a Grasshopper DataTree containing the elements of 
    a Python iterable such as a list or tuple """
    
    # Create a GH data tree (note the parentheses and type declaration (object))
    dataTree = gh.DataTree[object]()
    
    # Add the data from the list to the datatree
    for i, v in enumerate(list):
        for d in v:
            dataTree.Add(d,gh.Kernel.Data.GH_Path(i))
    
    return dataTree

def getNakedVertsIDs(mesh):
    
    """ Return the face indices of any face with a naked vertex """
    
    nakedVerts = []
    
    # Get naked vertices
    nPts = list( mesh.GetNakedEdgePointStatus())
    nIDs = [i for i,v in enumerate(nPts) if v == True]
    
    return nIDs

def meshBurner(mesh):
    
    """     Discretize a mesh using a grassfire algorithm """
    centerPts = []
    burnFronts = []
    while mesh.Faces.Count:
        
        orgPts = []
        
        # Make burn front mesh and add vertices to it
        bm = rc.Geometry.Mesh()
        bm.Vertices.AddVertices(mesh.Vertices.ToPoint3fArray())
        
        # Add the burn perimeter to the mesh
        nfIDs = getNakedFaceIDs(mesh)
        nf = [mesh.Faces.Item[i] for i in nfIDs]
        bm.Faces.AddFaces(nf)
        
        # Compact and append to output list
        bm.Compact()
        bm.Normals.ComputeNormals()
        burnFronts.append(bm)
        
        points = []
        for i in bm.Faces:
            # point = bm.Faces.GetFaceCenter
            # points.append(point)
            point = [mesh.Faces.GetFaceCenter(y) for y in nfIDs]
            points.append(point)
        centerPts = listToTree(points)
        
        # Delete the burned faces
        mesh.Faces.DeleteFaces(nfIDs)

    return burnFronts, centerPts

nakedVerts = getNakedVertsIDs(mesh)
# ---------- end mb ----------

# ---- group: Align Crv Seams
xy = XYPlane(Origin=Point(0, 0, 0))
x_tremez = Extremes(Curve=crv, Plane=xy)  # -> Highest, Lowest
x_tremez_2 = Extremes(Curve=crv_2, Plane=xy)  # -> Highest, Lowest
crv_cp = CurveClosestPoint(Point=x_tremez.Lowest, Curve=crv)  # -> Point, Parameter, Distance
crv_cp_2 = CurveClosestPoint(Point=x_tremez_2.Lowest, Curve=crv_2)  # -> Point, Parameter, Distance
seam = Seam(Curve=graft(crv), Seam=graft(crv_cp.Parameter))
seam_2 = Seam(Curve=graft(crv_2), Seam=graft(crv_cp_2.Parameter))

# ----
flip = FlipCurve(Curve=seam)  # -> Curve, Flag
cp_2 = ControlPoints(Curve=seam_2)  # -> Points, Weights, Knots
cp_3 = ControlPoints(Curve=flip.Curve)  # -> Points, Weights, Knots
long = LongestList(ListA=cp_2.Points, ListB=cp_3.Points, PaddingMode=2)  # -> simplify(ListA), simplify(ListB)

# ---- group: tree version
python_tree = PythonScript(crv1=long.ListA, crv2=long.ListB)  # -> out, a_Tree, b_Tree, c_Tree, d_Tree; inputs crv1: tree of Point3d, crv2: tree of Point3d
# ---------- python_tree: Python ----------
import Rhino.Geometry as rg
import rhinoscriptsyntax as rs
import Grasshopper as gh
import collections

def equalize(one_list, two_list):
    if len(one_list) > len(two_list):
        short = two_list
        llong = one_list
    else:
        short = one_list
        llong = two_list
    for i in range(len(short), len(llong)):
        print i
        short.append(short[-1])

print crv1.BranchCount
print crv2.BranchCount

a_Tree = gh.DataTree[object]()
b_Tree = gh.DataTree[object]()
c_Tree = gh.DataTree[object]()
d_Tree = gh.DataTree[object]()


for i in range(crv1.BranchCount):
    
    print i 
    
    c_one = crv1.Branch(i)        
    c_two = crv2.Branch(i)
    
    a = []
    b = []
    c = []
    d = []
    
    
    for n, pt in enumerate(c_one):
        
        if n == 0:
            pass
        
        if n == 0:
            a_Tree.Add(c_one[n],gh.Kernel.Data.GH_Path(i))
            b_Tree.Add(c_two[n],gh.Kernel.Data.GH_Path(i))
            c_Tree.Add(c_two[len(c_two)-1],gh.Kernel.Data.GH_Path(i))
            d_Tree.Add(c_one[len(c_one)-1],gh.Kernel.Data.GH_Path(i))
        
        if n > 0:
            #print 'N -', n
        
            a_Tree.Add(c_one[n],gh.Kernel.Data.GH_Path(i))
            b_Tree.Add(c_two[n],gh.Kernel.Data.GH_Path(i))
            c_Tree.Add(c_two[n-1],gh.Kernel.Data.GH_Path(i))
            d_Tree.Add(c_one[n-1],gh.Kernel.Data.GH_Path(i))
            
            m = [c_one[n], c_two[n], c_two[n-1], c_one[n-1]]
            
            #faces.append(rs.AddMesh(m,m))
        else:
            pass
# ---------- end python_tree ----------
merge = Merge(
    Data1=graft(python_tree.a_Tree),
    Data2=graft(python_tree.b_Tree),
    Data3=graft(python_tree.c_Tree),
    Data4=graft(python_tree.d_Tree))
conmesh_3 = ConstructMesh(Vertices=merge, Faces={A=0, B=1, C=2, D=3})
pshift = ShiftPaths(Data=conmesh_3, Offset=-1)
wbjoin = WeaverbirdsJoinMeshesAndWeld(Mesh=pshift, Weld=False)
mjoin_2 = MeshJoin(Meshes=pshift)
