# Grasshopper definition mesh_seam.gh (Grasshopper 0.9.76)
# plug-ins: Python Interpreter, Weaverbird

crv = Curve([<curve referenced from the Rhino model> x8])
crv_2 = Curve([<curve referenced from the Rhino model> x8])
cp = ControlPoints(Curve=crv)  # -> Points, Weights, Knots
cp_2 = ControlPoints(Curve=crv_2)  # -> Points, Weights, Knots
x_tremez = Extremes(Curve=crv, Plane=PlaneXY(0, 0, 0))  # -> Highest, Lowest
x_tremez_2 = Extremes(Curve=crv_2, Plane=PlaneXY(0, 0, 0))  # -> Highest, Lowest
seam = Seam(Curve=crv_2, Seam=x_tremez_2.Lowest)  # -> graft(Curve)
seam_2 = Seam(Curve=crv, Seam=x_tremez.Lowest)  # -> graft(Curve)
flip = FlipCurve(Curve=seam)  # -> Curve, Flag
alongcrv = SortAlongCurve(Points=cp.Points, Curve=seam_2)  # -> simplify(Points), Indices
alongcrv_2 = SortAlongCurve(Points=cp_2.Points, Curve=flip.Curve)  # -> simplify(Points), Indices

sort_pt = SortPoints(Points=cp.Points)  # -> Points, Indices
sort_pt_2 = SortPoints(Points=cp_2.Points)  # -> Points, Indices
pline = PolyLine(Vertices=sort_pt.Points, Closed=False)
item = ListItem(List=sort_pt_2.Points, Index=0, Wrap=True)
item_2 = ListItem(List=sort_pt.Points, Index=0, Wrap=True)
seam_3 = Seam(Curve=crv_2, Seam=item)
seam_4 = Seam(Curve=crv, Seam=item_2)
flip_2 = FlipCurve(Curve=seam_3)  # -> Curve, Flag
explode = Explode(Curve=seam_4, Recursive=True)  # -> Segments, Vertices
explode_2 = Explode(Curve=seam_3, Recursive=True)  # -> Segments, Vertices
cp_3 = ControlPoints(Curve=seam_3)  # -> Points, Weights, Knots
cp_4 = ControlPoints(Curve=seam_4)  # -> Points, Weights, Knots

ln = Line(StartPoint=alongcrv.Points, EndPoint=alongcrv_2.Points)

weave = Weave(Pattern=[0, 1], Stream0=cp.Points, Stream1=cp_2.Points, NullGaps=False)  # -> simplify(Weave)
lng = ListLength(List=cp_2.Points)
lng_2 = ListLength(List=cp.Points)
conmesh = ConstructMesh(Vertices=weave, Faces={A=0, B=1, C=2, D=3})

subset = SubList(List=cp_3.Points, Domain=Domain(0, 5), Wrap=True)  # -> List, Index
subset_2 = SubList(List=cp_4.Points, Domain=Domain(0, 5), Wrap=True)  # -> List, Index
points = PointList(Points=subset.List, Size=0.05)
points_2 = PointList(Points=subset_2.List, Size=0.05)
wbweave = WeaverbirdsMeshFromLinesWeaveBack(Lines=[explode.Segments, ln, explode_2.Segments], MaximumValence=6)  # disabled

area = Area(Geometry=crv_2)  # -> Area, Centroid
area_2 = Area(Geometry=crv)  # -> Area, Centroid
points_3 = PointList(Points=area.Centroid, Size=1.5)
python = PythonScript(crv1=crv, crv2=crv_2)  # -> out, a; inputs crv1: list of Curve, crv2: list of Curve
# ---------- python: Python ----------
import Rhino.Geometry as rg
import rhinoscriptsyntax as rs

for c in crv2:
    print c
    print c.ComponentIndex
# ---------- end python ----------
points_4 = PointList(Points=area_2.Centroid, Size=1.5)
