# Grasshopper definition mesh_seam_2.gh (Grasshopper 0.9.76)
# plug-ins: Python Interpreter

crv = Curve([<curve referenced from the Rhino model> x8])
crv_2 = Curve([<curve referenced from the Rhino model> x8])
xy = XYPlane(Origin=Point(0, 0, 0))
x_tremez = Extremes(Curve=crv_2, Plane=xy)  # -> Highest, Lowest
x_tremez_2 = Extremes(Curve=crv, Plane=xy)  # -> Highest, Lowest
crv_cp = CurveClosestPoint(Point=x_tremez.Lowest, Curve=crv_2)  # -> Point, Parameter, Distance
crv_cp_2 = CurveClosestPoint(Point=x_tremez_2.Lowest, Curve=crv)  # -> Point, Parameter, Distance
seam = Seam(Curve=graft(crv_2), Seam=graft(crv_cp.Parameter))
seam_2 = Seam(Curve=graft(crv), Seam=graft(crv_cp_2.Parameter))
cp = ControlPoints(Curve=seam_2)  # -> Points, Weights, Knots
cp_2 = ControlPoints(Curve=seam)  # -> Points, Weights, Knots
flip = FlipCurve(Curve=seam)  # -> Curve, Flag

curvepoint = PointOnCurve([seam_2, seam], parameter=0)
sph = Sphere(Base=curvepoint, Radius=0.05)
sph_2 = Sphere(Base=x_tremez_2.Lowest, Radius=0.01)

alongcrv = SortAlongCurve(Points=cp.Points, Curve=seam_2)  # -> simplify(Points), Indices
alongcrv_2 = SortAlongCurve(Points=cp_2.Points, Curve=flip.Curve)  # -> simplify(Points), Indices
explode = Explode(Curve=flip.Curve, Recursive=True)  # -> Segments, Vertices
explode_2 = Explode(Curve=seam_2, Recursive=True)  # -> Segments, Vertices
python = PythonScript(crv1=alongcrv.Points, crv2=alongcrv_2.Points)  # -> out, a; inputs crv1: list of Point3d, crv2: list of Point3d
# ---------- python: Python ----------
import Rhino.Geometry as rg
import rhinoscriptsyntax as rs

print '1-', len(crv1)
print '2-', len(crv2)

for pt in crv2:
    #print pt
    pass
# ---------- end python ----------
weave = Weave(Pattern=[0, 1], Stream0=alongcrv.Points, Stream1=alongcrv_2.Points, NullGaps=False)
ln = Line(StartPoint=alongcrv.Points, EndPoint=alongcrv_2.Points)
conmesh = ConstructMesh(Vertices=weave, Faces={A=0, B=1, C=2, D=3})
loft = Loft(Curves=ln, Options={Adjust=False, Closed=True, LoftEnds=0, LoftSimp=0, LoftType=3, Rebuild=10, Refit=0.01})

subset = SubList(List=alongcrv_2.Points, Domain=Domain(0, 5), Wrap=True)  # -> List, Index
subset_2 = SubList(List=alongcrv.Points, Domain=Domain(0, 5), Wrap=True)  # -> List, Index
points = PointList(Points=subset.List, Size=0.05)
points_2 = PointList(Points=subset_2.List, Size=0.05)
