# Grasshopper definition mesh_seam_3.gh (Grasshopper 0.9.76)
# plug-ins: Python Interpreter

# ---- group: TEST crvs
crv = Curve(<curve referenced from the Rhino model>)
crv_2 = Curve(<curve referenced from the Rhino model>)
divide = DivideCurve(Curve=crv_2, Count=10, Kinks=False)  # -> Points, Tangents, Parameters
divide_2 = DivideCurve(Curve=crv, Count=12, Kinks=False)  # -> Points, Tangents, Parameters

# ----
crv_3 = Curve([<curve referenced from the Rhino model> x8])
crv_4 = Curve([<curve referenced from the Rhino model> x8])

# ---- group: Align Crv Seams
xy = XYPlane(Origin=Point(0, 0, 0))
x_tremez = Extremes(Curve=crv_3, Plane=xy)  # -> Highest, Lowest
x_tremez_2 = Extremes(Curve=crv_4, Plane=xy)  # -> Highest, Lowest
crv_cp = CurveClosestPoint(Point=x_tremez.Lowest, Curve=crv_3)  # -> Point, Parameter, Distance
crv_cp_2 = CurveClosestPoint(Point=x_tremez_2.Lowest, Curve=crv_4)  # -> Point, Parameter, Distance
seam = Seam(Curve=graft(crv_3), Seam=graft(crv_cp.Parameter))
seam_2 = Seam(Curve=graft(crv_4), Seam=graft(crv_cp_2.Parameter))

# ----
cp = ControlPoints(Curve=seam)  # -> Points, Weights, Knots
cp_2 = ControlPoints(Curve=seam_2)  # -> Points, Weights, Knots
long = LongestList(ListA=cp_2.Points, ListB=cp.Points, PaddingMode=2)  # -> simplify(ListA), simplify(ListB)

# ---- group: Even Faces
index = ItemIndex(List=long.ListA, Item=long.ListA)
index_2 = ItemIndex(List=long.ListB, Item=long.ListB)
item = ListItem(List=long.ListB, Index=index_2, Wrap=True)  # -> graft(Item), graft(Item1), graft(Item2)
item_2 = ListItem(List=long.ListA, Index=index, Wrap=True)  # -> graft(Item), graft(Item1), graft(Item2)
merge = Merge(Data1=item_2.Item, Data2=item.Item, Data3=item.Item1, Data4=item_2.Item1)
conmesh = ConstructMesh(Vertices=merge, Faces={A=0, B=1, C=2, D=3})

# ---- group: Last Face
item_3 = ListItem(List=long.ListA, Index=0, Wrap=True)  # -> graft(Item1), graft(Item)
item_4 = ListItem(List=long.ListB, Index=0, Wrap=True)  # -> graft(Item1), graft(Item)
merge_2 = Merge(Data1=item_3.Item1, Data2=item_3.Item, Data3=item_4.Item, Data4=item_4.Item)
conmesh_2 = ConstructMesh(Vertices=merge_2, Faces={A=0, B=1, C=2, D=3})  # -> simplify(Mesh)

# ----
panel = Panel("Enumeration Issue")

# ---- group: Replace above w scripting
python = PythonScript(crv1=cp_2.Points, crv2=cp.Points)  # -> out, a, b, c, d; inputs crv1: list of Point3d, crv2: list of Point3d
# ---------- python: Python ----------
import Rhino.Geometry as rg
import rhinoscriptsyntax as rs

print '1-', len(crv1)
print '2-', len(crv2)

a = []
b = []
c = []
d = []

if len(crv2) > len(crv1):
    big_crv = crv2
    sml_crv = crv1
else:
    big_crv = crv1
    sml_crv = crv2

for n, pt in enumerate(big_crv):

#    if n > len(sml_crv):
#        
    
    if n > 0:
        print 'N-', n

        a.append(pt)
        b.append(sml_crv[n])
        c.append(sml_crv[n-1])
        d.append(pt[n-1])
        print a
        print b
        print c
        print d

    #m_face = rs.AddMesh(m_verts, len(m_verts))

#print a, b, c, d
# ---------- end python ----------
merge_3 = Merge(Data1=python.a, Data2=python.b, Data3=python.c, Data4=python.d)
conmesh_3 = ConstructMesh(Vertices=merge_3, Faces={A=0, B=1, C=2, D=3})

# ----
pshift = ShiftPaths(Data=conmesh, Offset=-1)
flatten = FlattenTree(Tree=conmesh_2, Path="{0}")  # -> simplify(graft(Tree))
weld = WeldMesh(Mesh=[pshift, flatten], Angle=3.141592654)
mjoin = MeshJoin(Meshes=weld)  # -> flatten(Mesh)
panel_2 = Panel(mjoin)

sph = Sphere(Base=PlaneXY(0, 0, 0), Radius=0.05)
sph_2 = Sphere(Base=PlaneXY(0, 0, 0), Radius=0.01)

subset = SubList(Domain=Domain(0, 5), Wrap=True)  # -> List, Index
subset_2 = SubList(Domain=Domain(0, 5), Wrap=True)  # -> List, Index
points = PointList(Points=subset.List, Size=0.05)
points_2 = PointList(Points=subset_2.List, Size=0.05)
