# Grasshopper definition mesh_seam_4.gh (Grasshopper 0.9.76)
# plug-ins: Python Interpreter

crv = Curve([<curve referenced from the Rhino model> x8])
crv_2 = Curve([<curve referenced from the Rhino model> x8])

# ---- group: Align Crv Seams
xy = XYPlane(Origin=Point(0, 0, 0))
x_tremez = Extremes(Curve=crv, Plane=xy)  # -> Highest, Lowest
x_tremez_2 = Extremes(Curve=crv_2, Plane=xy)  # -> Highest, Lowest
# import Grasshopper as gh
# 
# # Create a GH data tree (note the parentheses and type declaration)
# 
# dataTree = gh.DataTree[object]()
# 
# 
# # Add the data from the nested list to the datatree
# 
# for i, v in enumerate(list):
#     for d in v:
#         dataTree.Add(d,gh.Kernel.Data.GH_Path(i))
# 
# # Add other stuff to the data tree using custom paths
# 
# for i in range(10):
#     dataTree.Add(i,gh.Kernel.Data.GH_Path(69))
#     dataTree.Add(i*5,gh.Kernel.Data.GH_Path(666))
# 
# 
# # Return the tree to GH
# 
# ghTree = dataTree
crv_cp = CurveClosestPoint(Point=x_tremez.Lowest, Curve=crv)  # -> Point, Parameter, Distance
crv_cp_2 = CurveClosestPoint(Point=x_tremez_2.Lowest, Curve=crv_2)  # -> Point, Parameter, Distance
seam = Seam(Curve=graft(crv), Seam=graft(crv_cp.Parameter))
seam_2 = Seam(Curve=graft(crv_2), Seam=graft(crv_cp_2.Parameter))

# ----
cp = ControlPoints(Curve=seam)  # -> Points, Weights, Knots
cp_2 = ControlPoints(Curve=seam_2)  # -> Points, Weights, Knots

# ---- group: TEST crvs
crv_3 = Curve(<curve referenced from the Rhino model>)
crv_4 = Curve(<curve referenced from the Rhino model>)
divide = DivideCurve(Curve=crv_4, Count=10, Kinks=False)  # -> Points, Tangents, Parameters
divide_2 = DivideCurve(Curve=crv_3, Count=12, Kinks=False)  # -> Points, Tangents, Parameters

# ---- group: Replace above w scripting
python = PythonScript(crv1=divide.Points, crv2=divide_2.Points)  # -> out, a, b, c, d, faces; inputs crv1: list of Point3d, crv2: list of Point3d
# ---------- python: Python ----------
import Rhino.Geometry as rg
import rhinoscriptsyntax as rs

def equalize(short, llong):
    for i in range(len(short), len(llong)):
        short.append(short[-1])

a = []
b = []
c = []
d = []
faces = []

if len(crv2) > len(crv1):
    equalize(crv1, crv2)
else:
    equalize(crv2, crv1)


for n, pt in enumerate(crv1):

    if n == 0:
        a.append(crv1[n])
        b.append(crv2[n])
        c.append(crv2[-1])
        d.append(crv1[-1])


    elif n > 0:
        print 'N -', n

        a.append(crv1[n])
        b.append(crv2[n])
        c.append(crv2[n-1])
        d.append(crv1[n-1])
        
        m = [crv1[n], crv2[n], crv2[n-1], crv1[n-1]]
        
        #faces.append(rs.AddMesh(m,m))
    else:
        pass
        #rs.AddMesh(
# ---------- end python ----------
merge = Merge(Data1=graft(python.a), Data2=graft(python.b), Data3=graft(python.c), Data4=graft(python.d))
conmesh = ConstructMesh(Vertices=simplify(merge), Faces={A=0, B=1, C=2, D=3})  # -> flatten(Mesh)

# ----
panel = Panel("TREE Enumeration Issue")
panel_2 = Panel(merge)
pshift = ShiftPaths(Data=merge, Offset=-2)
mjoin = MeshJoin(Meshes=conmesh)
