# Grasshopper definition mesh_seam_6.gh (Grasshopper 0.9.76)
# plug-ins: Python Interpreter, Weaverbird

crv = Curve([<curve referenced from the Rhino model> x8])
crv_2 = Curve([<curve referenced from the Rhino model> x8])

# ---- group: Align Crv Seams
xy = XYPlane(Origin=Point(0, 0, 0))
# import Grasshopper as gh
# 
# # Create a GH data tree (note the parentheses and type declaration)
# 
# dataTree = gh.DataTree[object]()
# 
# 
# # Add the data from the nested list to the datatree
# 
# for i, v in enumerate(list):
#     for d in v:
#         dataTree.Add(d,gh.Kernel.Data.GH_Path(i))
# 
# # Add other stuff to the data tree using custom paths
# 
# for i in range(10):
#     dataTree.Add(i,gh.Kernel.Data.GH_Path(69))
#     dataTree.Add(i*5,gh.Kernel.Data.GH_Path(666))
# 
# 
# # Return the tree to GH
# 
# ghTree = dataTree
x_tremez = Extremes(Curve=crv_2, Plane=xy)  # -> Highest, Lowest
x_tremez_2 = Extremes(Curve=crv, Plane=xy)  # -> Highest, Lowest
crv_cp = CurveClosestPoint(Point=x_tremez.Lowest, Curve=crv_2)  # -> Point, Parameter, Distance
crv_cp_2 = CurveClosestPoint(Point=x_tremez_2.Lowest, Curve=crv)  # -> Point, Parameter, Distance
seam = Seam(Curve=graft(crv_2), Seam=graft(crv_cp.Parameter))
seam_2 = Seam(Curve=graft(crv), Seam=graft(crv_cp_2.Parameter))

# ----
flip = FlipCurve(Curve=seam)  # -> Curve, Flag
cp = ControlPoints(Curve=flip.Curve)  # -> Points, Weights, Knots
cp_2 = ControlPoints(Curve=seam_2)  # -> Points, Weights, Knots
long = LongestList(ListA=cp_2.Points, ListB=cp.Points, PaddingMode=2)  # -> simplify(ListA), simplify(ListB)

# ---- group: TEST crvs
crv_3 = Curve(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)
crv_4 = Curve(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)
divide = DivideCurve(Curve=crv_3, Count=10, Kinks=False)  # -> Points, Tangents, Parameters
divide_2 = DivideCurve(Curve=crv_4, Count=12, Kinks=False)  # -> Points, Tangents, Parameters

# ---- group: tree version
python_tree = PythonScript(crv1=long.ListA, crv2=long.ListB)  # -> out, a_Tree, b_Tree, c_Tree, d_Tree; inputs crv1: tree of Point3d, crv2: tree of Point3d
# ---------- python_tree: Python ----------
import Rhino.Geometry as rg
import rhinoscriptsyntax as rs
import Grasshopper as gh
import collections

def equalize(one_list, two_list):
    if len(one_list) > len(two_list):
        short = two_list
        llong = one_list
    else:
        short = one_list
        llong = two_list
    for i in range(len(short), len(llong)):
        print i
        short.append(short[-1])

print crv1.BranchCount
print crv2.BranchCount

a_Tree = gh.DataTree[object]()
b_Tree = gh.DataTree[object]()
c_Tree = gh.DataTree[object]()
d_Tree = gh.DataTree[object]()


for i in range(crv1.BranchCount):
    
    print i 
    
    c_one = crv1.Branch(i)        
    c_two = crv2.Branch(i)
    
    a = []
    b = []
    c = []
    d = []
    
    
    for n, pt in enumerate(c_one):
        
        if n == 0:
            pass
        
        if n == 0:
            a_Tree.Add(c_one[n],gh.Kernel.Data.GH_Path(i))
            b_Tree.Add(c_two[n],gh.Kernel.Data.GH_Path(i))
            c_Tree.Add(c_two[len(c_two)-1],gh.Kernel.Data.GH_Path(i))
            d_Tree.Add(c_one[len(c_one)-1],gh.Kernel.Data.GH_Path(i))
        
        if n > 0:
            #print 'N -', n
        
            a_Tree.Add(c_one[n],gh.Kernel.Data.GH_Path(i))
            b_Tree.Add(c_two[n],gh.Kernel.Data.GH_Path(i))
            c_Tree.Add(c_two[n-1],gh.Kernel.Data.GH_Path(i))
            d_Tree.Add(c_one[n-1],gh.Kernel.Data.GH_Path(i))
            
            m = [c_one[n], c_two[n], c_two[n-1], c_one[n-1]]
            
            #faces.append(rs.AddMesh(m,m))
        else:
            pass
# ---------- end python_tree ----------
merge = Merge(
    Data1=graft(python_tree.a_Tree),
    Data2=graft(python_tree.b_Tree),
    Data3=graft(python_tree.c_Tree),
    Data4=graft(python_tree.d_Tree))
conmesh = ConstructMesh(Vertices=merge, Faces={A=0, B=1, C=2, D=3})
pshift = ShiftPaths(Data=conmesh, Offset=-1)
wbjoin = WeaverbirdsJoinMeshesAndWeld(Mesh=pshift, Weld=False)
mjoin = MeshJoin(Meshes=pshift)

# ---- group: single version
python = PythonScript(crv1=divide.Points, crv2=divide_2.Points)  # -> out, a, b, c, d, faces; inputs crv1: list of Point3d, crv2: list of Point3d
# ---------- python: Python ----------
import Rhino.Geometry as rg
import rhinoscriptsyntax as rs

def equalize(one_list, two_list):
    if len(one_list) > len(two_list):
        short = two_list
        llong = one_list
    else:
        short = one_list
        llong = two_list

    for i in range(len(short), len(llong)):
        short.append(short[-1])

a = []
b = []
c = []
d = []
faces = []

equalize(crv1, crv2)

for n, pt in enumerate(crv1):

    if n == 0:
        a.append(crv1[n])
        b.append(crv2[n])
        c.append(crv2[-1])
        d.append(crv1[-1])


    elif n > 0:
        print 'N -', n

        a.append(crv1[n])
        b.append(crv2[n])
        c.append(crv2[n-1])
        d.append(crv1[n-1])
        
        m = [crv1[n], crv2[n], crv2[n-1], crv1[n-1]]
        
        #faces.append(rs.AddMesh(m,m))
    else:
        pass
        #rs.AddMesh(
# ---------- end python ----------
merge_2 = Merge(Data1=graft(python.a), Data2=graft(python.b), Data3=graft(python.c), Data4=graft(python.d))
conmesh_2 = ConstructMesh(Vertices=simplify(merge_2), Faces={A=0, B=1, C=2, D=3})  # -> flatten(Mesh)
mjoin_2 = MeshJoin(Meshes=conmesh_2)
