# Grasshopper definition remove_naked_faces.gh (Grasshopper 0.9.76)
# plug-ins: Python Interpreter

mesh = Mesh([<mesh referenced from the Rhino model> x4])
formfoundtoothbuttfinal = Mesh(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)
python = PythonScript(mesh=mesh)  # -> bound, intern; inputs mesh: Mesh
# ---------- python: Python ----------
boundaryFaces = []
internalFaces = []

print mesh.Faces.Count

for i in range(mesh.Faces.Count):
    if mesh.Faces.HasNakedEdges(i):
        boundaryFaces.append(i);
    else:
        internalFaces.append(i);

bound = boundaryFaces;
intern = internalFaces;
# ---------- end python ----------

# ---- group: Remove naked faces
demesh = DeconstructMesh(Mesh=mesh)  # -> Vertices, Faces, Colours, Normals
item = ListItem(List=demesh.Faces, Index=python.bound, Wrap=True)
conmesh = ConstructMesh(Vertices=demesh.Vertices, Faces=item)

# ----
trimeshmanifold = Mesh(formfoundtoothbuttfinal)
Z = Slider(155.61, range=155..165)

# ---- group: Rebuild Mesh Normals/Colors
N = PythonScript(M=trimeshmanifold)  # -> M; inputs M: Mesh
# ---------- N: Python ----------
if M:
    M.Normals.ComputeNormals()
    M.FaceNormals.ComputeFaceNormals()
    M.VertexColors.Clear()
# ---------- end N ----------

# ---- group: Make Walk Destination Picker
Z_2 = Slider(72.6, range=65..75)
X = Slider(50, range=40..50)
merge = Merge(Data1=X, Data2=Z)
mesh_2 = Mesh(N)

# ----
rad = Radians(Degrees=merge)

# ---- group: Make Walk Destination Picker (continued)
bbline = PythonScript(Mesh=mesh_2, Flip=Slider(0, range=0..1), Inflate=Slider(1000, range=100..1000), Rotate=rad)  # -> Edges, Line; inputs Mesh: Mesh, Rotate: list
# ---------- bbline: Python ----------
import Rhino as rc

a = []

if Mesh:
    
    # Get mesh bounding box and inflate it
    bb = Mesh.GetBoundingBox(False)
    print type(bb)
    bb.Inflate(Inflate)
    
    # Get box center/top points and make line
    bottom = bb.PointAt(0.5,0.5,0)
    top = bb.PointAt(0.5,0.5,1)
    Line = rc.Geometry.Line(bottom,top)
    if Flip > 0.5:
        Line.Flip()
    
    # Rotate line around center
    c = Line.PointAt(0.5)
    tX = rc.Geometry.Transform.Rotation(Rotate[0],rc.Geometry.Vector3d.XAxis,c)
    #tY = rc.Geometry.Transform.Rotation(Rotate[1],rc.Geometry.Vector3d.YAxis,c)
    tZ = rc.Geometry.Transform.Rotation(Rotate[1],rc.Geometry.Vector3d.ZAxis,c)
    Line.Transform(tX)
    #Line.Transform(tY)
    Line.Transform(tZ)
    
    # Get edges of bb for viz purposes
    Edges = bb.ToBrep().GetWireframe(-1)
# ---------- end bbline ----------
R = R(edges=bbline.Edges, line=bbline.Line)

# ---- group: Mesk Walker Algorithm
mesh_3 = Mesh(N)
line = Line(R)
meshwalker = PythonScript(
    Mesh=mesh_3,
    Line=line,
    PerimeterEdgeWeight=Slider(1, range=0.5..1),
    AdjustOddWalks=Toggle(False),
    CombinePass=Toggle(True))  # -> MeshWalks, FaceWalks, Mesh, SolutionValid; inputs Mesh: Mesh, Line: Line, MaxFaces: Int32, AdjustOddWalks: Boolean, CombinePass: Boolean
# ---------- meshwalker: Python ----------
"""
MeshWalker.
-
Author: Anders Holden Deleuran
Contact: andersdeleuran@outlook.com
Updated: 150828
"""

import random
import Rhino as rc
import networkx as nx
import Grasshopper as gh
import copy

def listToTree(list):
    
    """ Returns a Grasshopper DataTree containing the elements of 
    a Python iterable such as a list or tuple """
    
    # Create a GH data tree (note the parentheses and type declaration (object))
    dataTree = gh.DataTree[object]()
    
    # Add the data from the list to the datatree
    for i, v in enumerate(list):
        for d in v:
            dataTree.Add(d,gh.Kernel.Data.GH_Path(i))
    
    return dataTree

def meshVertexGraph(mesh):
    
    """ Make a networkx graph with mesh vertices as nodes and mesh edges as edges """
    
    # Create graph
    g = nx.Graph()
    
    for i in range(mesh.Vertices.Count):
        
        # Add node to graph and get its neighbours
        g.add_node(i,point=mesh.Faces.GetFaceCenter(i))
        neighbours = mesh.TopologyVertices.ConnectedTopologyVertices(i)
        
        # Add edges to graph
        for n in neighbours:
            if n > i:
                line = rc.Geometry.Line(mesh.Vertices.Item[i],mesh.Vertices.Item[n])
                g.add_edge(i,n,weight=line.Length,line=line)
    return g

def meshFacesGraph(mesh):
    
    """ Make a networkx graph with mesh face centers as nodes
    and topological connections (lines) as edges """
    
    # Create graph
    g = nx.Graph()
    
    for i in range(mesh.Faces.Count):
        
        # Add node to graph and get its neighbours
        g.add_node(i,point=mesh.Faces.GetFaceCenter(i))
        neighbours = mesh.Faces.AdjacentFaces(i)
        
        # Add edges to graph
        for n in neighbours:
            if n > i:
                line = rc.Geometry.Line(mesh.Faces.GetFaceCenter(i),mesh.Faces.GetFaceCenter(n))
                g.add_edge(i,n,weight=1,line=line)
                
    return g

def hasPath(g,source,target):
    
    """ Return True if G has a path from source to target, False otherwise """
    
    try:
        sp = nx.shortest_path(g,source, target)
    except nx.NetworkXNoPath:
        return False
    return True

def meshShortestWalkStripper(mesh,line,maxFaces,perimeterEdgeWeight,adjustOddWalks):
    
    # Return list
    facesWalked = []
    
    # Make graph and list of mesh face indices
    g = meshFacesGraph(mesh)
    mf = [i for i in range(mesh.Faces.Count)]
    
    while g.number_of_nodes():
        
        # Make perimeter edges more attractive by lowering their weight
        if perimeterEdgeWeight != 1.0:
            nDeg = g.degree()
            for e in g.edges():
                d0 = nDeg[e[0]]
                d1 = nDeg[e[1]]
                if d0 < 3 or d1 < 3:
                    g[e[0]][e[1]]['weight'] = perimeterEdgeWeight
                
        # Split graph into connected subgraphs and pick first one
        cg = nx.connected_components(g)[0]
        
        # Get index of closest nodes to line endpoints
        nPts = [g.node[n]["point"] for n in cg]
        nPts = rc.Collections.Point3dList(nPts)
        startID = nPts.ClosestIndex(line.From)
        endID = nPts.ClosestIndex(line.To)
        start = cg[startID]
        end = cg[endID]
        
        # Check that start and are not the same node
        if start == end:
            sp = (start,)
            
        else:
            # Check that that a path exist between the two nodes
            if hasPath(g,start,end):
                
                # Make path
                #sp = nx.shortest_path(g,start,end)
                sp = nx.dijkstra_path(g,start,end,weight = "weight")
                
                # Ensure that the path has en equal amount of face (to make strip quadrifiable)
                if adjustOddWalks:
                    if len(sp) % 2 != 0:
                        del sp[-1]
                        
                # Cull nodes
                if maxFaces:
                    if len(sp) > maxFaces:
                        sp = sp[0:maxFaces]
                        
        # Remove nodes from graph
        g.remove_nodes_from(sp)
        
        # Add to walk
        facesWalked.append(list(sp))
        
    return facesWalked

def combineFaceWalks(faceWalks,mesh):
    
    """ Add single walks to longer walks if possible """
    
    # Get mesh faces and single walks
    faces = mesh.Faces
    singleWalks = [w for w in faceWalks if len(w) == 1]
    
    # Iterate single walks
    for sw in singleWalks:
        if len(sw) == 1:
            
            # Get the face neighbours
            nbs = faces.AdjacentFaces(sw[0])
            
            # Identify neighbour walks
            for nb in nbs:
                
                nwID = [i for i,fw in enumerate(faceWalks) if nb in fw][0]
                
                # Add single walk if possible at start of neighbour walk
                if nb == faceWalks[nwID][0]:
                    faceWalks[nwID].insert(0,sw[0])
                    faceWalks.remove(sw)
                    break
                    
                # Add single walk if possible at start of neighbour walk
                elif nb == faceWalks[nwID][-1]:
                    faceWalks[nwID].insert(-1,sw[0])
                    faceWalks.remove(sw)
                    break

def checkMeshStrip(mesh):
    
    """ Check that a mesh strip is valid i.e. faces may
    have no more than two neighbours """
    
    valid = True
    for i in range(mesh.Faces.Count):
        n = mesh.Faces.AdjacentFaces(i)
        if len(n) > 2:
            valid = False
            break
            
    return valid

def extractMeshWalk(mesh,faceWalk):
    
    """ Extract the faceWalk (list of face integers) from the mesh """
    
    # Copy mesh and get mesh face indices
    cm = copy.copy(mesh)
    mf = [i for i in range(cm.Faces.Count)]
    
    # Calculate face difference and delete it
    fd = set(mf) - set(faceWalk)
    cm.Faces.DeleteFaces(fd)
    
    # Set normals
    cm.Normals.ComputeNormals()
    cm.FaceNormals.ComputeFaceNormals()
    
    return cm




# Check input geometry
if Mesh and Line:
    
    # Calculate mesh normals
    Mesh.Normals.ComputeNormals()
    Mesh.FaceNormals.ComputeFaceNormals()
    
    # Walk the mesh
    faceWalks = meshShortestWalkStripper(Mesh,Line,MaxFaces,PerimeterEdgeWeight,AdjustOddWalks)
    
    # Combine small walks with large ones
    if CombinePass:
        combineFaceWalks(faceWalks,Mesh)
    
    # Get the walks as meshes
    meshWalks = [extractMeshWalk(Mesh,fw) for fw in faceWalks]
    
    # Check that mesh strips are valid
    walksValid = [checkMeshStrip(m) for m in meshWalks]
    SolutionValid = False not in walksValid
    
    # Output to GH
    if SolutionValid:
        FaceWalks = listToTree(faceWalks)
        MeshWalks = meshWalks
    else:
        FaceWalks = []
        MeshWalks = []
# ---------- end meshwalker ----------
panel = Panel(meshwalker.SolutionValid)

# ----
facen = FaceNormals(Mesh=mesh_3)  # -> Centers, Normals
branch = TreeBranch(Tree=meshwalker.FaceWalks, Path=Slider(3, range=0..10), MaintainPaths=True)

# ---- group: Fitness Evaluation
fitness = PythonScript(MeshWalks=meshwalker.MeshWalks)  # -> SmallWalks, OddWalks; inputs MeshWalks: list of Mesh
# ---------- fitness: Python ----------
if MeshWalks and MeshWalks[0]:
    
    faceCount = [m.Faces.Count for m in MeshWalks]
    
    # Calculate small walks
    ones = faceCount.count(1)
    twos = faceCount.count(2)
    threes = faceCount.count(3)
    fours = faceCount.count(4)
    SmallWalks = ones + twos + threes + fours
    
    # Calculate odd walks
    OddWalks = []
    for fc in faceCount:
        if fc % 2 == 0:
            OddWalks.append(0)
        else:
            OddWalks.append(1)
    OddWalks = sum(OddWalks)
    
else:
    SmallWalks = 100000
# ---------- end fitness ----------
smallwalks = Number(fitness.SmallWalks)
oddwalks = Number(fitness.OddWalks)
panel_2 = Panel(smallwalks)

# ----
item_2 = ListItem(List=facen.Centers, Index=branch, Wrap=True)
pline = PolyLine(Vertices=item_2, Closed=False)
panel_3 = Panel(branch)
meshwalks = Mesh(meshwalker.MeshWalks)

# ==== cluster R: Render
edges = ClusterInput()
line = ClusterInput()
line_2 = Line(edges)
line_3 = Line(line)
end = EndPoints(Curve=line_3)  # -> Start, End
line_4 = ClusterOutput(line_3)
vec2pt = Vector2Pt(PointA=end.Start, PointB=end.End, Unitize=False)  # -> Vector, Length
vdis = VectorDisplay(Anchor=end.Start, Vector=vec2pt.Vector)
preview = CustomPreview(Geometry=line_2, Shader=ColourSwatch(SwatchColor=RGB(168, 168, 168)))
