# Grasshopper definition average_mesh_pts.gh (Grasshopper 0.9.76)
# plug-ins: Python Interpreter

mesh = Mesh([<mesh referenced from the Rhino model> x4])
mesh_2 = Mesh([<mesh referenced from the Rhino model> x4])
demesh = DeconstructMesh(Mesh=mesh_2)  # -> Vertices, Faces, Colours, Normals
average_pt = PythonScript(pts=demesh.Vertices)  # -> out, a; inputs pts: list of Point3d
# ---------- average_pt: Python ----------
import Rhino.Geometry as rg

avg_pt = [0,0,0]

for p in pts:
    avg_pt[0] += p[0]
    avg_pt[1] += p[1]
    avg_pt[2] += p[2]

for n, coord in enumerate(avg_pt):
    print avg_pt[n]
    avg_pt[n] = coord/len(pts)
    print avg_pt[n]
    
print avg_pt

a = rg.Point3d(avg_pt[0], avg_pt[1], avg_pt[2])
# ---------- end average_pt ----------
pt = Point(average_pt.a)
