# Grasshopper definition closest_point_pairs.gh (Grasshopper 0.9.76)
# plug-ins: Python Interpreter, Weaverbird

mesh = Mesh([<mesh referenced from the Rhino model> x12])

wbnaked = WeaverbirdsNakedBoundary(MeshClosedPolylines=mesh)
explode = Explode(Curve=wbnaked, Recursive=True)  # -> Segments, Vertices
viewer = ParamViewer(explode.Segments)
cp = ControlPoints(Curve=explode.Segments)  # -> Points, Weights, Knots
pshift = ShiftPaths(Data=cp.Points, Offset=-1)
del = DelaunayMesh(Points=pshift, Plane=PlaneXY(0, 0, 0))

# ----
# IF it has a pair:
#     WELD them
short_pt = Point([Point(161.6004869, -83.45932051, 0), Point(172.9732997, -101.3617075, 0), Point(104.3087975, -66.63272766, 0), Point(101.3699471, -58.92063783, 0)])
long_pt = Point([Point(117.6437076, -59.48209445, 0), Point(117.7949481, -37.95082808, 0), Point(138.1097405, -49.38639349, 0), Point(133.7248167, -29.63625994, 0), Point(158.3435095, -17.90363459, 0), Point(182.9841674, -32.1237947, 0), Point(197.3903481, -50.82325462, 0), Point(206.8548277, -78.10706072, 0), Point(173.5439963, -64.7085604, 0), Point(154.7865094, -60.89852491, 0)])

# ---- group: First CP
cp_2 = ClosestPoint(Point=short_pt, Cloud=long_pt)  # -> ClosestPoint, CPIndex, Distance
item = ListItem(List=long_pt, Index=cp_2.CPIndex, Wrap=True)

# ----
# IF no pair:
#     CAP it
python = PythonScript(long=long_pt, matched=item)  # -> solos; inputs long: list of Point3d, matched: list of Point3d
# ---------- python: Python ----------
solos = []

for iter, l in enumerate(long):
    if l in matched:
        pass
    else:
        solos.append(l)
# ---------- end python ----------
sph = Sphere(Base=python, Radius=0.5)
cir = Circle(Plane=python, Radius=3)

# ---- group: Reverse CP
cp_3 = ClosestPoint(Point=item, Cloud=short_pt)  # -> ClosestPoint, CPIndex, Distance
item_2 = ListItem(List=cp_2.ClosestPoint, Index=cp_3.CPIndex, Wrap=True)

# ----
python_2 = PythonScript(long=short_pt, matched=cp_3.ClosestPoint)  # -> solos; inputs long: list of Point3d, matched: list of Point3d; same code as python
ln = Line(StartPoint=cp_3.ClosestPoint, EndPoint=item_2)
cir_2 = Circle(Plane=python_2, Radius=3)
polygon = Polygon(Plane=[item_2, cp_3.ClosestPoint], Radius=3, Segments=3, FilletRadius=0)  # -> Polygon, Length
panel = Panel(item)
