# Grasshopper definition export_individ_stls.gh (Grasshopper 0.9.76)
# plug-ins: Python Interpreter

mesh = Mesh([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])
python = PythonScript(meshes=mesh)  # -> out, a, b; inputs meshes: list of Mesh
# ---------- python: Python ----------
import Rhino.Geometry as rg

a = []

for m in meshes:
    print m.Faces.Count
    if m.Faces.Count > 100:
        a.append(m)
    else:
        pass

b = len(a)
# ---------- end python ----------
panel = Panel(python.b)
# Export to Individual 3dms
panel_2 = Panel("""_RunPythonScript in Rhino
"Automate_Export_Individual_Meshes_01"
""")  # disabled

# ---- group: DONT DELETE - Iterated in Python
mesh_to_export = Slider(4, range=0..9)

# ----
mesh_2 = Mesh(python.a)

item = ListItem(List=mesh_2, Index=mesh_to_export, Wrap=False)

# ---- group: DONT DELETE - Baked in Python
geo_to_export = Geometry(item)
