# Grasshopper definition fill_mesh_hole_delaunay.gh (Grasshopper 0.9.76)
# plug-ins: Python Interpreter, Weaverbird, PolyMeshGh

# IF it has a pair:
#     WELD them
short_pt = Point([Point(161.6004869, -83.45932051, 0), Point(172.9732997, -101.3617075, 0), Point(104.3087975, -66.63272766, 0), Point(101.3699471, -58.92063783, 0)])  # disabled
long_pt = Point([Point(117.6437076, -59.48209445, 0), Point(117.7949481, -37.95082808, 0), Point(138.1097405, -49.38639349, 0), Point(133.7248167, -29.63625994, 0), Point(158.3435095, -17.90363459, 0), Point(182.9841674, -32.1237947, 0), Point(197.3903481, -50.82325462, 0), Point(206.8548277, -78.10706072, 0), Point(173.5439963, -64.7085604, 0), Point(154.7865094, -60.89852491, 0)])  # disabled

# ---- group: First CP
cp = ClosestPoint(Point=short_pt, Cloud=long_pt)  # -> ClosestPoint, CPIndex, Distance; disabled
item = ListItem(List=long_pt, Index=cp.CPIndex, Wrap=True)  # disabled

# ----
# IF no pair:
#     CAP it
python = PythonScript(long=long_pt, matched=item)  # -> solos; inputs long: list of Point3d, matched: list of Point3d; disabled
# ---------- python: Python ----------
solos = []

for iter, l in enumerate(long):
    if l in matched:
        pass
    else:
        solos.append(l)
# ---------- end python ----------
sph = Sphere(Base=python, Radius=0.5)  # disabled
cir = Circle(Plane=python, Radius=3)  # disabled

# ---- group: Reverse CP
cp_2 = ClosestPoint(Point=item, Cloud=short_pt)  # -> ClosestPoint, CPIndex, Distance; disabled
item_2 = ListItem(List=cp.ClosestPoint, Index=cp_2.CPIndex, Wrap=True)  # disabled

# ----
python_2 = PythonScript(long=short_pt, matched=cp_2.ClosestPoint)  # -> solos; inputs long: list of Point3d, matched: list of Point3d; disabled; same code as python
ln = Line(StartPoint=cp_2.ClosestPoint, EndPoint=item_2)  # disabled
cir_2 = Circle(Plane=python_2, Radius=3)  # disabled
polygon = Polygon(Plane=[item_2, cp_2.ClosestPoint], Radius=3, Segments=3, FilletRadius=0)  # -> Polygon, Length; disabled
panel = Panel(item)  # disabled
mesh = Mesh([<mesh referenced from the Rhino model> x12])
python_3 = PythonScript(m=mesh)  # -> msg, open, closed; inputs m: list of Mesh
# ---------- python_3: Python ----------
import Rhino.Geometry as rg
import Rhino as rh

open = []
closed = []

for mesh in m:
    naked = mesh.GetNakedEdges

    if mesh.IsClosed:
        print 'yes - Closed', naked
        closed.append(mesh)
    else:
        print 'no - Open'#, naked
        open.append(mesh)

msg = 'Open: %d, Closed: %d' % (len(open), len(closed))
# ---------- end python_3 ----------
wbnaked = WeaverbirdsNakedBoundary(MeshClosedPolylines=mesh)
python_4 = PythonScript(m=mesh)  # -> msg, open; inputs m: list of Mesh; same code as python_3
panel_2 = Panel(python_3.msg)
cp_3 = ControlPoints(Curve=wbnaked)  # -> Points, Weights, Knots
avr = Average(Input=cp_3.Points)  # -> flatten(ArithmeticMean)
python_5 = PythonScript(avg_pt=avr, crvs=wbnaked)  # -> patches; inputs avg_pt: list of Point3d, crvs: list of Curve
# ---------- python_5: Python ----------
import Rhino.Geometry as rg
import Rhino as rh
import rhinoscriptsyntax as rs
from collections import deque
items = deque([1, 2])
items.append(3) # deque == [1, 2, 3]

patches = []

for i, crv in enumerate(crvs):

    if rs.IsCurve(crv):
        points = rs.CurvePoints(crv)
    if points: cpts = [rs.AddPoint(pt) for pt in points]

    mesh = rg.Mesh()

    shiftedpts = deque(cpts)
    shiftedpts.rotate(1)
    
    print i
    for j, c in enumerate(cpts):
        print rs.coerce3dpoint(c)
        print rs.coerce3dpoint(shiftedpts[j])
        print avg_pt[i]

        mesh.Vertices.Add(rs.coerce3dpoint(c))
        mesh.Vertices.Add(rs.coerce3dpoint(shiftedpts[j]))
        mesh.Vertices.Add(avg_pt[i])
        mesh.Faces.AddFace(0,1,2)

    mesh.Normals.ComputeNormals()
    mesh.Compact()
    patches.append(mesh)


"""
    mesh = Rhino.Geometry.Mesh()
    mesh.Vertices.Add(0.0, 0.0, 1.0) #0
    mesh.Vertices.Add(1.0, 0.0, 1.0) #1
    mesh.Vertices.Add(2.0, 0.0, 1.0) #2

    mesh.Faces.AddFace(0, 1, 5, 4)
    mesh.Faces.AddFace(1, 2, 6, 5)

    
"""
# ---------- end python_5 ----------
explode = Explode(Curve=wbnaked, Recursive=True)  # -> Segments, Vertices
python_tree = PythonScript()  # -> out, a_Tree, b_Tree, c_Tree, d_Tree; inputs crv1: tree of Point3d, crv2: tree of Point3d
# ---------- python_tree: Python ----------
import Rhino.Geometry as rg
import rhinoscriptsyntax as rs
import Grasshopper as gh
import collections

def equalize(one_list, two_list):
    if len(one_list) > len(two_list):
        short = two_list
        llong = one_list
    else:
        short = one_list
        llong = two_list
    for i in range(len(short), len(llong)):
        print i
        short.append(short[-1])

print crv1.BranchCount
print crv2.BranchCount

a_Tree = gh.DataTree[object]()
b_Tree = gh.DataTree[object]()
c_Tree = gh.DataTree[object]()
d_Tree = gh.DataTree[object]()


for i in range(crv1.BranchCount):
    
    print i 
    
    c_one = crv1.Branch(i)        
    c_two = crv2.Branch(i)
    
    a = []
    b = []
    c = []
    d = []
    
    
    for n, pt in enumerate(c_one):
        
        if n == 0:
            pass
        
        if n == 0:
            a_Tree.Add(c_one[n],gh.Kernel.Data.GH_Path(i))
            b_Tree.Add(c_two[n],gh.Kernel.Data.GH_Path(i))
            c_Tree.Add(c_two[len(c_two)-1],gh.Kernel.Data.GH_Path(i))
            d_Tree.Add(c_one[len(c_one)-1],gh.Kernel.Data.GH_Path(i))
        
        if n > 0:
            #print 'N -', n
        
            a_Tree.Add(c_one[n],gh.Kernel.Data.GH_Path(i))
            b_Tree.Add(c_two[n],gh.Kernel.Data.GH_Path(i))
            c_Tree.Add(c_two[n-1],gh.Kernel.Data.GH_Path(i))
            d_Tree.Add(c_one[n-1],gh.Kernel.Data.GH_Path(i))
            
            m = [c_one[n], c_two[n], c_two[n-1], c_one[n-1]]
            
            #faces.append(rs.AddMesh(m,m))
        else:
            pass
# ---------- end python_tree ----------
mesh_2 = Mesh(python_3.open)
avr_2 = Average(Input=cp_3.Points)
end = EndPoints(Curve=explode.Segments)  # -> Start, End

# ---- group: Add Delaunay
wbnaked_2 = WeaverbirdsNakedBoundary(MeshClosedPolylines=mesh_2)
explode_2 = Explode(Curve=wbnaked_2, Recursive=True)  # -> Segments, Vertices
cp_4 = ControlPoints(Curve=explode_2.Segments)  # -> Points, Weights, Knots
viewer = ParamViewer(explode_2.Segments)
pshift = ShiftPaths(Data=cp_4.Points, Offset=-1)  # -> simplify(Data)
cull_3 = PythonScript(tree=pshift)  # -> dataTree; inputs tree: tree
# ---------- cull_3: Python ----------
import Grasshopper as gh

# Create a GH data tree (note the parentheses and type declaration)
dataTree = gh.DataTree[object]()


for i in range(tree.BranchCount):
    branchList = tree.Branch(i)
    if len(branchList) > 2:
        for b in branchList:
            dataTree.Add(b,gh.Kernel.Data.GH_Path(i))

"""
firstItems = []
for i in range(tree.BranchCount):
    branchList = tree.Branch(i)
    firstItems.append(branchList[0])



# Add the data from the nested list to the datatree
for i, v in enumerate(list):
    for d in v:
        dataTree.Add(d,gh.Kernel.Data.GH_Path(i))

# Add other stuff to the data tree using custom paths
for i in range(10):
    dataTree.Add(i,gh.Kernel.Data.GH_Path(69))
    dataTree.Add(i*5,gh.Kernel.Data.GH_Path(666))

# Return the tree to GH
ghTree = dataTree
"""
# ---------- end cull_3 ----------
del = DelaunayMesh(Points=cull_3, Plane=PlaneXY(0, 0, 0))  # -> flatten(Mesh)

# ----
long = LongestList(ListA=avr_2, ListB=end.Start, PaddingMode=2)  # -> ListA, ListB
merge = Merge(Data1=graft(long.ListA), Data2=graft(end.Start), Data3=graft(end.End))
conmesh = ConstructMesh(Vertices=merge, Faces={A=0, B=1, C=2, D=2})
joinweld = JoinWeld(Weld=True)
pshift_2 = ShiftPaths(Data=conmesh, Offset=-1)
mjoin = MeshJoin(Meshes=pshift_2)
panel_3 = Panel(merge)
