# Grasshopper definition get_Ghx_values.gh (Grasshopper 0.9.76)
# Copyright: 2017
# plug-ins: Python Interpreter

python = PythonScript()  # -> SliderNickNames, SliderGuids
# ---------- python: Python ----------
import Grasshopper as gh

# Get the Grasshopper component, document and objects
ghComp = ghenv.Component
ghDoc = ghComp.OnPingDocument()
ghObjects = ghDoc.Objects

# Iterate the GH objects and get their name/guid if they are a slider
SliderNickNames = []
SliderGuids = []

for obj in ghObjects:
    if type(obj) is gh.Kernel.Special.GH_NumberSlider:
        
        # Get the slider nick name
        name = obj.NickName
        SliderNickNames.append(name)
        
        # Get instance guid
        guid = obj.InstanceGuid
        SliderGuids.append(str(guid))
        
        # Set the value of the sliders named "Foo" and "Ham"
        if name == "Foo" or name == "Ham":
            obj.Slider.Value = 0.42
            obj.ExpireSolution(True)
# ---------- end python ----------
panel = Panel(python.SliderGuids)
panel_2 = Panel(python.SliderNickNames)

random = Random(Range=Domain(0, 100), Number=1, Seed=Slider(4, range=0..11))
int = Integer(random)
meshes = PythonScript(num_meshes=int)  # -> out; inputs num_meshes: Int32
# ---------- meshes: Python ----------
import scriptcontext as sc


sc.sticky["Meshes_To_Export"] = num_meshes

print num_meshes, ' variable copied to sticky variable to Rhino Python editor'
# ---------- end meshes ----------
