# Grasshopper definition get_Rhino_obj_names.gh (Grasshopper 0.9.76)
# plug-ins: Python Interpreter, Human

mesh = Mesh([<mesh referenced from the Rhino model> x3188])
objatts = ObjectAttributes(ObjectOrAttributes=mesh)  # -> Name, LayerName, LayerFullPath, Color, MaterialName, LinetypeName, GroupIndices, PlotWeight, UserDataKeys, UserDataValues
python = PythonScript(x=objatts.Name)  # -> out, a; inputs x: list
# ---------- python: Python ----------
a = []

for str in x:
    a.append(str)
    
a.sort()

dupes = set([y for y in a if a.count(y) > 1])

print dupes
# ---------- end python ----------
