# Grasshopper definition get_creampuff_volumes.gh (Grasshopper 0.9.76)
# plug-ins: Human

# CP Meshes must have
# FBX Obj name to ID
mesh = Mesh([<mesh referenced from the Rhino model> x58])
objatts = ObjectAttributes(ObjectOrAttributes=mesh)  # -> simplify(graft(Name)), LayerName, LayerFullPath, Color, MaterialName, LinetypeName, GroupIndices, PlotWeight, UserDataKeys, UserDataValues
disjoint = DisjointMesh(Mesh=mesh)  # -> simplify(Meshes)
volume = Volume(Geometry=disjoint)  # -> Volume, Centroid
abs = Absolute(Value=volume.Volume)
ins = InsertItems(List=abs, Item=objatts.Name, Indices=0, Wrap=True)
panel = Panel(ins)
