# Grasshopper definition mesh_reduction.gh (Grasshopper 0.9.76)
# plug-ins: MeshEdit Components, Volvox

mesh = Mesh([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])
m_vertnorm = CalculateVertexNormals(M=mesh, C=True, F=False, N=False)  # -> out, A; inputs M: Mesh
# ---------- m_vertnorm: VB ----------
    Component.Params.Input(0).Name = "Mesh"
    Component.Params.Input(0).Description = "Open or closed mesh"
    Component.Params.Input(1).Name = "Compute"
    Component.Params.Input(1).Description = "If true, face normals are computed"
    Component.Params.Input(2).Name = "Flip"
    Component.Params.Input(2).Description = "If true, normals are flipped "
    Component.Params.Input(3).Name = "Normalize"
    Component.Params.Input(3).Description = "If true, face normals are unitized"

    Component.Params.Output(1).Name = "Mesh"
    Component.Params.Output(1).Description = "If successful, a valid mesh"
    If m IsNot Nothing Then

      If C Then m.Normals.ComputeNormals()
      If F Then m.Flip(True, False, False)
      If N Then m.Normals.UnitizeNormals()

      A = M
    End If
# ---------- end m_vertnorm ----------
demesh = DeconstructMesh(Mesh=mesh)  # -> Vertices, Faces, Colours, Normals

# ----
# http://formularch.blogspot.com/2015/05/gh-mesh-reduction.html
to_reduce_by = Slider(0.95, range=0..1)
lng = ListLength(List=demesh.Vertices)
multiplication = Multiplication(A=lng, B=to_reduce_by)
reduce = RandomReduce(List=demesh.Vertices, Reduction=graft(multiplication), Seed=1)
cp = ClosestPoint(Point=demesh.Vertices, Cloud=reduce)  # -> ClosestPoint, CPIndex, Distance
conmesh = ConstructMesh(Vertices=cp.ClosestPoint, Faces=demesh.Faces)
cullvertices = MeshCullUnusedVertices(Mesh=conmesh)

panel = Panel(lng)

# ----
# Volvox example
number_slider = Slider(67, range=0..100)
cloud = ConstructCloud(Points=demesh.Vertices, Normals=demesh.Normals)
rsub = RandomSubsampling(Percent=number_slider, Seed=123)
cloude = CloudEngine(Cloud=cloud, Instruction0=rsub)

panel_2 = Panel(multiplication)
panel_3 = Panel(reduce)
