# Grasshopper definition 141118_GetSliderNickNames.gh (Grasshopper 0.9.76)
# plug-ins: Python Interpreter

foo = Slider(0.42, range=0..1)
bar = Slider(0.656, range=0..1)
spam = Slider(0.126, range=0..1)
eggs = Slider(0.654, range=0..1)
ham = Slider(0.42, range=0..1)
python = PythonScript()  # -> SliderNickNames, SliderGuids
# ---------- python: Python ----------
import Grasshopper as gh

# Get the Grasshopper component, document and objects
ghComp = ghenv.Component
ghDoc = ghComp.OnPingDocument()
ghObjects = ghDoc.Objects

# Iterate the GH objects and get their name/guid if they are a slider
SliderNickNames = []
SliderGuids = []
for obj in ghObjects:
    if type(obj) is gh.Kernel.Special.GH_NumberSlider:
        
        # Get the slider nick name
        name = obj.NickName
        SliderNickNames.append(name)
        
        # Get instance guid
        guid = obj.InstanceGuid
        SliderGuids.append(str(guid))
        
        # Set the value of the sliders named "Foo" and "Ham"
        if name == "Foo" or name == "Ham":
            obj.Slider.Value = 0.42
            obj.ExpireSolution(True)
# ---------- end python ----------
panel = Panel(python.SliderGuids)
panel_2 = Panel(python.SliderNickNames)
