# Grasshopper definition 150929_LinesByOverlap_00.gh (Grasshopper 0.9.76)
# plug-ins: Python Interpreter, Human

crv = Curve(reparameterize([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]))
crv_2 = Curve([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])
python = PythonScript(Lines=crv_2)  # -> LinesByOverlap, BranchIndices; inputs Lines: list of Line
# ---------- python: Python ----------
from collections import Counter
import Grasshopper as gh

# Get line midpoints
midPts = [l.PointAt(0.5) for l in Lines]

# Make empty datatree to append lines to based on count
LinesByOverlap = gh.DataTree[object]()

# Add the lines to the datatree based on their overlap count
for k,v in Counter(midPts).iteritems():
    for l in Lines:
        if l.PointAt(0.5) == k:
            LinesByOverlap.Add(l,gh.Kernel.Data.GH_Path(v))

# Get the indices in the datatree branches (i.e. how many overlaps exist in this branch)
BranchIndices = [p.Indices[0] for p in LinesByOverlap.Paths]
# ---------- end python ----------
previewlw = CustomPreviewLineweights(
    Geometry=python.LinesByOverlap,
    Shader=ColourSwatch(SwatchColor=RGB(74, 74, 74)),
    Thickness=graft(python.BranchIndices),
    Absolute=True)
