# Grasshopper definition 151014_SetNamedSliders_GHPython.gh (Grasshopper 0.9.76)
# plug-ins: Python Interpreter

# ---- group: Some Named Slider
bar = Slider(0.75, range=0..10)
foo = Slider(0.1, range=0..10)

# ---- group: Slider not in list is not triggered
ham = Slider(0.15, range=0..1)

# ---- group: Set the Named Slider Values
panel = Panel("""0.1
0.75""")
panel_2 = Panel("""Foo
Bar""")
R = Reset(Sliders=panel_2, Values=panel)  # inputs Sliders: list, Values: list
# ---------- R: Python ----------
""" Reset named sliders """

import Grasshopper as gh

# Get to the GH objects
ghObjects = ghenv.Component.OnPingDocument().Objects

# Iterate the GH objects
for obj in ghObjects:
    
    # Set the named slider values
    if obj.NickName in Sliders:
        if type(obj) is gh.Kernel.Special.GH_NumberSlider:
            
            # Set min/max
            obj.Slider.Minimum = 0
            obj.Slider.Maximum = 10
            
            # Set value
            obj.Slider.Value = Values[Sliders.index(obj.NickName)]
            
            # Update slider
            obj.ExpireSolution(True)
# ---------- end R ----------
