# Grasshopper definition DR_PointAverageVersion4.gh (Grasshopper 0.9.77)

voxel_size = Slider(189, range=100..5000)
box = Box({Plane=Plane(origin=(1043.325915, -1073.241964, 0), x=(-0.6077400034, 0.7941360641, 0), y=(-0.7669540599, -0.5869380376, 0.2593939281)), X=Domain(0, 2679.695232), Y=Domain(0, 347.8212823), Z=Domain(0, 1764.446034)})
pop3d = Populate3D(Region=box, Count=Slider(10000, range=0..10000), Seed=1)
c_script = CSharpScript(Points_P=pop3d, Voxels_V=voxel_size)  # -> out, Average_A; inputs Points_P: list of Point3d, Voxels_V: Double
# ---------- c_script: C# ----------
    Dictionary<string, Point3dList> dic = new Dictionary<string, Point3dList>();
    double f = 1.0 / V;
    
    // Put all points in the correct voxel sublist.
    foreach (Point3d point in P)
    {
      int x = (int) (point.X * f);
      int y = (int) (point.Y * f);
      int z = (int) (point.Z * f);
      string key = x + "," + y + "," + z;
      
      Point3dList list;
      if (dic.TryGetValue(key, out list))
        list.Add(point);
      else
      {
        list = new Point3dList();
        list.Add(point);
        dic.Add(key, list);
      }
    }
    
    // Average the points in all voxels.
    Point3d[] averages = new Point3d[dic.Count];
    
    int index = -1;
    foreach (Point3dList list in dic.Values)
    {
      double factor = 1.0 / list.Count;
      Point3d mean = Point3d.Origin;
      foreach (Point3d point in list)
        mean += point * factor;
      
      index++;
      averages[index] = mean;
    }
    
    A = averages;
# ---------- end c_script ----------
