# Grasshopper definition Meshjoin.gh (Grasshopper 0.9.76)
# plug-ins: BullAnt

cir_base = Circle(Plane=PlaneXY(0, 0, 0), Radius=Slider(130, range=0..130))
cir_mid = Circle(Plane=PlaneXY(0, 0, 0), Radius=Slider(66.7, range=0..130))
cir_top = Circle(Plane=PlaneXY(0, 0, 0), Radius=Slider(72.5, range=0..130))
Z = UnitZ(Factor=Slider(500, range=0..1000))
Z_2 = UnitZ(Factor=Slider(1000, range=0..1500))
move_top = Move(Geometry=cir_top, Motion=Z_2)  # -> Geometry, Transform
move_mid = Move(Geometry=cir_mid, Motion=Z)  # -> Geometry, Transform
end = EndPoints(Curve=move_top.Geometry)  # -> Start, End
end_2 = EndPoints(Curve=move_mid.Geometry)  # -> Start, End
end_3 = EndPoints(Curve=cir_base)  # -> Start, End
arc = Arc3Pt(PointA=end_3.Start, PointB=end_2.Start, PointC=end.Start)  # -> Arc, Plane, Radius
swp1 = Sweep1(Rail=cir_base, Sections=arc.Arc, Miter=1)
sdivide = DivideSurface(Surface=swp1, UCount=15, VCount=60)  # -> Points, Normals, Parameters
sframes = SurfaceFrames(Surface=swp1, UCount=15, VCount=60)  # -> Frames, Parameters
item = ListItem(List=sdivide.Parameters, Index=2, Wrap=True)
item_2 = ListItem(List=sframes.Frames, Index=1, Wrap=True)
sph = Sphere(Base=item_2, Radius=16)
bbx = BrepBrep(BrepA=swp1, BrepB=sph)  # -> flatten(Curves), Points
srfsplit = SurfaceSplit(Surface=swp1, Curves=bbx.Curves)
area = Area(Geometry=srfsplit)  # -> Area, Centroid
sort = SortList(Keys=area.Area, ValuesA=srfsplit)  # -> Keys, reverse(ValuesA)
item_3 = ListItem(List=sort.ValuesA, Index=0, Wrap=True)
crvsrf = CurveOnSurface(Surface=item_3, UVCoordinates=flatten(item), Closed=False)  # -> Curve, Length, Domain
srfsplit_2 = SurfaceSplit(Surface=item_3, Curves=crvsrf.Curve)
item_4 = ListItem(List=srfsplit_2, Index=0, Wrap=True)  # -> Item, Item1
planar = Planar(Curve=crvsrf.Curve)  # -> Planar, Plane, Deviation
srf = Surface(item_4.Item)
srf_2 = Surface(item_4.Item1)
mesh_uv = MeshSurface(Surface=srf, UCount=40, VCount=50, Overhang=False, Equalize=False)
deconstruct_mesh = DeconstructMesh(Mesh=mesh_uv)  # -> Vertices, Faces, Colours, Normals
mesh = MeshBrep(
    Brep=srf_2,
    Settings={GridMaxCount=0, GridMinCount=16, JaggedSeams=False, MaxEdgeLength=0, MinEdgeLength=0.0001, MinTolerance=0, Refine=True, RefineAngle=0, RelativeTolerance=0.65, SimplePlanes=True, Tolerance=0})
deconstruct_mesh_2 = DeconstructMesh(Mesh=mesh)  # -> Vertices, Faces, Colours, Normals
plane_closest_point = PlaneClosestPoint(Point=deconstruct_mesh_2.Vertices, Plane=planar.Plane)  # -> Point, UVPoint, Distance
bounding_box = BoundingBox(Content=mesh_uv, Plane=PlaneXY(0, 0, 0))  # -> Box, Box_2
absolute = Absolute(Value=plane_closest_point.Distance)
top = Text("Top")
base = Text("Base")
deconstruct_box = DeconstructBox(Box=bounding_box.Box)  # -> Plane, X, Y, Z
smaller_than = SmallerThan(FirstNumber=absolute, SecondNumber="0.1")  # -> SmallerThan, OrEqualTo
deconstruct_domain = DeconstructDomain(Domain=deconstruct_box.Z)  # -> Start, End
ggp2d = GgGSACreate2dFiniteElementProp(Name=base, Thickness=Slider(0.25, range=0..1))
ggp2d_2 = GgGSACreate2dFiniteElementProp(Name=top, Thickness=Slider(0.822, range=0..1))
dispatch = Dispatch(List=deconstruct_mesh_2.Vertices, DispatchPattern=smaller_than.SmallerThan)  # -> ListA, ListB
construct_point = ConstructPoint(XCoordinate=0, YCoordinate=0, ZCoordinate=deconstruct_domain.Start)
plane_closest_point_2 = PlaneClosestPoint(Point=deconstruct_mesh.Vertices, Plane=construct_point)  # -> Point, UVPoint, Distance
ggbake = GgGSABakeModel(ClipSummary=False, NewFile=False)
absolute_2 = Absolute(Value=plane_closest_point_2.Distance)
ggmfe = GgGSAMeshConvertFiniteElements(Prop=ggp2d_2, Group=1, Mesh=mesh_uv, Angle=0)  # -> StructureModelFiniteElements, StructureModelNodes, MeshIdentifyingFacesBreachingShapeChecks
ggmfe_2 = GgGSAMeshConvertFiniteElements(Prop=ggp2d, Group=1, Mesh=mesh, Angle=0)  # -> StructureModelFiniteElements, StructureModelNodes, MeshIdentifyingFacesBreachingShapeChecks
smaller_than_2 = SmallerThan(FirstNumber=absolute_2, SecondNumber="0.1")  # -> SmallerThan, OrEqualTo
dispatch_2 = Dispatch(List=deconstruct_mesh.Vertices, DispatchPattern=smaller_than_2.SmallerThan)  # -> ListA, ListB
point = Point(dispatch.ListA)
point_2 = Point(dispatch_2.ListA)
closest_point = ClosestPoint(Point=point_2, Cloud=point)  # -> ClosestPoint, CPIndex, Distance
closest_point_2 = ClosestPoint(Point=point, Cloud=point_2)  # -> ClosestPoint, CPIndex, Distance
curve_closest_point = CurveClosestPoint(Point=point_2, Curve=crvsrf.Curve)  # -> Point, Parameter, Distance
curve_closest_point_2 = CurveClosestPoint(Point=point, Curve=crvsrf.Curve)  # -> Point, Parameter, Distance
line = Line(StartPoint=closest_point_2.ClosestPoint, EndPoint=point)
line_2 = Line(StartPoint=point_2, EndPoint=closest_point.ClosestPoint)
sort_list = SortList(Keys=curve_closest_point.Parameter, ValuesA=point_2)  # -> Keys, ValuesA
sort_list_2 = SortList(Keys=curve_closest_point_2.Parameter, ValuesValuesA=point)  # -> Keys, ValuesValuesA
polyline = PolyLine(Vertices=sort_list.ValuesA, Closed=True)
polyline_2 = PolyLine(Vertices=sort_list_2.ValuesValuesA, Closed=True)
ggremoveduplicates = GgRemoveDuplicates(Curves=[line_2, line], Tol=0.01)
explode = Explode(Curve=polyline, Recursive=True)  # -> Segments, Vertices
explode_2 = Explode(Curve=polyline_2, Recursive=True)  # -> Segments, Vertices
ggnetworktomesh = GgNetworkToMesh(Curves=[explode_2.Segments, explode.Segments, ggremoveduplicates])
