# Grasshopper definition OJ_ImportStl_20131209.gh (Grasshopper 0.9.61)

path = FilePath()
vb = VBScript(F=path)  # -> out, Mesh
# ---------- vb: VB ----------
    Dim stl = My.Computer.FileSystem.ReadAllBytes(F)
    Dim numtris As Long = BitConverter.ToInt32(stl, 80)
    Dim c As Integer
    Dim tempmesh As New mesh
    For c = 0 To numtris - 1
      tempmesh.Vertices.setvertex(c * 3, _
        BitConverter.ToSingle(stl, c * 50 + 96), _
        BitConverter.ToSingle(stl, c * 50 + 100), _
        BitConverter.ToSingle(stl, c * 50 + 104))
      tempmesh.Vertices.setvertex(c * 3 + 1, _
        BitConverter.ToSingle(stl, c * 50 + 108), _
        BitConverter.ToSingle(stl, c * 50 + 112), _
        BitConverter.ToSingle(stl, c * 50 + 116))
      tempmesh.Vertices.setvertex(c * 3 + 2, _
        BitConverter.ToSingle(stl, c * 50 + 120), _
        BitConverter.ToSingle(stl, c * 50 + 124), _
        BitConverter.ToSingle(stl, c * 50 + 128))
      tempmesh.Faces.setface(c, c * 3, c * 3 + 1, c * 3 + 2)
    Next
    Mesh = tempmesh
# ---------- end vb ----------
mesh = Mesh(vb.Mesh)
