# Grasshopper definition ReadingAnSTLFileCPYTHONVERSION.gh (Grasshopper 0.9.76)
# plug-ins: Python Interpreter

# ---- group: File Path With FORWARD SLASHES and NO SPACES
panel = Panel("C:/Users/Scott/Desktop/29-33_stls/0_33_0.stl")

# ----
python = PythonScript(FILE_PATH=panel)  # -> out, MESH; disabled
# ---------- python: Python ----------
import Rhino

mesh = Rhino.Geometry.Mesh() # Initialize "mesh" variable as a blank mesh object to hold each face.
MESH = Rhino.Geometry.Mesh() # Initialize "MESH" variable as a blank mesh object to accumulate faces.

with open(FILE_PATH) as f:

  for line in f:

    if "vertex" in line:
      q = line.replace("      vertex ", "")
      q = q.replace("\n", "")
      q = [float(x) for x in q.split()]
      mesh.Vertices.Add(q[0],q[1],q[2]) # Fill mesh with three vertex lines in a row.

    if "endloop" in line: # File itself tells us we are done with three vertices for one face.
      mesh.Faces.AddFace(0,1,2) # Create a single face mesh.
      MESH.Append(mesh) # Magically build a real multi-face mesh while removing redundant vertices.
      mesh = Rhino.Geometry.Mesh() # Reinitialize empty mesh object for each mesh face.

  MESH.Normals.ComputeNormals() # Gives nice mesh and preview but makes the script take longer.
# ---------- end python ----------
mesh = Mesh(python.MESH)
preview = CustomPreview(Geometry=mesh, Shader="Pink")
