# Grasshopper definition ReduceMesh.gh (Grasshopper 0.8.66)

percentage = Panel("10")
mesh = Mesh()
reducemesh = CSharpScript(M=mesh, P=percentage)  # -> out, A; inputs M: Mesh, P: Double
# ---------- reducemesh: C# ----------
    if(M != null){
      Guid meshObj = doc.Objects.AddMesh(M);
      doc.Objects.UnselectAll();
      doc.Objects.Select(meshObj);
      Rhino.RhinoApp.RunScript("_-ReduceMesh _ReductionPercentage " + Convert.ToString(P) + " _Enter", false);
      Rhino.DocObjects.RhinoObject MObj = doc.Objects.GetSelectedObjects(false, false).First();
      doc.Objects.Delete(meshObj, true);
      A = MObj.Geometry;
    }
# ---------- end reducemesh ----------
