# Grasshopper definition ReduceMesh_andrewheumann.gh (Grasshopper 0.9.76)

percentage = Panel("90")
mesh = Mesh([<mesh referenced from the Rhino model> x4])
demesh = DeconstructMesh(Mesh=flatten(mesh))  # -> Vertices, flatten(Faces), Colours, Normals
reducemesh = CSharpScript(M=mesh, P=percentage)  # -> out, A; inputs M: Mesh, P: Double
# ---------- reducemesh: C# ----------
    if(M != null){
      Guid meshObj = doc.Objects.AddMesh(M);
      doc.Objects.UnselectAll();
      doc.Objects.Select(meshObj);
      Rhino.RhinoApp.RunScript("_-ReduceMesh _ReductionPercentage " + Convert.ToString(P) + " _Enter", false);
      Rhino.DocObjects.RhinoObject MObj = doc.Objects.GetSelectedObjects(false, false).First();
      doc.Objects.Delete(meshObj, true);
      A = MObj.Geometry;
    }
# ---------- end reducemesh ----------
lng = ListLength(List=demesh.Faces)
ma = MassAddition(Input=lng)  # -> Result, PartialResults
panel = Panel(ma.Result)
