# Grasshopper definition UO_01_MESH-LOFT.gh (Grasshopper 0.9.76)

# ----
# INPUTS
u_divisions = Slider(500, range=1..500)
v_divisions = Slider(200, range=1..200)
input_curve_b = Curve(<curve referenced from the Rhino model>)
input_curve_a = Curve(<curve referenced from the Rhino model>)

# ----
# MESH LOFT
cluster = Cluster(input_curve_a=input_curve_a, input_curve_b=input_curve_b, u_divisions=u_divisions, v_divisions=v_divisions)  # -> single_mesh_2, u_mesh_strips_2, v_mesh_strips_2, individual_mesh_faces_2

# ----
# OUTPUTS / PREVIEW
swatch = ColourSwatch(SwatchColor=RGB(155, 200, 222))
material = CreateMaterial(
    Diffuse=swatch,
    Specular=ColourSwatch(SwatchColor=RGB(116, 60, 222)),
    Emission=ColourSwatch(SwatchColor=RGB(0, 0, 0)),
    Transparency=0,
    Shine=2)
mesh_out = Mesh(cluster.single_mesh_2)
preview = CustomPreview(Geometry=mesh_out, Shader=material)

# ==== cluster Cluster
input_curve_a = ClusterInput()
input_curve_b = ClusterInput()
u_divisions = ClusterInput()
v_divisions = ClusterInput()

toggle = BooleanToggle(True)
input_curve_a_2 = Curve(input_curve_a)
input_curve_b_2 = Curve(input_curve_b)
u_divisions_2 = Number(u_divisions)
v_divisions_2 = Number(v_divisions)
divide = DivideCurve(Curve=reparameterize(input_curve_b_2), Count=u_divisions_2, Kinks=toggle)  # -> Points, Tangents, Parameters
divide_2 = DivideCurve(Curve=reparameterize(input_curve_a_2), Count=u_divisions_2, Kinks=toggle)  # -> Points, Tangents, Parameters
ln = Line(StartPoint=divide_2.Points, EndPoint=divide.Points)
divide_3 = DivideCurve(Curve=flatten(ln), Count=v_divisions_2, Kinks=toggle)  # -> simplify(Points), Tangents, Parameters
toggle_2 = BooleanToggle(False)
cls = Closed(Curve=input_curve_a_2)  # -> Closed, Periodic
relitem = RelativeItem(Tree=divide_3.Points, Offset="{0}(0)", WrapPaths=cls.Closed, WrapItems=toggle_2)  # -> ItemA, graft(ItemB)
relitem_2 = RelativeItem(Tree=divide_3.Points, Offset="{1}(0)", WrapPaths=cls.Closed, WrapItems=toggle_2)  # -> ItemA, graft(ItemB)
relitem_3 = RelativeItem(Tree=divide_3.Points, Offset="{0}(1)", WrapPaths=cls.Closed, WrapItems=toggle_2)  # -> ItemA, graft(ItemB)
relitem_4 = RelativeItem(Tree=divide_3.Points, Offset="{1}(1)", WrapPaths=cls.Closed, WrapItems=toggle_2)  # -> ItemA, graft(ItemB)
merge = Merge(Data1=relitem.ItemB, Data2=relitem_2.ItemB, Data3=relitem_4.ItemB, Data4=relitem_3.ItemB)
prune = PruneTree(Tree=merge, Minimum=4, Maximum=0)
conmesh = ConstructMesh(Vertices=prune, Faces={A=0, B=1, C=2, D=3})
pshift = ShiftPaths(Data=conmesh, Offset=-1)
pshift_2 = ShiftPaths(Data=conmesh, Offset=-1)
mjoin = MeshJoin(Meshes=flatten(conmesh))
mjoin_2 = MeshJoin(Meshes=pshift_2)
flip = FlipMatrix(Data=pshift)
mjoin_3 = MeshJoin(Meshes=flip)
single_mesh = Mesh(mjoin)
u_mesh_strips = Mesh(mjoin_3)
v_mesh_strips = Mesh(mjoin_2)
individual_mesh_faces = Mesh(conmesh)

single_mesh_2 = ClusterOutput(single_mesh)
u_mesh_strips_2 = ClusterOutput(u_mesh_strips)
v_mesh_strips_2 = ClusterOutput(v_mesh_strips)
individual_mesh_faces_2 = ClusterOutput(individual_mesh_faces)
