# Grasshopper definition edgefaces.gh (Grasshopper 0.8.66)

mplane = MeshPlane(Base=PlaneXY(0, 0, 0), Width=Domain(-10, 10), Height=Domain(-10, 10), WidthCount=10, HeightCount=10)  # -> Mesh, Area
mesh = Mesh(mplane.Mesh)
c_script = CSharpScript(m=mesh)  # -> out, A, B; inputs m: Mesh
# ---------- c_script: C# ----------
    List<int> BoundaryFaces = new List<int>();
    List<int> InternalFaces = new List<int>();

    for (int i = 0;i < m.Faces.Count;i++)
    {
      if (m.Faces.HasNakedEdges(i))
        BoundaryFaces.Add(i);
      else
        InternalFaces.Add(i);
    }

    A = BoundaryFaces;
    B = InternalFaces;
# ---------- end c_script ----------
mcomp = Decompose(Mesh=mesh)  # -> Vertices, Faces, Colours, Normals
item = ListItem(List=mcomp.Faces, Index=c_script.B, Wrap=False)
item_2 = ListItem(List=mcomp.Faces, Index=c_script.A, Wrap=False)
mesh_2 = Mesh(Vertices=mcomp.Vertices, Faces=item_2)
mesh_3 = Mesh(Vertices=mcomp.Vertices, Faces=item)
