# Grasshopper definition mesh_naked_face.gh (Grasshopper 0.8.66)

mplane = MeshPlane(Base=PlaneXY(0, 0, 0), Width=Domain(-10, 10), Height=Domain(-10, 10), WidthCount="100", HeightCount="100")  # -> Mesh, Area
input_mesh = Mesh(mplane.Mesh)
naked_mesh_faces = CSharpScript(M=input_mesh, DataComparison="cross_reference")  # -> out, NakedFaces, ClothedFaces; inputs M: Mesh
# ---------- naked_mesh_faces: C# ----------
    List<MeshFace> mfN = new List<MeshFace>();
    List<MeshFace> mfNN = new List<MeshFace>();
    bool[] nakedVerts = M.GetNakedEdgePointStatus();

    foreach (MeshFace mf in M.Faces){
      if(nakedVerts[mf.A]){
        mfN.Add(mf);
        continue;
      }
      if(nakedVerts[mf.B]){
        mfN.Add(mf);
        continue;
      }
      if(nakedVerts[mf.C]){
        mfN.Add(mf);
        continue;
      }
      if(nakedVerts[mf.D]){
        mfN.Add(mf);
        continue;
      }
      mfNN.Add(mf);


    }
    NakedFaces = mfN;
    ClothedFaces = mfNN;
# ---------- end naked_mesh_faces ----------
mcomp = Decompose(Mesh=input_mesh)  # -> Vertices, Faces, Colours, Normals
mesh = Mesh(Vertices=mcomp.Vertices, Faces=naked_mesh_faces.ClothedFaces)
mesh_2 = Mesh(Vertices=mcomp.Vertices, Faces=naked_mesh_faces.NakedFaces)
non_naked_faces = Mesh(mesh)
naked_faces = Mesh(mesh_2)
