# Grasshopper definition read_STL_from_file.gh (Grasshopper 0.9.76)
# plug-ins: Python Interpreter

# ---- group: File Path With FORWARD SLASHES and NO SPACES
# File path is OFF
panel = Panel("C:/Users/Scott/Desktop/29-33_stls/0_33_0.stl")  # disabled

# ---- group: http://www.grasshopper3d.com/forum/topics/import-an-stl-file-direct-in-grasshopper
path = FilePath(panel)
vb = VBScript(F=path)  # -> out, Mesh
# ---------- vb: VB ----------
    Dim stl = My.Computer.FileSystem.ReadAllBytes(F)
    print("File length: " & stl.length() & " bytes")
    Dim numtris As Long = BitConverter.ToInt32(stl, 80)
    print("Number of triangles: " & numtris)
    Dim c,pos As Integer
    Dim tempmesh As New mesh
    Dim tempvect As Vector3f
    If (numtris * 50 + 84 = stl.length()) Then
      print("STL file length matches the number of triangle faces")
      For c = 0 To numtris - 1
        pos = c * 50 + 84
        tempvect = readVect3f(stl, pos)
        With tempmesh
          .Vertices.setvertex(c * 3, readPoint3f(stl, pos))
          .Vertices.setvertex(c * 3 + 1, readPoint3f(stl, pos))
          .Vertices.setvertex(c * 3 + 2, readPoint3f(stl, pos))
          .Faces.setface(c, c * 3, c * 3 + 1, c * 3 + 2)
          .Normals.SetNormal(c * 3, tempvect)
          .Normals.SetNormal(c * 3 + 1, tempvect)
          .Normals.SetNormal(c * 3 + 2, tempvect)
        End With
      Next
      tempmesh.Weld(math.PI)
    Else
      print("STL file length does not match the number of triangle faces")
    End If
    Mesh = tempmesh
# ---------- vb: VB additional code ----------
  '
  Private Function readSingle(ByRef stl As Byte(), ByRef pos As Integer) As Single
    readSingle = BitConverter.ToSingle(stl, pos)
    pos = pos + 4
  End Function

  Private Function readVect3f(ByRef stl As Byte(), ByRef pos As Integer) As Vector3f
    readVect3f = New Vector3f(readSingle(stl, pos), readSingle(stl, pos), readSingle(stl, pos))
  End Function

  Private Function readPoint3f(ByRef stl As Byte(), ByRef pos As Integer) As Point3f
    readPoint3f = New Point3f(readSingle(stl, pos), readSingle(stl, pos), readSingle(stl, pos))
  End Function
# ---------- end vb ----------
preview = CustomPreview(
    Geometry=vb.Mesh,
    Shader={ambient=RGB(0, 0, 0), diffuse=RGB(255, 105, 180), emission=RGB(76, 32, 54), shine=0.5, specular=RGB(255, 255, 255), transparency=0})

# ---- group: http://www.grasshopper3d.com/forum/topics/importing-stl-format-file-to-grasshopper
python = PythonScript(FILE_PATH=panel)  # -> out, MESH
# ---------- python: Python ----------
import Rhino

mesh = Rhino.Geometry.Mesh() # Initialize "mesh" variable as a blank mesh object to hold each face.
MESH = Rhino.Geometry.Mesh() # Initialize "MESH" variable as a blank mesh object to accumulate faces.

with open(FILE_PATH) as f:

  for line in f:

    if "vertex" in line:
      q = line.replace("      vertex ", "")
      q = q.replace("\n", "")
      q = [float(x) for x in q.split()]
      mesh.Vertices.Add(q[0],q[1],q[2]) # Fill mesh with three vertex lines in a row.

    if "endloop" in line: # File itself tells us we are done with three vertices for one face.
      mesh.Faces.AddFace(0,1,2) # Create a single face mesh.
      MESH.Append(mesh) # Magically build a real multi-face mesh while removing redundant vertices.
      mesh = Rhino.Geometry.Mesh() # Reinitialize empty mesh object for each mesh face.

  MESH.Normals.ComputeNormals() # Gives nice mesh and preview but makes the script take longer.
# ---------- end python ----------
mesh = Mesh(python.MESH)
preview_2 = CustomPreview(Geometry=mesh, Shader="Pink")

# ----
disjoint = DisjointMesh(Mesh=vb.Mesh)
